# Dynamo custom node Curve.angleBetweenCoplanarLines.dyf (Dynamo 2.0.3.8810)
# category: Easen It Nodes
# Finds the sweep for an angle created between two coplanar lines

firstLine = Input(firstLine: var[]..[])
secondLine = Input(secondLine: var[]..[])
centerPoint = Input(centerPoint: var[]..[])
python_script = Python(IN[0]=firstLine, IN[1]=secondLine, IN[2]=centerPoint)
# ---------- python_script.python (34 lines) ----------
# Enable Python support and load DesignScript library
import clr
clr.AddReference('ProtoGeometry')
from Autodesk.DesignScript.Geometry import *


 
# Input list
line_1=IN[0]
line_2=IN[1]
centerPnt=IN[2]
# method that creates an arc and returns the sweeep angle for that arc
def BetweenLinesArcAngle(line_1,line_2,midPnt):
	arcStartPnt=Curve.PointAtParameter(line_1,0.5)
	arcEndPnt=Curve.PointAtParameter(line_2,0.5)
	arc=Arc.ByCenterPointStartPointEndPoint(midPnt,arcStartPnt,arcEndPnt)
	angle=Arc.SweepAngle.GetValue(arc)
	return angle
	
OUT = BetweenLinesArcAngle(line_1,line_2,centerPnt)

#______________________________________________________________________________________________________________________________________________________#
#______________________________________________________________________________________________________________________________________________________#
                                                                                                                                              
#     88888888888                                                      88               888b      88                        88                         #
#     88                                                               88    ,d         8888b     88                        88                         #
#     88                                                               88    88         88 `8b    88                        88                         #
#     88aaaaa      ,adPPYYba,  ,adPPYba,   ,adPPYba,  8b,dPPYba,       88  MM88MMM      88  `8b   88   ,adPPYba,    ,adPPYb,88   ,adPPYba,  ,adPPYba,  #
#     88"""""      ""     `Y8  I8[    ""  a8P_____88  88P'   `"8a      88    88         88   `8b  88  a8"     "8a  a8"    `Y88  a8P_____88  I8[    ""  #
#     88           ,adPPPPP88   `"Y8ba,   8PP"""""""  88       88      88    88         88    `8b 88  8b       d8  8b       88  8PP"""""""   `"Y8ba,   #
#     88           88,    ,88  aa    ]8I  "8b,   ,aa  88       88      88    88,        88     `8888  "8a,   ,a8"  "8a,   ,d88  "8b,   ,aa  aa    ]8I  #
#     88888888888  `"8bbdP"Y8  `"YbbdP"'   `"Ybbd8"'  88       88      88    "Y888      88      `888   `"YbbdP"'    `"8bbdP"Y8   `"Ybbd8"'  `"YbbdP"'  #
#______________________________________________________________________________________________________________________________________________________#                                                                                                                                                 
#______________________________________________________________________________________________________________________________________________________#
# ----------------------------------------
angle = Output(python_script)
