# Dynamo custom node Curve.divideTriangle.dyf (Dynamo 2.0.3.8810)
# category: Easen It Nodes
# Create sub-traingles by edges center points for a given triangle

listOfTriangles = Input(listOfTriangles: var[]..[])
stopAtLength = Input(stopAtLength: var[]..[])
python_script = Python(IN[0]=listOfTriangles, IN[1]=stopAtLength)
# ---------- python_script.python (59 lines) ----------
# Enable Python support and load DesignScript library
import clr
clr.AddReference('ProtoGeometry')
from Autodesk.DesignScript.Geometry import *

                                                                                                                                            



# The inputs to this node will be stored as a list in the IN variables.
triangle = IN[0]
stopLength = IN[1]
# The output lists that will eventually going to be stored in the OUT variable.
result=[]
###############################################################################
# A recrusive method that will iterat over sub-traingles until it reaches a certain length that will return all of the sub traingles
def iterateTriangle(triangle):
###############################################################################
# Finding the new points for the new sub-traingles
	crvs=Polygon.Curves(triangle)
	triCorners=Polygon.Corners(triangle)
	centerPnts=[]
	for i in crvs:
		centerPnts.append(Curve.PointAtParameter(i,0.5))
###############################################################################
# Creating sub-traingles
	tris=[]
	tris.append(Polygon.ByPoints([centerPnts[0],centerPnts[1],centerPnts[2]]))
	tris.append(Polygon.ByPoints([centerPnts[0],centerPnts[1],triCorners[1]]))
	tris.append(Polygon.ByPoints([centerPnts[1],centerPnts[2],triCorners[2]]))
	tris.append(Polygon.ByPoints([centerPnts[0],centerPnts[2],triCorners[0]]))
###############################################################################
# Adding sub-traingles to output list
	pCrvs=Polygon.Curves(tris[0])
	if Curve.Length.GetValue(pCrvs[0]) < stopLength:
		result.append(tris)
		return
	else:
		for i in tris:
			iterateTriangle(i)
# Calling iterateTriangle method for multiple input triangles			
for i in triangle:
	iterateTriangle(i)

OUT = result

#______________________________________________________________________________________________________________________________________________________#
#______________________________________________________________________________________________________________________________________________________#
                                                                                                                                              
#     88888888888                                                      88               888b      88                        88                         #
#     88                                                               88    ,d         8888b     88                        88                         #
#     88                                                               88    88         88 `8b    88                        88                         #
#     88aaaaa      ,adPPYYba,  ,adPPYba,   ,adPPYba,  8b,dPPYba,       88  MM88MMM      88  `8b   88   ,adPPYba,    ,adPPYb,88   ,adPPYba,  ,adPPYba,  #
#     88"""""      ""     `Y8  I8[    ""  a8P_____88  88P'   `"8a      88    88         88   `8b  88  a8"     "8a  a8"    `Y88  a8P_____88  I8[    ""  #
#     88           ,adPPPPP88   `"Y8ba,   8PP"""""""  88       88      88    88         88    `8b 88  8b       d8  8b       88  8PP"""""""   `"Y8ba,   #
#     88           88,    ,88  aa    ]8I  "8b,   ,aa  88       88      88    88,        88     `8888  "8a,   ,a8"  "8a,   ,d88  "8b,   ,aa  aa    ]8I  #
#     88888888888  `"8bbdP"Y8  `"YbbdP"'   `"Ybbd8"'  88       88      88    "Y888      88      `888   `"YbbdP"'    `"8bbdP"Y8   `"Ybbd8"'  `"YbbdP"'  #
#______________________________________________________________________________________________________________________________________________________#                                                                                                                                                 
#______________________________________________________________________________________________________________________________________________________#     
# ----------------------------------------
dividedTriangles = Output(python_script)
