# Dynamo custom node Curve.getCurveApprox.dyf (Dynamo 2.0.3.8810)
# category: Easen It Nodes
# Create an approximate lines within a convex of curve

curve = Input(curve: var[]..[])
numberOflines = Input(numberOflines: var[]..[])
python_script = Python(IN[0]=curve, IN[1]=numberOflines)
# ---------- python_script.python (40 lines) ----------
# Enable Python support and load DesignScript library
import clr
clr.AddReference('ProtoGeometry')
from Autodesk.DesignScript.Geometry import *
                          

# The inputs to this node will be stored as a list in the IN variables.
crv = IN[0]
approxParameter=IN[1]
# A method that creates and approximation lines for a curvilnear
def getCurveAprox(curve,approxParameter):
	approxParameter+=1
	parameters=[]
	step=1.0/(approxParameter-1)
	for i in range(0,approxParameter):
		parameters.append(i*step)
	pntsAtParam=[]
	for i in parameters:
		pntsAtParam.append(Curve.PointAtParameter(curve,i))
	lines=[]
	for i in range(1,len(pntsAtParam)):
		lines.append(Line.ByStartPointEndPoint(pntsAtParam[i-1],pntsAtParam[i]))
	return lines

OUT =getCurveAprox(crv,approxParameter)


#______________________________________________________________________________________________________________________________________________________#
#______________________________________________________________________________________________________________________________________________________#
                                                                                                                                              
#     88888888888                                                      88               888b      88                        88                         #
#     88                                                               88    ,d         8888b     88                        88                         #
#     88                                                               88    88         88 `8b    88                        88                         #
#     88aaaaa      ,adPPYYba,  ,adPPYba,   ,adPPYba,  8b,dPPYba,       88  MM88MMM      88  `8b   88   ,adPPYba,    ,adPPYb,88   ,adPPYba,  ,adPPYba,  #
#     88"""""      ""     `Y8  I8[    ""  a8P_____88  88P'   `"8a      88    88         88   `8b  88  a8"     "8a  a8"    `Y88  a8P_____88  I8[    ""  #
#     88           ,adPPPPP88   `"Y8ba,   8PP"""""""  88       88      88    88         88    `8b 88  8b       d8  8b       88  8PP"""""""   `"Y8ba,   #
#     88           88,    ,88  aa    ]8I  "8b,   ,aa  88       88      88    88,        88     `8888  "8a,   ,a8"  "8a,   ,d88  "8b,   ,aa  aa    ]8I  #
#     88888888888  `"8bbdP"Y8  `"YbbdP"'   `"Ybbd8"'  88       88      88    "Y888      88      `888   `"YbbdP"'    `"8bbdP"Y8   `"Ybbd8"'  `"YbbdP"'  #
#______________________________________________________________________________________________________________________________________________________#                                                                                                                                                 
#______________________________________________________________________________________________________________________________________________________#    
# ----------------------------------------
lines = Output(python_script)
