# Dynamo custom node Curve.makePolyCurvesUnconnectedCurves.dyf (Dynamo 2.0.3.8810)
# category: Easen It Nodes
# Attempts to  create a polyCurve for a non-sorted list of curves asserted that the given curves are connected to a tolerance of 0.0001

curves = Input(curves: var[]..[])
python_script = Python(IN[0]=curves)
# ---------- python_script.python (39 lines) ----------
# Enable Python support and load DesignScript library
import clr
clr.AddReference('ProtoGeometry')
from Autodesk.DesignScript.Geometry import *

# The inputs to this node will be stored as a list in the IN variables.
crvs = IN[0]
polyCrvs=[]

# A method to create polyCurve by certian index.
def makePolycurve(startIndex,EndIndex):
	tempCrv=[]
	for i in range(startIndex,EndIndex):
		tempCrv.append(crvs[i])
	polyCrvs.append(PolyCurve.ByJoinedCurves(tempCrv, 0.001))

firstIndex=0
for i in range(1,len(crvs)):
	if Geometry.DistanceTo(crvs[i-1],crvs[i]) != 0:
		makePolycurve(firstIndex,i-1)
		firstIndex=i
makePolycurve(firstIndex,len(crvs))

OUT=polyCrvs


#______________________________________________________________________________________________________________________________________________________#
#______________________________________________________________________________________________________________________________________________________#
                                                                                                                                              
#     88888888888                                                      88               888b      88                        88                         #
#     88                                                               88    ,d         8888b     88                        88                         #
#     88                                                               88    88         88 `8b    88                        88                         #
#     88aaaaa      ,adPPYYba,  ,adPPYba,   ,adPPYba,  8b,dPPYba,       88  MM88MMM      88  `8b   88   ,adPPYba,    ,adPPYb,88   ,adPPYba,  ,adPPYba,  #
#     88"""""      ""     `Y8  I8[    ""  a8P_____88  88P'   `"8a      88    88         88   `8b  88  a8"     "8a  a8"    `Y88  a8P_____88  I8[    ""  #
#     88           ,adPPPPP88   `"Y8ba,   8PP"""""""  88       88      88    88         88    `8b 88  8b       d8  8b       88  8PP"""""""   `"Y8ba,   #
#     88           88,    ,88  aa    ]8I  "8b,   ,aa  88       88      88    88,        88     `8888  "8a,   ,a8"  "8a,   ,d88  "8b,   ,aa  aa    ]8I  #
#     88888888888  `"8bbdP"Y8  `"YbbdP"'   `"Ybbd8"'  88       88      88    "Y888      88      `888   `"YbbdP"'    `"8bbdP"Y8   `"Ybbd8"'  `"YbbdP"'  #
#______________________________________________________________________________________________________________________________________________________#                                                                                                                                                 
#______________________________________________________________________________________________________________________________________________________#                              
# ----------------------------------------
PolyCurves = Output(python_script)
