# Dynamo custom node ExtraUtil.countCPU.dyf (Dynamo 2.0.3.8810)
# category: Easen It Nodes
# Counts the CPU for your machine.
# Note : Python code is not made be Easen It Nodes for more information visit :
# https://github.com/giampaolo/psutil

python_script = Python()
# ---------- python_script.python (144 lines) ----------
import clr
import sys
clr.AddReference('ProtoGeometry')
from Autodesk.DesignScript.Geometry import *
pyt_path = r'C:\Program Files (x86)\IronPython 2.7\Lib'
sys.path.append(pyt_path)

import os
import re
import subprocess

# https://github.com/giampaolo/psutil


def available_cpu_count():
    """ Number of available virtual or physical CPUs on this system, i.e.
    user/real as output by time(1) when called with an optimally scaling
    userspace-only program"""

    # cpuset
    # cpuset may restrict the number of *available* processors
    try:
        m = re.search(r'(?m)^Cpus_allowed:\s*(.*)$',
                      open('/proc/self/status').read())
        if m:
            res = bin(int(m.group(1).replace(',', ''), 16)).count('1')
            if res > 0:
                return res
    except IOError:
        pass

    # Python 2.6+
    try:
        import multiprocessing
        return multiprocessing.cpu_count()
    except (ImportError, NotImplementedError):
        pass

    
    try:
        import psutil
        return psutil.cpu_count()   # psutil.NUM_CPUS on old versions
    except (ImportError, AttributeError):
        pass

    # POSIX
    try:
        res = int(os.sysconf('SC_NPROCESSORS_ONLN'))

        if res > 0:
            return res
    except (AttributeError, ValueError):
        pass

    # Windows
    try:
        res = int(os.environ['NUMBER_OF_PROCESSORS'])

        if res > 0:
            return res
    except (KeyError, ValueError):
        pass

    # jython
    try:
        from java.lang import Runtime
        runtime = Runtime.getRuntime()
        res = runtime.availableProcessors()
        if res > 0:
            return res
    except ImportError:
        pass

    # BSD
    try:
        sysctl = subprocess.Popen(['sysctl', '-n', 'hw.ncpu'],
                                  stdout=subprocess.PIPE)
        scStdout = sysctl.communicate()[0]
        res = int(scStdout)

        if res > 0:
            return res
    except (OSError, ValueError):
        pass

    # Linux
    try:
        res = open('/proc/cpuinfo').read().count('processor\t:')

        if res > 0:
            return res
    except IOError:
        pass

    # Solaris
    try:
        pseudoDevices = os.listdir('/devices/pseudo/')
        res = 0
        for pd in pseudoDevices:
            if re.match(r'^cpuid@[0-9]+$', pd):
                res += 1

        if res > 0:
            return res
    except OSError:
        pass

    # Other UNIXes (heuristic)
    try:
        try:
            dmesg = open('/var/run/dmesg.boot').read()
        except IOError:
            dmesgProcess = subprocess.Popen(['dmesg'], stdout=subprocess.PIPE)
            dmesg = dmesgProcess.communicate()[0]

        res = 0
        while '\ncpu' + str(res) + ':' in dmesg:
            res += 1

        if res > 0:
            return res
    except OSError:
        pass

    raise Exception('Can not determine number of CPUs on this system')

			
OUT = available_cpu_count()



#______________________________________________________________________________________________________________________________________________________#
#______________________________________________________________________________________________________________________________________________________#
                                                                                                                                              
#     88888888888                                                      88               888b      88                        88                         #
#     88                                                               88    ,d         8888b     88                        88                         #
#     88                                                               88    88         88 `8b    88                        88                         #
#     88aaaaa      ,adPPYYba,  ,adPPYba,   ,adPPYba,  8b,dPPYba,       88  MM88MMM      88  `8b   88   ,adPPYba,    ,adPPYb,88   ,adPPYba,  ,adPPYba,  #
#     88"""""      ""     `Y8  I8[    ""  a8P_____88  88P'   `"8a      88    88         88   `8b  88  a8"     "8a  a8"    `Y88  a8P_____88  I8[    ""  #
#     88           ,adPPPPP88   `"Y8ba,   8PP"""""""  88       88      88    88         88    `8b 88  8b       d8  8b       88  8PP"""""""   `"Y8ba,   #
#     88           88,    ,88  aa    ]8I  "8b,   ,aa  88       88      88    88,        88     `8888  "8a,   ,a8"  "8a,   ,d88  "8b,   ,aa  aa    ]8I  #
#     88888888888  `"8bbdP"Y8  `"YbbdP"'   `"Ybbd8"'  88       88      88    "Y888      88      `888   `"YbbdP"'    `"8bbdP"Y8   `"Ybbd8"'  `"YbbdP"'  #
#______________________________________________________________________________________________________________________________________________________#  
#______________________________________________________________________________________________________________________________________________________#   
# ----------------------------------------
CPU_Count = Output(python_script)
code_block = CodeBlock()
# ---------- code_block.designscript (14 lines) ----------
/*
#______________________________________________________________________________________________________________________________________________________#
#______________________________________________________________________________________________________________________________________________________#

#     88888888888                                                      88               888b      88                        88                         #
#     88                                                               88    ,d         8888b     88                        88                         #
#     88                                                               88    88         88 `8b    88                        88                         #
#     88aaaaa      ,adPPYYba,  ,adPPYba,   ,adPPYba,  8b,dPPYba,       88  MM88MMM      88  `8b   88   ,adPPYba,    ,adPPYb,88   ,adPPYba,  ,adPPYba,  #
#     88"""""      ""     `Y8  I8[    ""  a8P_____88  88P'   `"8a      88    88         88   `8b  88  a8"     "8a  a8"    `Y88  a8P_____88  I8[    ""  #
#     88           ,adPPPPP88   `"Y8ba,   8PP"""""""  88       88      88    88         88    `8b 88  8b       d8  8b       88  8PP"""""""   `"Y8ba,   #
#     88           88,    ,88  aa    ]8I  "8b,   ,aa  88       88      88    88,        88     `8888  "8a,   ,a8"  "8a,   ,d88  "8b,   ,aa  aa    ]8I  #
#     88888888888  `"8bbdP"Y8  `"YbbdP"'   `"Ybbd8"'  88       88      88    "Y888      88      `888   `"YbbdP"'    `"8bbdP"Y8   `"Ybbd8"'  `"YbbdP"'  #
#______________________________________________________________________________________________________________________________________________________#
#______________________________________________________________________________________________________________________________________________________#*/;
# ----------------------------------------
