# Dynamo custom node ExtraUtil.mutlithreadedThickenSurface.dyf (Dynamo 2.0.3.8810)
# category: Easen It Nodes
# Using multithreadding utilities in IronPython to complete a task of thickening surfaces faster

countCPU = Custom[ExtraUtil.countCPU]()  # Counts the CPU for your machine. Note : Python code is not made be Easen It Nodes for more information visit : https://github.com/giampaolo/psutil
surfaces = Input(surfaces: var[]..[])
thickness = Input(thickness: var[]..[])
both_sides = Input(both_sides: var[]..[])
python_script = Python(IN[0]=countCPU, IN[1]=surfaces, IN[2]=thickness, IN[3]=both_sides)
# ---------- python_script.python (75 lines) ----------
import clr
import sys
clr.AddReference('ProtoGeometry')
from Autodesk.DesignScript.Geometry import *
pyt_path = r'C:\Program Files (x86)\IronPython 2.7\Lib'
sys.path.append(pyt_path)
import threading
import time

start_time = time.time()

numberOfCPUs=IN[0]
surfaces=IN[1]
thickness=IN[2]
both_sides=IN[3]

class thickenSurfaces(threading.Thread):
	def __init__(self,inputList):
		self.inputList=inputList
		self.result=[]
	
	def run(self):
		for i in self.inputList:
			self.result.append(Surface.Thicken(i,thickness,both_sides))

def divideSubElements(inList):
	numbOfSubElements=int(len(inList)/numberOfCPUs)

	dividedElements=[]

	for i in range(numberOfCPUs):
		if i == numberOfCPUs-1:
			dividedElements.append(inList[i*numbOfSubElements:len(surfaces)])
		else:
			dividedElements.append(inList[i*numbOfSubElements:i*numbOfSubElements+numbOfSubElements])
	
	return dividedElements

def createThreadObjects(inList):
	threadObjects=[]
	for i in inList:
		threadObjects.append(thickenSurfaces(i))
	return threadObjects
	
divided=divideSubElements(surfaces)
threadObjs=createThreadObjects(divided)

for i in threadObjs:
	i.run()

results=[]

for i in threadObjs:
	results.append(i.result)
	
elapsedTime=time.time()-start_time

elapsedTimeStr='Done in ' + repr(elapsedTime) + ' Seconds'
OUT=results,elapsedTimeStr



#______________________________________________________________________________________________________________________________________________________#
#______________________________________________________________________________________________________________________________________________________#
                                                                                                                                              
#     88888888888                                                      88               888b      88                        88                         #
#     88                                                               88    ,d         8888b     88                        88                         #
#     88                                                               88    88         88 `8b    88                        88                         #
#     88aaaaa      ,adPPYYba,  ,adPPYba,   ,adPPYba,  8b,dPPYba,       88  MM88MMM      88  `8b   88   ,adPPYba,    ,adPPYb,88   ,adPPYba,  ,adPPYba,  #
#     88"""""      ""     `Y8  I8[    ""  a8P_____88  88P'   `"8a      88    88         88   `8b  88  a8"     "8a  a8"    `Y88  a8P_____88  I8[    ""  #
#     88           ,adPPPPP88   `"Y8ba,   8PP"""""""  88       88      88    88         88    `8b 88  8b       d8  8b       88  8PP"""""""   `"Y8ba,   #
#     88           88,    ,88  aa    ]8I  "8b,   ,aa  88       88      88    88,        88     `8888  "8a,   ,a8"  "8a,   ,d88  "8b,   ,aa  aa    ]8I  #
#     88888888888  `"8bbdP"Y8  `"YbbdP"'   `"Ybbd8"'  88       88      88    "Y888      88      `888   `"YbbdP"'    `"8bbdP"Y8   `"Ybbd8"'  `"YbbdP"'  #
#______________________________________________________________________________________________________________________________________________________#  
#______________________________________________________________________________________________________________________________________________________#   
# ----------------------------------------
code_block = CodeBlock(a=python_script) { a[0]; a[1]; }
solids = Output(code_block.out0)
ExecutionTime = Output(code_block.out1)
