# Dynamo custom node Fractals.explodeFractalGeometry.dyf (Dynamo 2.0.3.8810)
# category: Easen It Nodes
# Takes in fractal geometry list and returns its exploded data

fractalGeometry = Input(fractalGeometry: var[]..[])
code_block = CodeBlock(list=fractalGeometry) { List.Flatten(list); }
python_script = Python(IN[0]=code_block)
# ---------- python_script.python (51 lines) ----------
# Enable Python support and load DesignScript library
import clr
clr.AddReference('ProtoGeometry')
from Autodesk.DesignScript.Geometry import *

# The inputs to this node will be stored as a list in the IN variables.
fractalGeometry = IN[0]

# List of outputs if nothing is stored in the list it means Geometry doesn't consist of that type.
surfaces=[]
curves=[]
points=[]


if isinstance(fractalGeometry[0],Solid):
# Test for solids.
	for i in fractalGeometry:
		faces=Solid.Faces.GetValue(i)
		tmp=[]
		for j in faces:
			tmp.append(Face.SurfaceGeometry(j))
		surfaces.append(tmp)
if isinstance(fractalGeometry[0],Surface):
# Test for surfaces.
	for i in fractalGeometry:
		crvs=Surface.PerimeterCurves(i)
		curves.append(crvs)
if isinstance(fractalGeometry[0],Curve):
# Test for curves.
	for i in fractalGeometry:
		pnts=[]
		pnts.append(Curve.PointAtParameter(i,0.5))
		pnts.append(Curve.PointAtParameter(i,0.0))
		pnts.append(Curve.PointAtParameter(i,1.0))
		points.append(pnts)
OUT = surfaces,curves,points


#______________________________________________________________________________________________________________________________________________________#
#______________________________________________________________________________________________________________________________________________________#
                                                                                                                                              
#     88888888888                                                      88               888b      88                        88                         #
#     88                                                               88    ,d         8888b     88                        88                         #
#     88                                                               88    88         88 `8b    88                        88                         #
#     88aaaaa      ,adPPYYba,  ,adPPYba,   ,adPPYba,  8b,dPPYba,       88  MM88MMM      88  `8b   88   ,adPPYba,    ,adPPYb,88   ,adPPYba,  ,adPPYba,  #
#     88"""""      ""     `Y8  I8[    ""  a8P_____88  88P'   `"8a      88    88         88   `8b  88  a8"     "8a  a8"    `Y88  a8P_____88  I8[    ""  #
#     88           ,adPPPPP88   `"Y8ba,   8PP"""""""  88       88      88    88         88    `8b 88  8b       d8  8b       88  8PP"""""""   `"Y8ba,   #
#     88           88,    ,88  aa    ]8I  "8b,   ,aa  88       88      88    88,        88     `8888  "8a,   ,a8"  "8a,   ,d88  "8b,   ,aa  aa    ]8I  #
#     88888888888  `"8bbdP"Y8  `"YbbdP"'   `"Ybbd8"'  88       88      88    "Y888      88      `888   `"YbbdP"'    `"8bbdP"Y8   `"Ybbd8"'  `"YbbdP"'  #
#______________________________________________________________________________________________________________________________________________________#                                                                                                                                                 
#______________________________________________________________________________________________________________________________________________________#                              
# ----------------------------------------
code_block_2 = CodeBlock(a=python_script) { a[0]; a[1]; a[2]; }
surfaces = Output(code_block_2.out0)
curves = Output(code_block_2.out1)
points = Output(code_block_2.out2)
