# Dynamo custom node Fractals.fractalPolygonTulip.dyf (Dynamo 2.0.3.8810)
# category: Easen It Nodes
# Creates a tulip like structure using recursion the recursive method stops at the given level

numberOfSides = Input(numberOfSides: var[]..[])
rotation = Input(rotation: var[]..[])
level = Input(level: var[]..[])
scaleFactor = Input(scaleFactor: var[]..[])
python_script = Python(IN[0]=numberOfSides, IN[1]=rotation, IN[2]=level, IN[3]=scaleFactor)
# ---------- python_script.python (65 lines) ----------
# Enable Python support and load DesignScript library
import clr
clr.AddReference('ProtoGeometry')
from Autodesk.DesignScript.Geometry import *

# The inputs to this node will be stored as a list in the IN variables.
sidesNum = IN[0]
angle=IN[1]
stopLevel=IN[2]
scaleFactor=IN[3]
# The output to this node will be stored as a list in these variables eventually will be stored in OUT.
resultGeometry=[]


#Creating the first tulip structure polygon to be passed to fractalFrame method.
#############################################################################
c1=Circle.ByCenterPointRadius(Point.ByCoordinates(0,0,0),1)
c2=Circle.ByCenterPointRadius(Point.ByCoordinates(0,0,0),0.9)
#############################################################################
p1=Polygon.RegularPolygon(c1,sidesNum)
p2=Polygon.RegularPolygon(c2,sidesNum)
#############################################################################
s1=Surface.ByPatch(p1)
s2=Surface.ByPatch(p2)
#############################################################################
sol1=Surface.Thicken(s1,0.1)
sol2=Surface.Thicken(s2,0.1)
#############################################################################
frameSolid=Solid.Difference(sol1,sol2)
#############################################################################


#This method scales and returns a tanslated vertically version of the first frame and stops at the given level.
def fractalFrame(solid,level=0):
	if level > stopLevel:
		return
	translation=Geometry.Translate(solid,0,0,-0.1)
	plane=Plane.ByOriginNormal(Point.ByCoordinates(0,0,0),Vector.ByCoordinates(0,0,1))
	rotation=Geometry.Rotate(translation,plane,angle)
	scale=Geometry.Scale(rotation,scaleFactor,scaleFactor,scaleFactor)
	resultGeometry.append(scale)
	fractalFrame(scale,level+1)
	
#############################################################################
#Calling the method with the first frame.

fractalFrame(frameSolid)

#############################################################################
OUT = resultGeometry


#______________________________________________________________________________________________________________________________________________________#
#______________________________________________________________________________________________________________________________________________________#
                                                                                                                                              
#     88888888888                                                      88               888b      88                        88                         #
#     88                                                               88    ,d         8888b     88                        88                         #
#     88                                                               88    88         88 `8b    88                        88                         #
#     88aaaaa      ,adPPYYba,  ,adPPYba,   ,adPPYba,  8b,dPPYba,       88  MM88MMM      88  `8b   88   ,adPPYba,    ,adPPYb,88   ,adPPYba,  ,adPPYba,  #
#     88"""""      ""     `Y8  I8[    ""  a8P_____88  88P'   `"8a      88    88         88   `8b  88  a8"     "8a  a8"    `Y88  a8P_____88  I8[    ""  #
#     88           ,adPPPPP88   `"Y8ba,   8PP"""""""  88       88      88    88         88    `8b 88  8b       d8  8b       88  8PP"""""""   `"Y8ba,   #
#     88           88,    ,88  aa    ]8I  "8b,   ,aa  88       88      88    88,        88     `8888  "8a,   ,a8"  "8a,   ,d88  "8b,   ,aa  aa    ]8I  #
#     88888888888  `"8bbdP"Y8  `"YbbdP"'   `"Ybbd8"'  88       88      88    "Y888      88      `888   `"YbbdP"'    `"8bbdP"Y8   `"Ybbd8"'  `"YbbdP"'  #
#______________________________________________________________________________________________________________________________________________________#                                                                                                                                                 
#______________________________________________________________________________________________________________________________________________________#                              
# ----------------------------------------
tulipSolids = Output(python_script)
