# Dynamo custom node Fractals.indentedCubeByLengthCenterPoint.dyf (Dynamo 2.0.3.8810)
# category: Easen It Nodes
# Defines an indented cube strucutre by center point the structure stops at a given cube length

startLength = Input(startLength: var[]..[])
stopLength = Input(stopLength: var[]..[])
centerPoint = Input(centerPoint: var[]..[])
python_script = Python(IN[0]=startLength, IN[1]=stopLength, IN[2]=centerPoint)
# ---------- python_script.python (75 lines) ----------
# Enable Python support and load DesignScript library
import clr
clr.AddReference('ProtoGeometry')
from Autodesk.DesignScript.Geometry import *

# The inputs to this node will be stored as a list in the IN variables.
length = IN[0]
stoppingLength=IN[1]
centerPoint=IN[2]
# The output to this node will be stored as a list in this list.
result=[]
###########################################################################
###########################################################################
def recursiveCubes(length):
	#Create a the cube.
	cube=Cuboid.ByLengths(centerPoint,length,length,length)
	facesOfCube=Topology.Faces.GetValue(cube)
###########################################################################
	# UV coordinates to form a rectangle of solid-cut extrusion.
	UVCoordinate=((0.1,0.1),(0.1,0.9),(0.9,0.9),(0.9,0.1))
###########################################################################
	# Define three surfaces to the cube to from the cutting solids.
	srfc1=Face.SurfaceGeometry(facesOfCube[0])
	srfc2=Face.SurfaceGeometry(facesOfCube[2])
	srfc3=Face.SurfaceGeometry(facesOfCube[5])
###########################################################################
	# Define points for the cutting entities.
	firstPatch=[]
	for i in UVCoordinate:
		firstPatch.append(Surface.PointAtParameter(srfc1,i[0],i[1]))
	secondPatch=[]
	for i in UVCoordinate:
		secondPatch.append(Surface.PointAtParameter(srfc2,i[0],i[1]))
	thirdPatch=[]
	for i in UVCoordinate:
		thirdPatch.append(Surface.PointAtParameter(srfc3,i[0],i[1]))
###########################################################################	
	# Define polygon patches of extrusion.	
	subpoly1=Polygon.ByPoints(firstPatch)
	subpoly2=Polygon.ByPoints(secondPatch)
	subpoly3=Polygon.ByPoints(thirdPatch)
###########################################################################
	# Extrusion of solid-cut cubes.
	subCubes=[]
	subCubes.append(Curve.ExtrudeAsSolid(subpoly1,Vector.ByCoordinates(0,0,-1),length*2))
	subCubes.append(Curve.ExtrudeAsSolid(subpoly2,Vector.ByCoordinates(0,1,0),length*2))
	subCubes.append(Curve.ExtrudeAsSolid(subpoly3,Vector.ByCoordinates(-1,0,0),length*2))
	# Base case to stop the recursion.
	if length*0.9<stoppingLength:
		result.append(Cuboid.ByLengths(centerPoint,length*0.9,length*0.9,length*0.9))
		return
	# Apply subtraction.
	result.append(Solid.DifferenceAll(cube,subCubes))
	recursiveCubes(length*0.9)
###########################################################################

# Calling the recursive method.
recursiveCubes(length)

OUT=result


#______________________________________________________________________________________________________________________________________________________#
#______________________________________________________________________________________________________________________________________________________#
                                                                                                                                              
#     88888888888                                                      88               888b      88                        88                         #
#     88                                                               88    ,d         8888b     88                        88                         #
#     88                                                               88    88         88 `8b    88                        88                         #
#     88aaaaa      ,adPPYYba,  ,adPPYba,   ,adPPYba,  8b,dPPYba,       88  MM88MMM      88  `8b   88   ,adPPYba,    ,adPPYb,88   ,adPPYba,  ,adPPYba,  #
#     88"""""      ""     `Y8  I8[    ""  a8P_____88  88P'   `"8a      88    88         88   `8b  88  a8"     "8a  a8"    `Y88  a8P_____88  I8[    ""  #
#     88           ,adPPPPP88   `"Y8ba,   8PP"""""""  88       88      88    88         88    `8b 88  8b       d8  8b       88  8PP"""""""   `"Y8ba,   #
#     88           88,    ,88  aa    ]8I  "8b,   ,aa  88       88      88    88,        88     `8888  "8a,   ,a8"  "8a,   ,d88  "8b,   ,aa  aa    ]8I  #
#     88888888888  `"8bbdP"Y8  `"YbbdP"'   `"Ybbd8"'  88       88      88    "Y888      88      `888   `"YbbdP"'    `"8bbdP"Y8   `"Ybbd8"'  `"YbbdP"'  #
#______________________________________________________________________________________________________________________________________________________#                                                                                                                                                 
#______________________________________________________________________________________________________________________________________________________#                              
# ----------------------------------------
indentedCubes = Output(python_script)
