# Dynamo custom node Fractals.octahedronByBaseLength.dyf (Dynamo 2.0.3.8810)
# category: Easen It Nodes
# Create octahedron surfaces fractal geoemtry

baseLength = Input(baseLength: var[]..[])
tetrahedronByBaseLength = Custom[Solid.tetrahedronByBaseLength](baseLength=baseLength)  # Create a tetrahedron geometry given a base length
code_block = CodeBlock(t1=tetrahedronByBaseLength)
# ---------- code_block.designscript (2 lines) ----------
plane1 = Plane.ByOriginNormal(Point.ByCoordinates(0, 0, 0), Vector.ByCoordinates(0, 0, 1));
geometry1 = Geometry.Mirror(t1, plane1);
# ----------------------------------------
join = List.Join(list0=code_block.geometry1, list1=tetrahedronByBaseLength)
octahedronSurfaces = Output(join)
code_block_2 = CodeBlock()
# ---------- code_block_2.designscript (14 lines) ----------
/*
#______________________________________________________________________________________________________________________________________________________#
#______________________________________________________________________________________________________________________________________________________#

#     88888888888                                                      88               888b      88                        88                         #
#     88                                                               88    ,d         8888b     88                        88                         #
#     88                                                               88    88         88 `8b    88                        88                         #
#     88aaaaa      ,adPPYYba,  ,adPPYba,   ,adPPYba,  8b,dPPYba,       88  MM88MMM      88  `8b   88   ,adPPYba,    ,adPPYb,88   ,adPPYba,  ,adPPYba,  #
#     88"""""      ""     `Y8  I8[    ""  a8P_____88  88P'   `"8a      88    88         88   `8b  88  a8"     "8a  a8"    `Y88  a8P_____88  I8[    ""  #
#     88           ,adPPPPP88   `"Y8ba,   8PP"""""""  88       88      88    88         88    `8b 88  8b       d8  8b       88  8PP"""""""   `"Y8ba,   #
#     88           88,    ,88  aa    ]8I  "8b,   ,aa  88       88      88    88,        88     `8888  "8a,   ,a8"  "8a,   ,d88  "8b,   ,aa  aa    ]8I  #
#     88888888888  `"8bbdP"Y8  `"YbbdP"'   `"Ybbd8"'  88       88      88    "Y888      88      `888   `"YbbdP"'    `"8bbdP"Y8   `"Ybbd8"'  `"YbbdP"'  #
#______________________________________________________________________________________________________________________________________________________#
#______________________________________________________________________________________________________________________________________________________#*/;
# ----------------------------------------
