# Dynamo custom node Fractals.randomRecursiveTree.dyf (Dynamo 2.0.3.8810)
# category: Easen It Nodes
# Creating a random length given the maximum length for branches tree structure

rootLine = Input(rootLine: var[]..[])
maxRandomLength = Input(maxRandomLength: var[]..[])
branchesInlevel = Input(branchesInlevel: var[]..[])
stoppingLevel = Input(stoppingLevel: var[]..[])
python_script = Python(IN[0]=rootLine, IN[1]=maxRandomLength, IN[2]=branchesInlevel, IN[3]=stoppingLevel)
# ---------- python_script.python (64 lines) ----------
# Enable Python support and load DesignScript library.
import clr
import sys
clr.AddReference('ProtoGeometry')
from Autodesk.DesignScript.Geometry import *
pyt_path = r'C:\Program Files (x86)\IronPython 2.7\Lib'
sys.path.append(pyt_path)
import random

# The inputs to this node will be stored as a list in the IN variables.

startLine = IN[0]
randomLengthRange=IN[1]
numberOfBranches=IN[2]
stopLevel=IN[3]

# The output to this node will be stored as a list in this list.

resultTreeLines=[]

# A method to be used recurisvely to create a tree structure.

def createRandomTree(baseLine,level=0):
	# Base Case.
	if level == stopLevel:
		return
	# temporary list to hold current iteration lines.
	tmp=[]
	# Create a direction of the new lines at the end of the baseLine.
	endPnt=Curve.EndPoint.GetValue(baseLine)
	endPntTangent=Curve.TangentAtParameter(baseLine,1)
	jointPlane=Plane.ByOriginNormal(endPnt,endPntTangent)
	cs=CoordinateSystem.ByPlane(jointPlane)
	# Creating the branches lines.
	for i in range(numberOfBranches):
		directionPnt=Point.ByCartesianCoordinates(cs,random.random()*2-1,random.random()*2-1,random.random()+0.1)
		direction=Vector.ByTwoPoints(endPnt,directionPnt)
		newLine=Line.ByStartPointDirectionLength(endPnt,direction,random.random()*randomLengthRange+0.1)
		tmp.append(newLine)
	# Adding the tmp list to the results.
	resultTreeLines.append(tmp)
	# Calling the method again.
	for i in tmp:
		createRandomTree(i,level+1)
		
# First call for the method.		
createRandomTree(startLine)
	
OUT = resultTreeLines


#______________________________________________________________________________________________________________________________________________________#
#______________________________________________________________________________________________________________________________________________________#
                                                                                                                                              
#     88888888888                                                      88               888b      88                        88                         #
#     88                                                               88    ,d         8888b     88                        88                         #
#     88                                                               88    88         88 `8b    88                        88                         #
#     88aaaaa      ,adPPYYba,  ,adPPYba,   ,adPPYba,  8b,dPPYba,       88  MM88MMM      88  `8b   88   ,adPPYba,    ,adPPYb,88   ,adPPYba,  ,adPPYba,  #
#     88"""""      ""     `Y8  I8[    ""  a8P_____88  88P'   `"8a      88    88         88   `8b  88  a8"     "8a  a8"    `Y88  a8P_____88  I8[    ""  #
#     88           ,adPPPPP88   `"Y8ba,   8PP"""""""  88       88      88    88         88    `8b 88  8b       d8  8b       88  8PP"""""""   `"Y8ba,   #
#     88           88,    ,88  aa    ]8I  "8b,   ,aa  88       88      88    88,        88     `8888  "8a,   ,a8"  "8a,   ,d88  "8b,   ,aa  aa    ]8I  #
#     88888888888  `"8bbdP"Y8  `"YbbdP"'   `"Ybbd8"'  88       88      88    "Y888      88      `888   `"YbbdP"'    `"8bbdP"Y8   `"Ybbd8"'  `"YbbdP"'  #
#______________________________________________________________________________________________________________________________________________________#                                                                                                                                                 
#______________________________________________________________________________________________________________________________________________________#                              
# ----------------------------------------
treeLines = Output(python_script)
