# Dynamo custom node Fractals.recursiveCubes.dyf (Dynamo 2.0.3.8810)
# category: Easen It Nodes
# Creates a recursive outward cubes structure that stops at a given volume

startingCube = Input(startingCube: var[]..[])
stoppingVolume = Input(stoppingVolume: var[]..[])
python_script = Python(IN[0]=startingCube, IN[1]=stoppingVolume)
# ---------- python_script.python (57 lines) ----------
# Enable Python support and load DesignScript library
import clr
clr.AddReference('ProtoGeometry')
from Autodesk.DesignScript.Geometry import *

# The inputs to this node will be stored as a list in the IN variables.
inCube=IN[0]
stopRecursionVol=IN[1]

# The output to this node will be stored as a list in this list.
outCubes=[]

# A method for the recursive cubes.
def recursiveCube(cube):
	# Base Case.
	if Cuboid.Volume.GetValue(cube)<stopRecursionVol:
		return
	# Get cube faces surfaces.
	faces=Topology.Faces.GetValue(cube)
	srfcs=[]
	for i in faces:
		srfcs.append(Face.SurfaceGeometry(i))
	# Create sub-cubes on each surface.
	newPnts=[]
	for i in srfcs:
		newPnts.append(Surface.PointAtParameter(i,0.5,0.5))
	newWidth=Cuboid.Width.GetValue(cube)*0.61803398875
	newLength=Cuboid.Length.GetValue(cube)*0.61803398875
	newHeight=Cuboid.Height.GetValue(cube)*0.61803398875
	tmpCubes=[]
	for i in newPnts:
		tmpCubes.append(Cuboid.ByLengths(i, newWidth, newLength, newHeight))		
		outCubes.append(Cuboid.ByLengths(i, newWidth, newLength, newHeight))
	# Calling itself.
	for i in tmpCubes:
		recursiveCube(i)
		
		
# First Call		
recursiveCube(inCube)

OUT = outCubes


#______________________________________________________________________________________________________________________________________________________#
#______________________________________________________________________________________________________________________________________________________#
                                                                                                                                              
#     88888888888                                                      88               888b      88                        88                         #
#     88                                                               88    ,d         8888b     88                        88                         #
#     88                                                               88    88         88 `8b    88                        88                         #
#     88aaaaa      ,adPPYYba,  ,adPPYba,   ,adPPYba,  8b,dPPYba,       88  MM88MMM      88  `8b   88   ,adPPYba,    ,adPPYb,88   ,adPPYba,  ,adPPYba,  #
#     88"""""      ""     `Y8  I8[    ""  a8P_____88  88P'   `"8a      88    88         88   `8b  88  a8"     "8a  a8"    `Y88  a8P_____88  I8[    ""  #
#     88           ,adPPPPP88   `"Y8ba,   8PP"""""""  88       88      88    88         88    `8b 88  8b       d8  8b       88  8PP"""""""   `"Y8ba,   #
#     88           88,    ,88  aa    ]8I  "8b,   ,aa  88       88      88    88,        88     `8888  "8a,   ,a8"  "8a,   ,d88  "8b,   ,aa  aa    ]8I  #
#     88888888888  `"8bbdP"Y8  `"YbbdP"'   `"Ybbd8"'  88       88      88    "Y888      88      `888   `"YbbdP"'    `"8bbdP"Y8   `"Ybbd8"'  `"YbbdP"'  #
#______________________________________________________________________________________________________________________________________________________#                                                                                                                                                 
#______________________________________________________________________________________________________________________________________________________#                              
# ----------------------------------------
resultCubes = Output(python_script)
