# Dynamo custom node Fractals.rippleCircles.dyf (Dynamo 2.0.3.8810)
# category: Easen It Nodes
# Creates a ripple curve recursively out a starting circle to a stopping radius

firstCircle = Input(firstCircle: var[]..[])
stoppingRadius = Input(stoppingRadius: var[]..[])
randomRange = Input(randomRange: var[]..[])
python_script = Python(IN[0]=firstCircle, IN[1]=stoppingRadius, IN[2]=randomRange)
# ---------- python_script.python (52 lines) ----------
import clr
import sys
clr.AddReference('ProtoGeometry')
from Autodesk.DesignScript.Geometry import *
pyt_path = r'C:\Program Files (x86)\IronPython 2.7\Lib'

sys.path.append(pyt_path)
import random

# The inputs to this node will be stored as a list in the IN variables.
firstCircle = IN[0]
stoppingRadius= IN[1]
randomRange=IN[2]

# The output to this node will be stored as a list.
result=[]

# A recursive method to create sub-circles.
def replicateCircles(firstCircle):
	# Base Case.
	if Circle.Radius.GetValue(firstCircle) <= stoppingRadius:
		return
	else:
	# Creating sub circle
		newRadius=0.61803398875*Circle.Radius.GetValue(firstCircle)
		centerPoint=Circle.CenterPoint.GetValue(firstCircle)
		newCenter=Geometry.Translate(centerPoint,random.random()*randomRange-randomRange,random.random()*randomRange-randomRange,0)
		newCircle=Circle.ByCenterPointRadius(newCenter,newRadius)
		result.append(newCircle)
		# Calling itself.
		replicateCircles(newCircle)
		
# first call
replicateCircles(firstCircle)


OUT = result


#______________________________________________________________________________________________________________________________________________________#
#______________________________________________________________________________________________________________________________________________________#
                                                                                                                                              
#     88888888888                                                      88               888b      88                        88                         #
#     88                                                               88    ,d         8888b     88                        88                         #
#     88                                                               88    88         88 `8b    88                        88                         #
#     88aaaaa      ,adPPYYba,  ,adPPYba,   ,adPPYba,  8b,dPPYba,       88  MM88MMM      88  `8b   88   ,adPPYba,    ,adPPYb,88   ,adPPYba,  ,adPPYba,  #
#     88"""""      ""     `Y8  I8[    ""  a8P_____88  88P'   `"8a      88    88         88   `8b  88  a8"     "8a  a8"    `Y88  a8P_____88  I8[    ""  #
#     88           ,adPPPPP88   `"Y8ba,   8PP"""""""  88       88      88    88         88    `8b 88  8b       d8  8b       88  8PP"""""""   `"Y8ba,   #
#     88           88,    ,88  aa    ]8I  "8b,   ,aa  88       88      88    88,        88     `8888  "8a,   ,a8"  "8a,   ,d88  "8b,   ,aa  aa    ]8I  #
#     88888888888  `"8bbdP"Y8  `"YbbdP"'   `"Ybbd8"'  88       88      88    "Y888      88      `888   `"YbbdP"'    `"8bbdP"Y8   `"Ybbd8"'  `"YbbdP"'  #
#______________________________________________________________________________________________________________________________________________________#                                                                                                                                                 
#______________________________________________________________________________________________________________________________________________________#                              
# ----------------------------------------
rippleCircles = Output(python_script)
