# Dynamo custom node Fractals.sierpinskiTriangles.dyf (Dynamo 2.0.3.8810)
# category: Easen It Nodes
# Creates a polygon curve to form Sierpinski Triangles

startLength = Input(startLength: var[]..[])
stopLength = Input(stopLength: var[]..[])
python_script = Python(IN[0]=startLength, IN[1]=stopLength)
# ---------- python_script.python (67 lines) ----------
# Enable Python support and load DesignScript library
import clr
clr.AddReference('ProtoGeometry')
from Autodesk.DesignScript.Geometry import *
import math
# The inputs to this node will be stored as a list in the IN variables.
length = IN[0]
stopLength=IN[1]
sin60=math.sin(math.radians(60))

# Creating the first triangle.
pnts=[]
pnts.append(Point.ByCoordinates(-length/2,0,0))
pnts.append(Point.ByCoordinates(length/2,0,0))
pnts.append(Point.ByCoordinates(0,sin60*length,0))

# The output to this node will be stored as a list in the IN variables.
result=[]

# A recursive method to create sub-triangles.
def creatSubTriangles(eqTri):
	# Getting the curves of the triangle .
	crvs=PolyCurve.Curves(eqTri)
	# Getting the corners for the triangle .
	startPnts=[]
	for i in crvs:
		startPnts.append(Curve.StartPoint.GetValue(i))
	# Getting the mid points for the triangle .
	newPnts=[]
	for i in crvs:
		newPnts.append(Curve.PointAtParameter(i,0.5))
	# Creating sub-triangles .
	resultTriangles=[]
	resultTriangles.append(Polygon.ByPoints(newPnts))
	resultTriangles.append(Polygon.ByPoints([startPnts[0],newPnts[0],newPnts[2]]))
	resultTriangles.append(Polygon.ByPoints([startPnts[1],newPnts[0],newPnts[1]]))
	resultTriangles.append(Polygon.ByPoints([startPnts[2],newPnts[1],newPnts[2]]))
	# Base Case.
	if Curve.Length.GetValue(crvs[0])<stopLength:
		return
	result.append(resultTriangles[0])
	for i in range(1,len(resultTriangles)):
		creatSubTriangles(resultTriangles[i])

# Create first triangle store it and pass it to the method .
triPolygon=Polygon.ByPoints(pnts)
result.append(triPolygon)
# First call .
creatSubTriangles(triPolygon)


OUT = result


#______________________________________________________________________________________________________________________________________________________#
#______________________________________________________________________________________________________________________________________________________#
                                                                                                                                              
#     88888888888                                                      88               888b      88                        88                         #
#     88                                                               88    ,d         8888b     88                        88                         #
#     88                                                               88    88         88 `8b    88                        88                         #
#     88aaaaa      ,adPPYYba,  ,adPPYba,   ,adPPYba,  8b,dPPYba,       88  MM88MMM      88  `8b   88   ,adPPYba,    ,adPPYb,88   ,adPPYba,  ,adPPYba,  #
#     88"""""      ""     `Y8  I8[    ""  a8P_____88  88P'   `"8a      88    88         88   `8b  88  a8"     "8a  a8"    `Y88  a8P_____88  I8[    ""  #
#     88           ,adPPPPP88   `"Y8ba,   8PP"""""""  88       88      88    88         88    `8b 88  8b       d8  8b       88  8PP"""""""   `"Y8ba,   #
#     88           88,    ,88  aa    ]8I  "8b,   ,aa  88       88      88    88,        88     `8888  "8a,   ,a8"  "8a,   ,d88  "8b,   ,aa  aa    ]8I  #
#     88888888888  `"8bbdP"Y8  `"YbbdP"'   `"Ybbd8"'  88       88      88    "Y888      88      `888   `"YbbdP"'    `"8bbdP"Y8   `"Ybbd8"'  `"YbbdP"'  #
#______________________________________________________________________________________________________________________________________________________#                                                                                                                                                 
#______________________________________________________________________________________________________________________________________________________#                              
# ----------------------------------------
sierpinskiTriangles = Output(python_script)
