# Dynamo custom node Fractals.symmetricalRecursiveTree.dyf (Dynamo 2.0.3.8810)
# category: Easen It Nodes
# Creates a symmetrical tree like structure

baseLine = Input(baseLine: var[]..[])
branchLength = Input(branchLength: var[]..[])
numberOfBranchees = Input(numberOfBranchees: var[]..[])
stopLevel = Input(stopLevel: var[]..[])
alphaAngle = Input(alphaAngle: var[]..[])
python_script = Python(IN[0]=baseLine, IN[1]=branchLength, IN[2]=numberOfBranchees, IN[3]=stopLevel, IN[4]=alphaAngle)
# ---------- python_script.python (64 lines) ----------
# Enable Python support and load DesignScript library
import clr
import sys
clr.AddReference('ProtoGeometry')
from Autodesk.DesignScript.Geometry import *
pyt_path = r'C:\Program Files (x86)\IronPython 2.7\Lib'
sys.path.append(pyt_path)
import random
import math

# The inputs to this node will be stored as a list in the IN variables.
startLine = IN[0]
length=IN[1]
numberOfBranches=IN[2]
stopLevel=IN[3]
alphaAngle=IN[4]

# The output to this node will be stored as a list in this list.
resultTreeLines=[]

# A recursive method to create the tree structure.
def createTree(baseLine,level=0):
	# Base Case .
	if level == stopLevel:
		return
	# Temporary list to store the current iteration lines.
	tmp=[]
	# Defining the branches start at the end of the baseLine.
	endPnt=Curve.EndPoint.GetValue(baseLine)
	endPntTangent=Curve.TangentAtParameter(baseLine,1)
	jointPlane=Plane.ByOriginNormal(endPnt,endPntTangent)
	cs=CoordinateSystem.ByPlane(jointPlane)
	thetaAngle=360.0/numberOfBranches
	# Creating the iteration branches.
	for i in range(numberOfBranches):
		directionPnt=Point.BySphericalCoordinates(cs,alphaAngle,i*thetaAngle,length)
		direction=Vector.ByTwoPoints(endPnt,directionPnt)
		newLine=Line.ByStartPointDirectionLength(endPnt,direction,length)
		tmp.append(newLine)
	# Adding iteration lines to resultTreeLines list.
	resultTreeLines.append(tmp)
	# Calling itself
	for i in tmp:
		createTree(i,level+1)
		
# First Call .
createTree(startLine)
	
OUT = resultTreeLines


#______________________________________________________________________________________________________________________________________________________#
#______________________________________________________________________________________________________________________________________________________#
                                                                                                                                              
#     88888888888                                                      88               888b      88                        88                         #
#     88                                                               88    ,d         8888b     88                        88                         #
#     88                                                               88    88         88 `8b    88                        88                         #
#     88aaaaa      ,adPPYYba,  ,adPPYba,   ,adPPYba,  8b,dPPYba,       88  MM88MMM      88  `8b   88   ,adPPYba,    ,adPPYb,88   ,adPPYba,  ,adPPYba,  #
#     88"""""      ""     `Y8  I8[    ""  a8P_____88  88P'   `"8a      88    88         88   `8b  88  a8"     "8a  a8"    `Y88  a8P_____88  I8[    ""  #
#     88           ,adPPPPP88   `"Y8ba,   8PP"""""""  88       88      88    88         88    `8b 88  8b       d8  8b       88  8PP"""""""   `"Y8ba,   #
#     88           88,    ,88  aa    ]8I  "8b,   ,aa  88       88      88    88,        88     `8888  "8a,   ,a8"  "8a,   ,d88  "8b,   ,aa  aa    ]8I  #
#     88888888888  `"8bbdP"Y8  `"YbbdP"'   `"Ybbd8"'  88       88      88    "Y888      88      `888   `"YbbdP"'    `"8bbdP"Y8   `"Ybbd8"'  `"YbbdP"'  #
#______________________________________________________________________________________________________________________________________________________#                                                                                                                                                 
#______________________________________________________________________________________________________________________________________________________#                              
# ----------------------------------------
recursiveTree = Output(python_script)
