# Dynamo custom node ImportExport.parseJSON.dyf (Dynamo 2.0.3.8810)
# category: Easen It Nodes
# Parses and type of data into JSON format

list = Input(list: var[]..[])
python_script = Python(IN[0]=list)
# ---------- python_script.python (48 lines) ----------
import clr
import sys
clr.AddReference('ProtoGeometry')
from Autodesk.DesignScript.Geometry import *
pyt_path = r'C:\Program Files (x86)\IronPython 2.7\Lib'
sys.path.append(pyt_path)
import json

import json
input_list=IN[0]

def parseJSON(inputList) :
	listCounter =0
	for i in inputList:
		if isinstance(i, list) :
			listCounter +=1
	if listCounter ==0:
		tmp=[] 
		for i in inputList:
			tmp.append(str(i)) 
		return tmp
		
	tmp=[] 
	for i in inputList:
		if isinstance(i, list) :
			tmp.append(parseJSON(i))
		else:
			tmp.append(i)
	return tmp
 

OUT=json.dumps(parseJSON(input_list))



#______________________________________________________________________________________________________________________________________________________#
#______________________________________________________________________________________________________________________________________________________#
                                                                                                                                              
#     88888888888                                                      88               888b      88                        88                         #
#     88                                                               88    ,d         8888b     88                        88                         #
#     88                                                               88    88         88 `8b    88                        88                         #
#     88aaaaa      ,adPPYYba,  ,adPPYba,   ,adPPYba,  8b,dPPYba,       88  MM88MMM      88  `8b   88   ,adPPYba,    ,adPPYb,88   ,adPPYba,  ,adPPYba,  #
#     88"""""      ""     `Y8  I8[    ""  a8P_____88  88P'   `"8a      88    88         88   `8b  88  a8"     "8a  a8"    `Y88  a8P_____88  I8[    ""  #
#     88           ,adPPPPP88   `"Y8ba,   8PP"""""""  88       88      88    88         88    `8b 88  8b       d8  8b       88  8PP"""""""   `"Y8ba,   #
#     88           88,    ,88  aa    ]8I  "8b,   ,aa  88       88      88    88,        88     `8888  "8a,   ,a8"  "8a,   ,d88  "8b,   ,aa  aa    ]8I  #
#     88888888888  `"8bbdP"Y8  `"YbbdP"'   `"Ybbd8"'  88       88      88    "Y888      88      `888   `"YbbdP"'    `"8bbdP"Y8   `"Ybbd8"'  `"YbbdP"'  #
#______________________________________________________________________________________________________________________________________________________#  
#______________________________________________________________________________________________________________________________________________________#   
# ----------------------------------------
parsedData = Output(python_script)
