# Dynamo custom node List.chopList.dyf (Dynamo 2.0.3.8810)
# category: Easen It Nodes
# Extends the functionality of List.Chop to determine the number of sublists

numberOfSublists = Input(numberOfSublists: var[]..[])
sublistLength = Input(sublistLength: var[]..[])
list = Input(list: var[]..[])
code_block = CodeBlock(t1=list) { t2 = List.Flatten(t1, -1); }
python_script = Python(IN[0]=numberOfSublists, IN[1]=sublistLength, IN[2]=code_block)
# ---------- python_script.python (43 lines) ----------
# Enable Python support and load DesignScript library
import clr
clr.AddReference('ProtoGeometry')
from Autodesk.DesignScript.Geometry import *

# The inputs to this node will be stored as a list in the IN variables.
numberOfSublists = IN[0]
lengthsOfSublist = IN[1]
items = IN[2]


# The outputs to this node will be stored as a list in newList.
newList=[]

for i in range(numberOfSublists):
	tmp=[]
	for j in range(lengthsOfSublist):
		try:
			tmp.append(items[i*lengthsOfSublist+j])
		except IndexError:
			break
	newList.append(tmp)
flattened_list = [y for x in newList for y in x]
if len(flattened_list) != len(items):
	raise ValueError('The list has been truncated ! ')


OUT = newList


#______________________________________________________________________________________________________________________________________________________#
#______________________________________________________________________________________________________________________________________________________#
                                                                                                                                              
#     88888888888                                                      88               888b      88                        88                         #
#     88                                                               88    ,d         8888b     88                        88                         #
#     88                                                               88    88         88 `8b    88                        88                         #
#     88aaaaa      ,adPPYYba,  ,adPPYba,   ,adPPYba,  8b,dPPYba,       88  MM88MMM      88  `8b   88   ,adPPYba,    ,adPPYb,88   ,adPPYba,  ,adPPYba,  #
#     88"""""      ""     `Y8  I8[    ""  a8P_____88  88P'   `"8a      88    88         88   `8b  88  a8"     "8a  a8"    `Y88  a8P_____88  I8[    ""  #
#     88           ,adPPPPP88   `"Y8ba,   8PP"""""""  88       88      88    88         88    `8b 88  8b       d8  8b       88  8PP"""""""   `"Y8ba,   #
#     88           88,    ,88  aa    ]8I  "8b,   ,aa  88       88      88    88,        88     `8888  "8a,   ,a8"  "8a,   ,d88  "8b,   ,aa  aa    ]8I  #
#     88888888888  `"8bbdP"Y8  `"YbbdP"'   `"Ybbd8"'  88       88      88    "Y888      88      `888   `"YbbdP"'    `"8bbdP"Y8   `"Ybbd8"'  `"YbbdP"'  #
#______________________________________________________________________________________________________________________________________________________#                                                                                                                                                 
#______________________________________________________________________________________________________________________________________________________#                              
# ----------------------------------------
choppedList = Output(python_script)
