# Dynamo custom node List.maskItems.dyf (Dynamo 2.0.3.8810)
# category: Easen It Nodes
# Mask each list to the other out of list of lists to the lenghts of the longest one for shorter items Null value is the replacement

listOfLists = Input(listOfLists: var[]..[])
count = List.Count(list=listOfLists)
python_script = Python(IN[0]=listOfLists, IN[1]=count)
# ---------- python_script.python (43 lines) ----------
# Enable Python support and load DesignScript library
import clr
clr.AddReference('ProtoGeometry')
from Autodesk.DesignScript.Geometry import *

# The inputs to this node will be stored as a list in the IN variables.
listOfLists = IN[0]

# The output to this node will be stored in result.
result=[]

maxLength=0
for i in range(len(listOfLists)):

	if len(listOfLists[i])>maxLength:
		maxLength=len(listOfLists[i])

for i in range(maxLength):
	try:
		tmp=[]
		for j in range(len(listOfLists)):
			tmp.append(listOfLists[j][i])
	except IndexError :
		tmp.append(None)
	result.append(tmp)
	
	
OUT = result


#______________________________________________________________________________________________________________________________________________________#
#______________________________________________________________________________________________________________________________________________________#
                                                                                                                                              
#     88888888888                                                      88               888b      88                        88                         #
#     88                                                               88    ,d         8888b     88                        88                         #
#     88                                                               88    88         88 `8b    88                        88                         #
#     88aaaaa      ,adPPYYba,  ,adPPYba,   ,adPPYba,  8b,dPPYba,       88  MM88MMM      88  `8b   88   ,adPPYba,    ,adPPYb,88   ,adPPYba,  ,adPPYba,  #
#     88"""""      ""     `Y8  I8[    ""  a8P_____88  88P'   `"8a      88    88         88   `8b  88  a8"     "8a  a8"    `Y88  a8P_____88  I8[    ""  #
#     88           ,adPPPPP88   `"Y8ba,   8PP"""""""  88       88      88    88         88    `8b 88  8b       d8  8b       88  8PP"""""""   `"Y8ba,   #
#     88           88,    ,88  aa    ]8I  "8b,   ,aa  88       88      88    88,        88     `8888  "8a,   ,a8"  "8a,   ,d88  "8b,   ,aa  aa    ]8I  #
#     88888888888  `"8bbdP"Y8  `"YbbdP"'   `"Ybbd8"'  88       88      88    "Y888      88      `888   `"YbbdP"'    `"8bbdP"Y8   `"Ybbd8"'  `"YbbdP"'  #
#______________________________________________________________________________________________________________________________________________________#                                                                                                                                                 
#______________________________________________________________________________________________________________________________________________________#                              
# ----------------------------------------
maksedList = Output(python_script)
