# Dynamo custom node List.maskPairs.dyf (Dynamo 2.0.3.8810)
# category: Easen It Nodes
# Takes in two lists and pair every matching index in a sublist and adds it to the new list

firstList = Input(firstList: var[]..[])
secondList = Input(secondList: var[]..[])
code_block = CodeBlock(t1=firstList, t3=secondList) { t2 = List.Flatten(t1, -1); t4 = List.Flatten(t3, -1); }
python_script = Python(IN[0]=code_block.t2, IN[1]=code_block.t4)
# ---------- python_script.python (37 lines) ----------
# Enable Python support and load DesignScript library
import clr
clr.AddReference('ProtoGeometry')
from Autodesk.DesignScript.Geometry import *

# The inputs to this node will be stored as a list in the IN variables.
firstList  =IN[0]
secondList =IN[1]

# The output to this node will be stored in newList.
newList=[]

assert len(firstList)==len(secondList),'lists are not of equal length'

for i in range(len(firstList)):
	tmp=[]
	tmp.append(firstList[i])
	tmp.append(secondList[i])
	newList.append(tmp)


OUT = newList


#______________________________________________________________________________________________________________________________________________________#
#______________________________________________________________________________________________________________________________________________________#
                                                                                                                                              
#     88888888888                                                      88               888b      88                        88                         #
#     88                                                               88    ,d         8888b     88                        88                         #
#     88                                                               88    88         88 `8b    88                        88                         #
#     88aaaaa      ,adPPYYba,  ,adPPYba,   ,adPPYba,  8b,dPPYba,       88  MM88MMM      88  `8b   88   ,adPPYba,    ,adPPYb,88   ,adPPYba,  ,adPPYba,  #
#     88"""""      ""     `Y8  I8[    ""  a8P_____88  88P'   `"8a      88    88         88   `8b  88  a8"     "8a  a8"    `Y88  a8P_____88  I8[    ""  #
#     88           ,adPPPPP88   `"Y8ba,   8PP"""""""  88       88      88    88         88    `8b 88  8b       d8  8b       88  8PP"""""""   `"Y8ba,   #
#     88           88,    ,88  aa    ]8I  "8b,   ,aa  88       88      88    88,        88     `8888  "8a,   ,a8"  "8a,   ,d88  "8b,   ,aa  aa    ]8I  #
#     88888888888  `"8bbdP"Y8  `"YbbdP"'   `"Ybbd8"'  88       88      88    "Y888      88      `888   `"YbbdP"'    `"8bbdP"Y8   `"Ybbd8"'  `"YbbdP"'  #
#______________________________________________________________________________________________________________________________________________________#                                                                                                                                                 
#______________________________________________________________________________________________________________________________________________________#                              
# ----------------------------------------
newList = Output(python_script)
