# Dynamo custom node Math.MathematicalSurface__MonkeySaddle.dyf (Dynamo 2.0.3.8810)
# category: Easen It Nodes
# Create a surface defined by equation (x^3-3*x*y^2)*0.01

code_block = CodeBlock { "(x^3-3*x*y^2)*0.01"; }
minRange = Input(minRange: var[]..[])
maxRange = Input(maxRange: var[]..[])
functionGraphingCalculator = Custom[Math.functionGraphingCalculator](equationString=code_block, minRange=minRange, maxRange=maxRange)  # function graphing calculator takes an equation as a string and returns the graphed surface
scaleFactor = Input(scaleFactor: var[]..[])
code_block_2 = CodeBlock(t1=functionGraphingCalculator, t2=scaleFactor) { Geometry.Scale(t1, t2, t2, t2); }
monkeySaddle = Output(code_block_2)
code_block_3 = CodeBlock()
# ---------- code_block_3.designscript (14 lines) ----------
/*
#______________________________________________________________________________________________________________________________________________________#
#______________________________________________________________________________________________________________________________________________________#

#     88888888888                                                      88               888b      88                        88                         #
#     88                                                               88    ,d         8888b     88                        88                         #
#     88                                                               88    88         88 `8b    88                        88                         #
#     88aaaaa      ,adPPYYba,  ,adPPYba,   ,adPPYba,  8b,dPPYba,       88  MM88MMM      88  `8b   88   ,adPPYba,    ,adPPYb,88   ,adPPYba,  ,adPPYba,  #
#     88"""""      ""     `Y8  I8[    ""  a8P_____88  88P'   `"8a      88    88         88   `8b  88  a8"     "8a  a8"    `Y88  a8P_____88  I8[    ""  #
#     88           ,adPPPPP88   `"Y8ba,   8PP"""""""  88       88      88    88         88    `8b 88  8b       d8  8b       88  8PP"""""""   `"Y8ba,   #
#     88           88,    ,88  aa    ]8I  "8b,   ,aa  88       88      88    88,        88     `8888  "8a,   ,a8"  "8a,   ,d88  "8b,   ,aa  aa    ]8I  #
#     88888888888  `"8bbdP"Y8  `"YbbdP"'   `"Ybbd8"'  88       88      88    "Y888      88      `888   `"YbbdP"'    `"8bbdP"Y8   `"Ybbd8"'  `"YbbdP"'  #
#______________________________________________________________________________________________________________________________________________________#
#______________________________________________________________________________________________________________________________________________________#   */;
# ----------------------------------------
