# Dynamo custom node Math.MathematicalSurface___SineRipple.dyf (Dynamo 2.0.3.8810)
# category: Easen It Nodes
# A ripple like mathematical surface that is described by a sine function for more info visit
# https://dynamobim.org/math-transit/

code_block = CodeBlock { -20..20; }
byCoordinates = Point.ByCoordinates(x=code_block, y=code_block, lacing=CrossProduct)
flatten = List.Flatten(list=byCoordinates)
Amplitude = Input(Amplitude: var[]..[])
Frequency = Input(Frequency: var[]..[])
centerShift = Input(centerShift: var[]..[])
python_script = Python(IN[0]=flatten, IN[1]=Amplitude, IN[2]=Frequency, IN[3]=centerShift)
# ---------- python_script.python (36 lines) ----------
# Enable Python support and load DesignScript library
import clr
clr.AddReference('ProtoGeometry')
from Autodesk.DesignScript.Geometry import *
import math

# The inputs to this node will be stored as a list in the IN variables.
pnts = IN[0]
amp=IN[1]
freq=IN[2]
shift=IN[3]

elevations=[]

def findZ(pnt):
	return amp*math.sin(((pnt.X-shift)**2+(pnt.Y-shift)**2+(pnt.Z-shift)**2)**0.5)
	
for i in pnts:
	elevations.append(findZ(i))
	
OUT = elevations


#______________________________________________________________________________________________________________________________________________________#
#______________________________________________________________________________________________________________________________________________________#
                                                                                                                                              
#     88888888888                                                      88               888b      88                        88                         #
#     88                                                               88    ,d         8888b     88                        88                         #
#     88                                                               88    88         88 `8b    88                        88                         #
#     88aaaaa      ,adPPYYba,  ,adPPYba,   ,adPPYba,  8b,dPPYba,       88  MM88MMM      88  `8b   88   ,adPPYba,    ,adPPYb,88   ,adPPYba,  ,adPPYba,  #
#     88"""""      ""     `Y8  I8[    ""  a8P_____88  88P'   `"8a      88    88         88   `8b  88  a8"     "8a  a8"    `Y88  a8P_____88  I8[    ""  #
#     88           ,adPPPPP88   `"Y8ba,   8PP"""""""  88       88      88    88         88    `8b 88  8b       d8  8b       88  8PP"""""""   `"Y8ba,   #
#     88           88,    ,88  aa    ]8I  "8b,   ,aa  88       88      88    88,        88     `8888  "8a,   ,a8"  "8a,   ,d88  "8b,   ,aa  aa    ]8I  #
#     88888888888  `"8bbdP"Y8  `"YbbdP"'   `"Ybbd8"'  88       88      88    "Y888      88      `888   `"YbbdP"'    `"8bbdP"Y8   `"Ybbd8"'  `"YbbdP"'  #
#______________________________________________________________________________________________________________________________________________________#                                                                                                                                                 
#______________________________________________________________________________________________________________________________________________________#                              
# ----------------------------------------
translate = Geometry.Translate(geometry=flatten, zTranslation=python_script)
count = List.Count(list=code_block)
chop = List.Chop(list=translate, lengths=count)
byPoints = NurbsSurface.ByPoints(points=chop)
scaleFactor = Input(scaleFactor: var[]..[])
scale = Geometry.Scale(geometry=byPoints, xamount=scaleFactor, yamount=scaleFactor, zamount=scaleFactor)
mathematicalSurface = Output(scale)
