# Dynamo custom node Math.functionGraphingCalculator.dyf (Dynamo 2.0.3.8810)
# category: Easen It Nodes
# function graphing calculator takes an equation as a string and returns the graphed surface

minRange = Input(minRange: var[]..[])
maxRange = Input(maxRange: var[]..[])
code_block = CodeBlock(minRange=minRange, maxRange=maxRange) { minRange..maxRange; }
equationString = Input(equationString: var[]..[])
code_block_2 = CodeBlock { "^"; }
code_block_3 = CodeBlock { "**"; }
code_block_4 = CodeBlock(str1=equationString, str2=code_block_2, str3=code_block_3) { String.Replace(str1, str2, str3); }
python_script = Python(IN[0]=code_block, IN[1]=code_block_4)
# ---------- python_script.python (55 lines) ----------
# Enable Python support and load DesignScript library
import clr
clr.AddReference('ProtoGeometry')
from Autodesk.DesignScript.Geometry import *
import math

# The inputs to this node will be stored as a list in the IN variables.
rng = IN[0]
eq=IN[1]


# Temporary lists.
pnts=[]
zTranslation=[]
newGeometry=[]
# The output list for this node.
choppedList=[]


# Create points that is the x,y independent variable for the f(x,y) function
for i in rng:
	for j in rng:
		pnts.append(Point.ByCoordinates(i,j , 0))
# Extract the double value for coordinates to use in the function and return Z / f(x,y) value
for i in pnts:
	x=i.X
	y=i.Y
	zTranslation.append(eval(eq))
# Translate the x,y points to form the function graph
for i in range(len(pnts)):
	newGeometry.append(Geometry.Translate(pnts[i], 0,0,zTranslation[i]))
# Chop the list to be used in the nurbs curve node
for i in range(len(rng)):	
	tmp=[]	
	for j in range(len(rng)*i,len(rng)*i+len(rng)):
		tmp.append(newGeometry[j])
	choppedList.append(tmp)
	
# The output list.	
OUT = choppedList


#______________________________________________________________________________________________________________________________________________________#
#______________________________________________________________________________________________________________________________________________________#
                                                                                                                                              
#     88888888888                                                      88               888b      88                        88                         #
#     88                                                               88    ,d         8888b     88                        88                         #
#     88                                                               88    88         88 `8b    88                        88                         #
#     88aaaaa      ,adPPYYba,  ,adPPYba,   ,adPPYba,  8b,dPPYba,       88  MM88MMM      88  `8b   88   ,adPPYba,    ,adPPYb,88   ,adPPYba,  ,adPPYba,  #
#     88"""""      ""     `Y8  I8[    ""  a8P_____88  88P'   `"8a      88    88         88   `8b  88  a8"     "8a  a8"    `Y88  a8P_____88  I8[    ""  #
#     88           ,adPPPPP88   `"Y8ba,   8PP"""""""  88       88      88    88         88    `8b 88  8b       d8  8b       88  8PP"""""""   `"Y8ba,   #
#     88           88,    ,88  aa    ]8I  "8b,   ,aa  88       88      88    88,        88     `8888  "8a,   ,a8"  "8a,   ,d88  "8b,   ,aa  aa    ]8I  #
#     88888888888  `"8bbdP"Y8  `"YbbdP"'   `"Ybbd8"'  88       88      88    "Y888      88      `888   `"YbbdP"'    `"8bbdP"Y8   `"Ybbd8"'  `"YbbdP"'  #
#______________________________________________________________________________________________________________________________________________________#                                                                                                                                                 
#______________________________________________________________________________________________________________________________________________________#                              
# ----------------------------------------
code_block_5 = CodeBlock(t1=python_script) { nurbsSurface1 = NurbsSurface.ByPoints(t1, 3, 3); }
graphSurface = Output(code_block_5)
