# Dynamo custom node Points.farthestPoints.dyf (Dynamo 2.0.3.8810)
# category: Easen It Nodes
# For a list of points returns two points of the longes distance in between

points = Input(points: var[]..[])
python_script = Python(IN[0]=points)
# ---------- python_script.python (47 lines) ----------
import clr
import sys
clr.AddReference('ProtoGeometry')
from Autodesk.DesignScript.Geometry import *

# A method that measures the distance between two points .
def distance(pnt1,pnt2):
	return (((pnt2.X-pnt1.X)**2
			+(pnt2.Y-pnt1.Y)**2
			+(pnt2.Z-pnt1.Z)**2)**0.5)

# The input list of points .
points = IN[0]


farthestDistance=distance(points[0],points[1])

# The output list of distances .
farthestPoints=[]

for i in range(len(points)):
	for j in range(len(points)):
		if i == j:
			pass
		else:
			if distance(points[i],points[j])>farthestDistance:
				farthestDistance=distance(points[i],points[j])
				farthestPoints.Clear()
				farthestPoints.append(points[i])
				farthestPoints.append(points[j])

OUT=farthestPoints


#______________________________________________________________________________________________________________________________________________________#
#______________________________________________________________________________________________________________________________________________________#
                                                                                                                                              
#     88888888888                                                      88               888b      88                        88                         #
#     88                                                               88    ,d         8888b     88                        88                         #
#     88                                                               88    88         88 `8b    88                        88                         #
#     88aaaaa      ,adPPYYba,  ,adPPYba,   ,adPPYba,  8b,dPPYba,       88  MM88MMM      88  `8b   88   ,adPPYba,    ,adPPYb,88   ,adPPYba,  ,adPPYba,  #
#     88"""""      ""     `Y8  I8[    ""  a8P_____88  88P'   `"8a      88    88         88   `8b  88  a8"     "8a  a8"    `Y88  a8P_____88  I8[    ""  #
#     88           ,adPPPPP88   `"Y8ba,   8PP"""""""  88       88      88    88         88    `8b 88  8b       d8  8b       88  8PP"""""""   `"Y8ba,   #
#     88           88,    ,88  aa    ]8I  "8b,   ,aa  88       88      88    88,        88     `8888  "8a,   ,a8"  "8a,   ,d88  "8b,   ,aa  aa    ]8I  #
#     88888888888  `"8bbdP"Y8  `"YbbdP"'   `"Ybbd8"'  88       88      88    "Y888      88      `888   `"YbbdP"'    `"8bbdP"Y8   `"Ybbd8"'  `"YbbdP"'  #
#______________________________________________________________________________________________________________________________________________________#                                                                                                                                                 
#______________________________________________________________________________________________________________________________________________________#                              
# ----------------------------------------
farthestPoints = Output(python_script)
