# Dynamo custom node Points.randomPointsForClosedSurfaces.dyf (Dynamo 2.0.3.8810)
# category: Easen It Nodes
# For a closed is surface create random points over that surface

surface = Input(surface: var[]..[])

# group: Splits the closed surface to two opened surfaces
code_block = CodeBlock { 0.00001; }
code_block_2 = CodeBlock(surface1=surface, num1=code_block)
# ---------- code_block_2.designscript (3 lines) ----------
solid1 = Surface.Thicken(surface1, num1, true);
point1 = Solid.Centroid(solid1);
plane1 = Plane.ByOriginNormal(point1, Vector.ByCoordinates(0, 0, 1));
# ----------------------------------------
split = Geometry.Split(geometry=surface, other=code_block_2.plane1)
flatten = List.Flatten(list=split)

numberOfPoints = Input(numberOfPoints: var[]..[])

# group: Check if the surface is closed or not
closed = Surface.Closed(surface=surface)

python_script = Python(IN[0]=flatten, IN[1]=numberOfPoints, IN[2]=closed)
# ---------- python_script.python (41 lines) ----------
import clr
import sys
clr.AddReference('ProtoGeometry')
from Autodesk.DesignScript.Geometry import *
pyt_path = r'C:\Program Files (x86)\IronPython 2.7\Lib'
sys.path.append(pyt_path)
import random

# Input lists for this node .
isClosed=IN[2]
numberOfPoints=IN[1]
surfacesList=IN[0]


pnts=[]
# Checkes if the surface is closed or not if not raise a TypeError Exception .
if isClosed:
	# Create random points for the splitted surfaces .
	for i in range(len(surfacesList)):
		for j in range(numberOfPoints/2):
			pnts.append(Surface.PointAtParameter(surfacesList[i], random.random(), random.random()))
	if numberOfPoints % 2 != 0:
		pnts.append(Surface.PointAtParameter(surfacesList[i], random.random(), random.random()))
else:
	raise TypeError("The surface is not closed !")
OUT=pnts


#______________________________________________________________________________________________________________________________________________________#
#______________________________________________________________________________________________________________________________________________________#
                                                                                                                                              
#     88888888888                                                      88               888b      88                        88                         #
#     88                                                               88    ,d         8888b     88                        88                         #
#     88                                                               88    88         88 `8b    88                        88                         #
#     88aaaaa      ,adPPYYba,  ,adPPYba,   ,adPPYba,  8b,dPPYba,       88  MM88MMM      88  `8b   88   ,adPPYba,    ,adPPYb,88   ,adPPYba,  ,adPPYba,  #
#     88"""""      ""     `Y8  I8[    ""  a8P_____88  88P'   `"8a      88    88         88   `8b  88  a8"     "8a  a8"    `Y88  a8P_____88  I8[    ""  #
#     88           ,adPPPPP88   `"Y8ba,   8PP"""""""  88       88      88    88         88    `8b 88  8b       d8  8b       88  8PP"""""""   `"Y8ba,   #
#     88           88,    ,88  aa    ]8I  "8b,   ,aa  88       88      88    88,        88     `8888  "8a,   ,a8"  "8a,   ,d88  "8b,   ,aa  aa    ]8I  #
#     88888888888  `"8bbdP"Y8  `"YbbdP"'   `"Ybbd8"'  88       88      88    "Y888      88      `888   `"YbbdP"'    `"8bbdP"Y8   `"Ybbd8"'  `"YbbdP"'  #
#______________________________________________________________________________________________________________________________________________________#                                                                                                                                                 
#______________________________________________________________________________________________________________________________________________________#                              
# ----------------------------------------
randomPoints = Output(python_script)
