# Dynamo custom node Points.randomPointsWithinBoundingBox.dyf (Dynamo 2.0.3.8810)
# category: Easen It Nodes
# Creates random points within the range of the bounding box (Edges are included in that range)

geometry = Input(geometry: var[]..[])
boundingBox = Geometry.BoundingBox(geometry=geometry)
code_block = CodeBlock(boundingBox1=boundingBox) { point1 = BoundingBox.MaxPoint(boundingBox1); point2 = BoundingBox.MinPoint(boundingBox1); }
numberOfPoints = Input(numberOfPoints: var[]..[])
python_script = Python(IN[0]=code_block.point1, IN[1]=code_block.point2, IN[2]=numberOfPoints)
# ---------- python_script.python (46 lines) ----------
import clr
import sys
clr.AddReference('ProtoGeometry')
from Autodesk.DesignScript.Geometry import *
pyt_path = r'C:\Program Files (x86)\IronPython 2.7\Lib'
sys.path.append(pyt_path)
import random


# the input lists for this node .
maxPnt =IN[0]
minPnt =IN[1]
numberOfPoints=IN[2]

# The output list for these nodes .
pnts=[]


# Finding the coordinat range for the bounding box .

xRange= maxPnt.X-minPnt.X
yRange= maxPnt.Y-minPnt.Y
zRange= maxPnt.Z-minPnt.Z

# Creating random points within the range of the bounding box .
for i in range(numberOfPoints):
	pnts.append(Point.ByCoordinates(minPnt.X+random.random()*(xRange+1), 
									minPnt.Y+random.random()*(yRange+1), 
									minPnt.Z+random.random()*(zRange+1)))
OUT = pnts



#______________________________________________________________________________________________________________________________________________________#
#______________________________________________________________________________________________________________________________________________________#
                                                                                                                                              
#     88888888888                                                      88               888b      88                        88                         #
#     88                                                               88    ,d         8888b     88                        88                         #
#     88                                                               88    88         88 `8b    88                        88                         #
#     88aaaaa      ,adPPYYba,  ,adPPYba,   ,adPPYba,  8b,dPPYba,       88  MM88MMM      88  `8b   88   ,adPPYba,    ,adPPYb,88   ,adPPYba,  ,adPPYba,  #
#     88"""""      ""     `Y8  I8[    ""  a8P_____88  88P'   `"8a      88    88         88   `8b  88  a8"     "8a  a8"    `Y88  a8P_____88  I8[    ""  #
#     88           ,adPPPPP88   `"Y8ba,   8PP"""""""  88       88      88    88         88    `8b 88  8b       d8  8b       88  8PP"""""""   `"Y8ba,   #
#     88           88,    ,88  aa    ]8I  "8b,   ,aa  88       88      88    88,        88     `8888  "8a,   ,a8"  "8a,   ,d88  "8b,   ,aa  aa    ]8I  #
#     88888888888  `"8bbdP"Y8  `"YbbdP"'   `"Ybbd8"'  88       88      88    "Y888      88      `888   `"YbbdP"'    `"8bbdP"Y8   `"Ybbd8"'  `"YbbdP"'  #
#______________________________________________________________________________________________________________________________________________________#                                                                                                                                                 
#______________________________________________________________________________________________________________________________________________________#                              
# ----------------------------------------
randomPoints = Output(python_script)
