# Dynamo custom node Points.solidCloudPoints.dyf (Dynamo 2.0.3.8810)
# category: Easen It Nodes
# Creates random points within the volume of the given solid

solid = Input(solid: var[]..[])
pointsDensity = Input(pointsDensity: var[]..[])
randomPointsWithinBoundingBox = Custom[Points.randomPointsWithinBoundingBox](numberOfPoints=pointsDensity, geometry=solid)  # Creates random points within the range of the bounding box (Edges are included in that range)
code_block = CodeBlock(sphere1=solid, t1=randomPointsWithinBoundingBox) { geometry1 = Geometry.Intersect(sphere1, t1); t2 = List.Flatten(geometry1, -1); }
cloudPoints = Output(code_block.t2)
code_block_2 = CodeBlock()
# ---------- code_block_2.designscript (14 lines) ----------
/*
#______________________________________________________________________________________________________________________________________________________#
#______________________________________________________________________________________________________________________________________________________#

#     88888888888                                                      88               888b      88                        88                         #
#     88                                                               88    ,d         8888b     88                        88                         #
#     88                                                               88    88         88 `8b    88                        88                         #
#     88aaaaa      ,adPPYYba,  ,adPPYba,   ,adPPYba,  8b,dPPYba,       88  MM88MMM      88  `8b   88   ,adPPYba,    ,adPPYb,88   ,adPPYba,  ,adPPYba,  #
#     88"""""      ""     `Y8  I8[    ""  a8P_____88  88P'   `"8a      88    88         88   `8b  88  a8"     "8a  a8"    `Y88  a8P_____88  I8[    ""  #
#     88           ,adPPPPP88   `"Y8ba,   8PP"""""""  88       88      88    88         88    `8b 88  8b       d8  8b       88  8PP"""""""   `"Y8ba,   #
#     88           88,    ,88  aa    ]8I  "8b,   ,aa  88       88      88    88,        88     `8888  "8a,   ,a8"  "8a,   ,d88  "8b,   ,aa  aa    ]8I  #
#     88888888888  `"8bbdP"Y8  `"YbbdP"'   `"Ybbd8"'  88       88      88    "Y888      88      `888   `"YbbdP"'    `"8bbdP"Y8   `"Ybbd8"'  `"YbbdP"'  #
#______________________________________________________________________________________________________________________________________________________#
#______________________________________________________________________________________________________________________________________________________#*/;
# ----------------------------------------
