# Dynamo custom node Polygon.planarPolygonTriangulation.dyf (Dynamo 2.0.3.8810)
# category: Easen It Nodes
# Create a triangulation tesselation for a planar polygon

closedPolyCurve = Input(closedPolyCurve: var[]..[])
byPatch = Surface.ByPatch(closedCurve=closedPolyCurve)
curveApproxParameter = Input(curveApproxParameter: var[]..[])
python_script = Python(IN[0]=byPatch, IN[1]=curveApproxParameter)
# ---------- python_script.python (56 lines) ----------
# Enable Python support and load DesignScript library
import clr
clr.AddReference('ProtoGeometry')
from Autodesk.DesignScript.Geometry import *

# The inputs to this node will be stored as a list in the IN variables.
srfcCrvs = Surface.PerimeterCurves(IN[0])
approxParameter=IN[1]

perimeterLines=[]

def isLine(curve):
	sPnt=Curve.StartPoint.GetValue(curve)
	ePnt=Curve.EndPoint.GetValue(curve)
	
	if round(Curve.Length.GetValue(curve),4) == round(Geometry.DistanceTo(sPnt,ePnt),4):
		return True
	else:
		return False
def getCurveAprox(curve,approxParameter):
	parameters=[]
	step=1.0/(approxParameter-1)
	for i in range(0,approxParameter):
		parameters.append(i*step)
	pntsAtParam=[]
	for i in parameters:
		pntsAtParam.append(Curve.PointAtParameter(curve,i))
	lines=[]
	for i in range(1,len(pntsAtParam)):
		lines.append(Line.ByStartPointEndPoint(pntsAtParam[i-1],pntsAtParam[i]))
	return lines
	
for i in srfcCrvs:
	if isLine(i):
		perimeterLines.append(i)
	else:
		perimeterLines.append(getCurveAprox(i,approxParameter))
	

OUT =perimeterLines



#______________________________________________________________________________________________________________________________________________________#
#______________________________________________________________________________________________________________________________________________________#
                                                                                                                                              
#     88888888888                                                      88               888b      88                        88                         #
#     88                                                               88    ,d         8888b     88                        88                         #
#     88                                                               88    88         88 `8b    88                        88                         #
#     88aaaaa      ,adPPYYba,  ,adPPYba,   ,adPPYba,  8b,dPPYba,       88  MM88MMM      88  `8b   88   ,adPPYba,    ,adPPYb,88   ,adPPYba,  ,adPPYba,  #
#     88"""""      ""     `Y8  I8[    ""  a8P_____88  88P'   `"8a      88    88         88   `8b  88  a8"     "8a  a8"    `Y88  a8P_____88  I8[    ""  #
#     88           ,adPPPPP88   `"Y8ba,   8PP"""""""  88       88      88    88         88    `8b 88  8b       d8  8b       88  8PP"""""""   `"Y8ba,   #
#     88           88,    ,88  aa    ]8I  "8b,   ,aa  88       88      88    88,        88     `8888  "8a,   ,a8"  "8a,   ,d88  "8b,   ,aa  aa    ]8I  #
#     88888888888  `"8bbdP"Y8  `"YbbdP"'   `"Ybbd8"'  88       88      88    "Y888      88      `888   `"YbbdP"'    `"8bbdP"Y8   `"Ybbd8"'  `"YbbdP"'  #
#______________________________________________________________________________________________________________________________________________________#  
#______________________________________________________________________________________________________________________________________________________#   
# ----------------------------------------
code_block = CodeBlock(t1=python_script) { t2 = List.Flatten(t1, -1); }
python_script_2 = Python(IN[0]=code_block, IN[1]=byPatch)
# ---------- python_script_2.python (86 lines) ----------
# Enable Python support and load DesignScript library
import clr
clr.AddReference('ProtoGeometry')
from Autodesk.DesignScript.Geometry import *


input=IN[0]
srfc=IN[1]
perimeterLines=[]
for i in input:
	perimeterLines.append(i)
triPolygon=[]
########################################################################
def isConvexBySphereSurface(line_1,line_2):
	intersectionList=Geometry.Intersect(line_1,line_2)
	midPnt=intersectionList[0]
	faces=Topology.Faces.GetValue(Sphere.ByCenterPointRadius(midPnt,0.1))
	arcOfIntersection=Geometry.Intersect(Face.SurfaceGeometry(faces[0]),srfc)
	if Arc.SweepAngle.GetValue(arcOfIntersection[0]) > 180:
		return False
	else:
		return True

def triangulatePolyLines(perimeterLines):
##############################################################
#Base case####
	if len(perimeterLines)==3:
		l1=perimeterLines[0]
		l2=perimeterLines[1]
		l3=perimeterLines[2]

		pnt1=Curve.StartPoint.GetValue(l1)
		pnt2=Curve.StartPoint.GetValue(l2)
		pnt3=Curve.StartPoint.GetValue(l3)

		triPolygon.append(Polygon.ByPoints([pnt1,pnt2,pnt3]))
		return
	if len(perimeterLines)<3:
		triPolygon.append("The input curves don't from a polygon") 
		return
##############################################################
####  Ear clipping  ##########################################
	
	for i in range(1,len(perimeterLines)):
	
		secondLineIndex=i
		firstLineIndex=i-1

		l1=perimeterLines[firstLineIndex]
		l2=perimeterLines[secondLineIndex]
		
		if isConvexBySphereSurface(l1,l2):
			pnt1=Curve.StartPoint.GetValue(l1)
			pnt2=Curve.EndPoint.GetValue(l1)
			pnt3=Curve.EndPoint.GetValue(l2)

			triPolygon.append(Polygon.ByPoints([pnt1,pnt2,pnt3]))
			newLine_1=Line.ByStartPointEndPoint(pnt1,pnt3)
########################################################################
			perimeterLines.pop(firstLineIndex)
			perimeterLines.pop(firstLineIndex)
########################################################################
			perimeterLines.insert(firstLineIndex,newLine_1)
			break

	return triangulatePolyLines(perimeterLines)
	
triangulatePolyLines(perimeterLines)

OUT =triPolygon



#______________________________________________________________________________________________________________________________________________________#
#______________________________________________________________________________________________________________________________________________________#
                                                                                                                                              
#     88888888888                                                      88               888b      88                        88                         #
#     88                                                               88    ,d         8888b     88                        88                         #
#     88                                                               88    88         88 `8b    88                        88                         #
#     88aaaaa      ,adPPYYba,  ,adPPYba,   ,adPPYba,  8b,dPPYba,       88  MM88MMM      88  `8b   88   ,adPPYba,    ,adPPYb,88   ,adPPYba,  ,adPPYba,  #
#     88"""""      ""     `Y8  I8[    ""  a8P_____88  88P'   `"8a      88    88         88   `8b  88  a8"     "8a  a8"    `Y88  a8P_____88  I8[    ""  #
#     88           ,adPPPPP88   `"Y8ba,   8PP"""""""  88       88      88    88         88    `8b 88  8b       d8  8b       88  8PP"""""""   `"Y8ba,   #
#     88           88,    ,88  aa    ]8I  "8b,   ,aa  88       88      88    88,        88     `8888  "8a,   ,a8"  "8a,   ,d88  "8b,   ,aa  aa    ]8I  #
#     88888888888  `"8bbdP"Y8  `"YbbdP"'   `"Ybbd8"'  88       88      88    "Y888      88      `888   `"YbbdP"'    `"8bbdP"Y8   `"Ybbd8"'  `"YbbdP"'  #
#______________________________________________________________________________________________________________________________________________________#  
#______________________________________________________________________________________________________________________________________________________#   
# ----------------------------------------
basicTriangulation = Output(python_script_2)
stoppingLength = Input(stoppingLength: var[]..[])
divideTriangle = Custom[Curve.divideTriangle](listOfTriangles=python_script_2, stopAtLength=stoppingLength)  # Create sub-traingles by edges center points for a given triangle
triangulation = Output(divideTriangle)
