# Dynamo custom node Polygon.regularPolygonBySegment.dyf (Dynamo 2.0.3.8810)
# category: Easen It Nodes
# Creates a regular polygon by a given line to form one of its segments

side = Input(side: var[]..[])
numberOfSides = Input(numberOfSides: var[]..[])
code_block = CodeBlock(t1=side, t2=numberOfSides)
# ---------- code_block.designscript (11 lines) ----------
point1 = Curve.PointAtParameter(t1, 0.5);
vector1 = Curve.NormalAtParameter(t1, 0.5);
num2 = Curve.Length(t1);
numberOfSides = t2;
sidesLength = num2;
theta = 360 / numberOfSides;
radius = (sidesLength * (Math.Sin((180 - theta) / 2))) / (Math.Sin(theta));
perpDistance = radius * (Math.Sin((180 - theta) / 2));
geometry1 = Geometry.Translate(point1, vector1, perpDistance);
circle1 = Circle.ByCenterPointRadius(geometry1, radius);
polygon1 = Polygon.RegularPolygon(circle1, t2);
# ----------------------------------------
code_block_2 = CodeBlock(t=code_block.polygon1)
# ---------- code_block_2.designscript (5 lines) ----------
crvs=PolyCurve.Curves(t);
c=crvs[0];
p1=Curve.PointAtParameter(c,0);
p2=Curve.PointAtParameter(c,1);
CoordinateSystem.ByOrigin(p1);
# ----------------------------------------
code_block_3 = CodeBlock(c=side) { p1=Curve.PointAtParameter(c,0); CoordinateSystem.ByOrigin(p1); p2=Curve.PointAtParameter(c,1); }
code_block_4 = CodeBlock(g=code_block.polygon1, cs1=code_block_2.out4, cs2=code_block_3.out1, centerP=code_block_3.p1, eP=code_block_3.p2)
# ---------- code_block_4.designscript (6 lines) ----------
t=Geometry.Transform(g,cs1,cs2);
crvs=PolyCurve.Curves(t);
c=crvs[0];
p1=Curve.PointAtParameter(c,0);
p2=Curve.PointAtParameter(c,1);
angle = Arc.SweepAngle(Arc.ByCenterPointStartPointEndPoint(centerP,p2,eP));
# ----------------------------------------
ZAxis = Vector.ZAxis()
rotate = Geometry.Rotate(geometry=code_block_4.t, origin=code_block_3.p1, axis=ZAxis, degrees=code_block_4.angle)
polygon = Output(rotate)
code_block_5 = CodeBlock()
# ---------- code_block_5.designscript (14 lines) ----------
/*
#______________________________________________________________________________________________________________________________________________________#
#______________________________________________________________________________________________________________________________________________________#

#     88888888888                                                      88               888b      88                        88                         #
#     88                                                               88    ,d         8888b     88                        88                         #
#     88                                                               88    88         88 `8b    88                        88                         #
#     88aaaaa      ,adPPYYba,  ,adPPYba,   ,adPPYba,  8b,dPPYba,       88  MM88MMM      88  `8b   88   ,adPPYba,    ,adPPYb,88   ,adPPYba,  ,adPPYba,  #
#     88"""""      ""     `Y8  I8[    ""  a8P_____88  88P'   `"8a      88    88         88   `8b  88  a8"     "8a  a8"    `Y88  a8P_____88  I8[    ""  #
#     88           ,adPPPPP88   `"Y8ba,   8PP"""""""  88       88      88    88         88    `8b 88  8b       d8  8b       88  8PP"""""""   `"Y8ba,   #
#     88           88,    ,88  aa    ]8I  "8b,   ,aa  88       88      88    88,        88     `8888  "8a,   ,a8"  "8a,   ,d88  "8b,   ,aa  aa    ]8I  #
#     88888888888  `"8bbdP"Y8  `"YbbdP"'   `"Ybbd8"'  88       88      88    "Y888      88      `888   `"YbbdP"'    `"8bbdP"Y8   `"Ybbd8"'  `"YbbdP"'  #
#______________________________________________________________________________________________________________________________________________________#
#______________________________________________________________________________________________________________________________________________________#*/;
# ----------------------------------------
