# Dynamo custom node Polygon.regularPolygonBySegmentLength.dyf (Dynamo 2.0.3.8810)
# category: Easen It Nodes
# Creates a regular polygon by determining the side length

numberOfSides = Input(numberOfSides: var[]..[])
sideLength = Input(sideLength: var[]..[])
code_block = CodeBlock(t1=numberOfSides, t2=sideLength)
# ---------- code_block.designscript (6 lines) ----------
numberOfSides = t1;
sidesLength = t2;
theta = 360 / numberOfSides;
radius = (sidesLength * (Math.Sin((180 - theta) / 2))) / (Math.Sin(theta));
circle1 = Circle.ByCenterPointRadius(Point.ByCoordinates(0, 0, 0), radius);
polygon1 = Polygon.RegularPolygon(circle1, t1);
# ----------------------------------------
polygon = Output(code_block.polygon1)
code_block_2 = CodeBlock()
# ---------- code_block_2.designscript (14 lines) ----------
/*
#______________________________________________________________________________________________________________________________________________________#
#______________________________________________________________________________________________________________________________________________________#

#     88888888888                                                      88               888b      88                        88                         #
#     88                                                               88    ,d         8888b     88                        88                         #
#     88                                                               88    88         88 `8b    88                        88                         #
#     88aaaaa      ,adPPYYba,  ,adPPYba,   ,adPPYba,  8b,dPPYba,       88  MM88MMM      88  `8b   88   ,adPPYba,    ,adPPYb,88   ,adPPYba,  ,adPPYba,  #
#     88"""""      ""     `Y8  I8[    ""  a8P_____88  88P'   `"8a      88    88         88   `8b  88  a8"     "8a  a8"    `Y88  a8P_____88  I8[    ""  #
#     88           ,adPPPPP88   `"Y8ba,   8PP"""""""  88       88      88    88         88    `8b 88  8b       d8  8b       88  8PP"""""""   `"Y8ba,   #
#     88           88,    ,88  aa    ]8I  "8b,   ,aa  88       88      88    88,        88     `8888  "8a,   ,a8"  "8a,   ,d88  "8b,   ,aa  aa    ]8I  #
#     88888888888  `"8bbdP"Y8  `"YbbdP"'   `"Ybbd8"'  88       88      88    "Y888      88      `888   `"YbbdP"'    `"8bbdP"Y8   `"Ybbd8"'  `"YbbdP"'  #
#______________________________________________________________________________________________________________________________________________________#
#______________________________________________________________________________________________________________________________________________________#*/;
# ----------------------------------------
