# Dynamo custom node Revit.Element.Faces.Area.dyf (Dynamo 2.0.3.8810)
# category: Easen It Nodes
# Finds the area for a selected faces in Revit envoironment

faceElements = Input(faceElements: var[]..[])
code_block = CodeBlock(t1=faceElements) { List.Flatten(t1, -1); }
python_script = Python(IN[0]=code_block)
# ---------- python_script.python (26 lines) ----------
import clr
clr.AddReference('ProtoGeometry')
from Autodesk.DesignScript.Geometry import *

srfcs = IN[0]
areas=[]

for i in srfcs:
	areas.append(round(Surface.Area.GetValue(i),3))

OUT = areas,sum(areas)


#______________________________________________________________________________________________________________________________________________________#
#______________________________________________________________________________________________________________________________________________________#
                                                                                                                                              
#     88888888888                                                      88               888b      88                        88                         #
#     88                                                               88    ,d         8888b     88                        88                         #
#     88                                                               88    88         88 `8b    88                        88                         #
#     88aaaaa      ,adPPYYba,  ,adPPYba,   ,adPPYba,  8b,dPPYba,       88  MM88MMM      88  `8b   88   ,adPPYba,    ,adPPYb,88   ,adPPYba,  ,adPPYba,  #
#     88"""""      ""     `Y8  I8[    ""  a8P_____88  88P'   `"8a      88    88         88   `8b  88  a8"     "8a  a8"    `Y88  a8P_____88  I8[    ""  #
#     88           ,adPPPPP88   `"Y8ba,   8PP"""""""  88       88      88    88         88    `8b 88  8b       d8  8b       88  8PP"""""""   `"Y8ba,   #
#     88           88,    ,88  aa    ]8I  "8b,   ,aa  88       88      88    88,        88     `8888  "8a,   ,a8"  "8a,   ,d88  "8b,   ,aa  aa    ]8I  #
#     88888888888  `"8bbdP"Y8  `"YbbdP"'   `"Ybbd8"'  88       88      88    "Y888      88      `888   `"YbbdP"'    `"8bbdP"Y8   `"Ybbd8"'  `"YbbdP"'  #
#______________________________________________________________________________________________________________________________________________________#  
#______________________________________________________________________________________________________________________________________________________#   
# ----------------------------------------
code_block_2 = CodeBlock(a=python_script) { a[0]; a[1]; }
area = Output(code_block_2.out0)
totalArea = Output(code_block_2.out1)
