# Dynamo custom node Revit.Element.FamilyInstance.FollowPath.dyf (Dynamo 2.0.3.8810)
# category: Easen It Nodes
# Create family instances at a give spacing for a selected model line

familyType = Input(familyType: var[]..[])
continuousCurve = Input(continuousCurve: var[]..[])
spacing = Input(spacing: var[]..[])
code_block = CodeBlock(FamilyInstance=familyType)  # unwired: t1
# ---------- code_block.designscript (2 lines) ----------
testInstance = FamilyInstance.ByPoint(t1, Point.ByCoordinates(0, 0, 0));
FamilyInstance.FacingOrientation(testInstance);
# ----------------------------------------
python_script = Python(IN[0]=continuousCurve, IN[1]=spacing, IN[2]=code_block.out1)
# ---------- python_script.python (54 lines) ----------
import clr
clr.AddReference('ProtoGeometry')
from Autodesk.DesignScript.Geometry import *

inputElements = IN[0]
spacing =IN[1]
facingOrientation=IN[2]
curves=[]
pCrv=[]

try:
	for i in inputElements:
		curves.append(i.Geometry()[0])
	pCrv.append(PolyCurve.ByJoinedCurves(curves))
except TypeError as e:
	pCrv.append(e)
except IndexError as e:
	pCrv.append(e)

parameterDivde=round(Curve.Length.GetValue(pCrv[0])/spacing,0)

parameters=[]

for i in range(int(parameterDivde)):
	parameters.append(i*1.0/(parameterDivde-1))
	
vectors=[]
pnts=[]

for i in range(len(parameters)):
	vectors.append(Curve.TangentAtParameter(pCrv[0],parameters[i]))
	pnts.append(Curve.PointAtParameter(pCrv[0],parameters[i]))

rotations=[]
for i in vectors:
	rotations.append(Vector.AngleWithVector(i,facingOrientation))
	

OUT = pnts,rotations


#______________________________________________________________________________________________________________________________________________________#
#______________________________________________________________________________________________________________________________________________________#
                                                                                                                                              
#     88888888888                                                      88               888b      88                        88                         #
#     88                                                               88    ,d         8888b     88                        88                         #
#     88                                                               88    88         88 `8b    88                        88                         #
#     88aaaaa      ,adPPYYba,  ,adPPYba,   ,adPPYba,  8b,dPPYba,       88  MM88MMM      88  `8b   88   ,adPPYba,    ,adPPYb,88   ,adPPYba,  ,adPPYba,  #
#     88"""""      ""     `Y8  I8[    ""  a8P_____88  88P'   `"8a      88    88         88   `8b  88  a8"     "8a  a8"    `Y88  a8P_____88  I8[    ""  #
#     88           ,adPPPPP88   `"Y8ba,   8PP"""""""  88       88      88    88         88    `8b 88  8b       d8  8b       88  8PP"""""""   `"Y8ba,   #
#     88           88,    ,88  aa    ]8I  "8b,   ,aa  88       88      88    88,        88     `8888  "8a,   ,a8"  "8a,   ,d88  "8b,   ,aa  aa    ]8I  #
#     88888888888  `"8bbdP"Y8  `"YbbdP"'   `"Ybbd8"'  88       88      88    "Y888      88      `888   `"YbbdP"'    `"8bbdP"Y8   `"Ybbd8"'  `"YbbdP"'  #
#______________________________________________________________________________________________________________________________________________________#  
#______________________________________________________________________________________________________________________________________________________#   
# ----------------------------------------
code_block_2 = CodeBlock(a=python_script) { a[0]; a[1]; }
code_block_3 = CodeBlock(FamilyInstance=familyType, familyType=code_block_2.out0, points=code_block_2.out1)  # unwired: rotations
# ---------- code_block_3.designscript (2 lines) ----------
familyinstance1 = FamilyInstance.ByPoint(familyType, points);
familyinstance2 = FamilyInstance.SetRotation(familyinstance1, rotations);
# ----------------------------------------
familyInstance = Output(code_block_3.familyinstance2)
