# Dynamo custom node Revit.Element.FamilyInstance.Scatter.dyf (Dynamo 2.0.3.8810)
# category: Easen It Nodes
# Scatters randomly a family instance by defining model line closed curve and passing it to this node

familyInstances = Output()  # unwired: arg0
byPoint = FamilyInstance.ByPoint()  # unwired: familyType, point
closedCurve = Input(closedCurve: var[]..[])
pointsDensity = Input(pointsDensity: var[]..[])
python_script = Python(IN[0]=closedCurve, IN[1]=pointsDensity)
# ---------- python_script.python (63 lines) ----------
import clr
import sys
clr.AddReference('ProtoGeometry')
from Autodesk.DesignScript.Geometry import *
pyt_path = r'C:\Program Files (x86)\IronPython 2.7\Lib'
sys.path.append(pyt_path)
import random

element= IN[0]
closedCurve=element.Geometry()

surface = Surface.ByPatch(closedCurve[0])
pointsDensityFactor=IN[1]
points=[]
withinSurfacePoints=[]

def isWithinSurface(pnt,srfc):
	firstVertex=Surface.PointAtParameter(srfc,0,1)
	secondVertex=Surface.PointAtParameter(srfc,1,0)
	thirdVertex=Surface.PointAtParameter(srfc,0,0)
	fourthVertex=Surface.PointAtParameter(srfc,1,1)
	
	line_1=Line.ByStartPointEndPoint(pnt,firstVertex)
	line_2=Line.ByStartPointEndPoint(pnt,secondVertex)
	line_3=Line.ByStartPointEndPoint(pnt,thirdVertex)
	line_4=Line.ByStartPointEndPoint(pnt,fourthVertex)
	
	firstCond=Geometry.DoesIntersect(line_1,srfc)
	secondCond=Geometry.DoesIntersect(line_2,srfc)
	thirdCond=Geometry.DoesIntersect(line_3,srfc)
	fourthCond=Geometry.DoesIntersect(line_4,srfc)
	
	if firstCond and secondCond and thirdCond and fourthCond:
		return True
	else:
		return False

for i in range(pointsDensityFactor):
	points.append(Surface.PointAtParameter(surface, random.random(), random.random()))

for i in points:
	if isWithinSurface(i,surface):
		withinSurfacePoints.append(i)

		
OUT = withinSurfacePoints,surface




#______________________________________________________________________________________________________________________________________________________#
#______________________________________________________________________________________________________________________________________________________#
                                                                                                                                              
#     88888888888                                                      88               888b      88                        88                         #
#     88                                                               88    ,d         8888b     88                        88                         #
#     88                                                               88    88         88 `8b    88                        88                         #
#     88aaaaa      ,adPPYYba,  ,adPPYba,   ,adPPYba,  8b,dPPYba,       88  MM88MMM      88  `8b   88   ,adPPYba,    ,adPPYb,88   ,adPPYba,  ,adPPYba,  #
#     88"""""      ""     `Y8  I8[    ""  a8P_____88  88P'   `"8a      88    88         88   `8b  88  a8"     "8a  a8"    `Y88  a8P_____88  I8[    ""  #
#     88           ,adPPPPP88   `"Y8ba,   8PP"""""""  88       88      88    88         88    `8b 88  8b       d8  8b       88  8PP"""""""   `"Y8ba,   #
#     88           88,    ,88  aa    ]8I  "8b,   ,aa  88       88      88    88,        88     `8888  "8a,   ,a8"  "8a,   ,d88  "8b,   ,aa  aa    ]8I  #
#     88888888888  `"8bbdP"Y8  `"YbbdP"'   `"Ybbd8"'  88       88      88    "Y888      88      `888   `"YbbdP"'    `"8bbdP"Y8   `"Ybbd8"'  `"YbbdP"'  #
#______________________________________________________________________________________________________________________________________________________#  
#______________________________________________________________________________________________________________________________________________________#   
# ----------------------------------------
familyType = Input(familyType: var[]..[])
