# Dynamo custom node Revit.Element.Geometry.Centroid.dyf (Dynamo 2.0.3.8810)
# category: Easen It Nodes
# Finds the centroid for the geometry of the element if it is a surface it finds the center point if it is a curve it finds the mid point.

element = Input(element: var[]..[])
python_script = Python(IN[0]=element)
# ---------- python_script.python (7 lines) ----------
import clr
clr.AddReference('ProtoGeometry')
from Autodesk.DesignScript.Geometry import *
# Get elements geometry
elem = IN[0]

OUT=elem.Geometry()[0]
# ----------------------------------------
code_block = CodeBlock(a=element) { a[0]; }
python_script_2 = Python(IN[0]=python_script, IN[1]=code_block)
# ---------- python_script_2.python (13 lines) ----------
import clr
clr.AddReference('ProtoGeometry')
from Autodesk.DesignScript.Geometry import *

geom = IN[0]
surface=IN[1]

if isinstance(geom,Solid):
	OUT=geom
else:
	OUT=surface

# centroids can be for solids or surfaces
# ----------------------------------------
python_script_3 = Python(IN[0]=python_script_2)
# ---------- python_script_3.python (30 lines) ----------
import clr
clr.AddReference('ProtoGeometry')
from Autodesk.DesignScript.Geometry import *

geom = IN[0]

# finds the centroid for any of the following 
if isinstance(geom,Solid):
	OUT=Solid.Centroid(geom)
elif isinstance(geom,Surface):
	OUT=Surface.PointAtParameter(geom[0],0.5,0.5)
elif isinstance(geom,Curve):
	OUT=Curve.PointAtParameter(geom,0.5)
else:
	OUT='Bad Input Type'


#______________________________________________________________________________________________________________________________________________________#
#______________________________________________________________________________________________________________________________________________________#
                                                                                                                                              
#     88888888888                                                      88               888b      88                        88                         #
#     88                                                               88    ,d         8888b     88                        88                         #
#     88                                                               88    88         88 `8b    88                        88                         #
#     88aaaaa      ,adPPYYba,  ,adPPYba,   ,adPPYba,  8b,dPPYba,       88  MM88MMM      88  `8b   88   ,adPPYba,    ,adPPYb,88   ,adPPYba,  ,adPPYba,  #
#     88"""""      ""     `Y8  I8[    ""  a8P_____88  88P'   `"8a      88    88         88   `8b  88  a8"     "8a  a8"    `Y88  a8P_____88  I8[    ""  #
#     88           ,adPPPPP88   `"Y8ba,   8PP"""""""  88       88      88    88         88    `8b 88  8b       d8  8b       88  8PP"""""""   `"Y8ba,   #
#     88           88,    ,88  aa    ]8I  "8b,   ,aa  88       88      88    88,        88     `8888  "8a,   ,a8"  "8a,   ,d88  "8b,   ,aa  aa    ]8I  #
#     88888888888  `"8bbdP"Y8  `"YbbdP"'   `"Ybbd8"'  88       88      88    "Y888      88      `888   `"YbbdP"'    `"8bbdP"Y8   `"Ybbd8"'  `"YbbdP"'  #
#______________________________________________________________________________________________________________________________________________________#  
#______________________________________________________________________________________________________________________________________________________#   
# ----------------------------------------
centroid = Output(python_script_3)
