# Dynamo custom node Revit.Element.Solids.Volume.dyf (Dynamo 2.0.3.8810)
# category: Easen It Nodes
# Finds a volume of an element by obtaining its solids geometry

elements = Input(elements: var[]..[])
python_script = Python(IN[0]=elements)
# ---------- python_script.python (34 lines) ----------
# Enable Python support and load DesignScript library
import clr
clr.AddReference('ProtoGeometry')

from Autodesk.DesignScript.Geometry import *


# The inputs to this node will be stored as a list in the IN variables.
elements = IN[0]

solids=[]
solidVol=[]
solids.append(elements.Geometry())
for i in solids:
	for j in i:
		solidVol.append(round(Solid.Volume.GetValue(j),3))
		
	
OUT = solidVol,sum(solidVol)


#______________________________________________________________________________________________________________________________________________________#
#______________________________________________________________________________________________________________________________________________________#
                                                                                                                                              
#     88888888888                                                      88               888b      88                        88                         #
#     88                                                               88    ,d         8888b     88                        88                         #
#     88                                                               88    88         88 `8b    88                        88                         #
#     88aaaaa      ,adPPYYba,  ,adPPYba,   ,adPPYba,  8b,dPPYba,       88  MM88MMM      88  `8b   88   ,adPPYba,    ,adPPYb,88   ,adPPYba,  ,adPPYba,  #
#     88"""""      ""     `Y8  I8[    ""  a8P_____88  88P'   `"8a      88    88         88   `8b  88  a8"     "8a  a8"    `Y88  a8P_____88  I8[    ""  #
#     88           ,adPPPPP88   `"Y8ba,   8PP"""""""  88       88      88    88         88    `8b 88  8b       d8  8b       88  8PP"""""""   `"Y8ba,   #
#     88           88,    ,88  aa    ]8I  "8b,   ,aa  88       88      88    88,        88     `8888  "8a,   ,a8"  "8a,   ,d88  "8b,   ,aa  aa    ]8I  #
#     88888888888  `"8bbdP"Y8  `"YbbdP"'   `"Ybbd8"'  88       88      88    "Y888      88      `888   `"YbbdP"'    `"8bbdP"Y8   `"Ybbd8"'  `"YbbdP"'  #
#______________________________________________________________________________________________________________________________________________________#  
#______________________________________________________________________________________________________________________________________________________#   
# ----------------------------------------
code_block = CodeBlock(a=python_script) { a[0]; a[1]; }
volumes = Output(code_block.out0)
totalVolume = Output(code_block.out0)
