# Dynamo custom node Revit.ImportExport.ImportCADSurfaces.dyf (Dynamo 2.0.3.8810)
# category: Easen It Nodes
# Import CAD surfaces and hatch elements as surfaces from importInstance element into dynamo environment

importInstance = Input(importInstance: var[]..[])
python_script = Python(IN[0]=importInstance)
# ---------- python_script.python (8 lines) ----------
import clr
clr.AddReference('ProtoGeometry')
from Autodesk.DesignScript.Geometry import *

elem = IN[0]
geometries=elem.Geometry()

OUT=geometries
# ----------------------------------------
cleanSolids = Custom[List.cleanSolids](flattenedList=python_script)  # Removes all the solid items from a given list
cleanCurves = Custom[List.cleanCurves](flattenedList=cleanSolids)  # Removes all curves items from a given list
cleanPoints = Custom[List.cleanPoints](flattenedList=cleanCurves)  # Removies all points items from a given list
code_block = CodeBlock { false; }
clean = List.Clean(list=cleanPoints, preserveIndices=code_block)
surfaces = Output(clean)
code_block_2 = CodeBlock()
# ---------- code_block_2.designscript (14 lines) ----------
/*
#______________________________________________________________________________________________________________________________________________________#
#______________________________________________________________________________________________________________________________________________________#

#     88888888888                                                      88               888b      88                        88                         #
#     88                                                               88    ,d         8888b     88                        88                         #
#     88                                                               88    88         88 `8b    88                        88                         #
#     88aaaaa      ,adPPYYba,  ,adPPYba,   ,adPPYba,  8b,dPPYba,       88  MM88MMM      88  `8b   88   ,adPPYba,    ,adPPYb,88   ,adPPYba,  ,adPPYba,  #
#     88"""""      ""     `Y8  I8[    ""  a8P_____88  88P'   `"8a      88    88         88   `8b  88  a8"     "8a  a8"    `Y88  a8P_____88  I8[    ""  #
#     88           ,adPPPPP88   `"Y8ba,   8PP"""""""  88       88      88    88         88    `8b 88  8b       d8  8b       88  8PP"""""""   `"Y8ba,   #
#     88           88,    ,88  aa    ]8I  "8b,   ,aa  88       88      88    88,        88     `8888  "8a,   ,a8"  "8a,   ,d88  "8b,   ,aa  aa    ]8I  #
#     88888888888  `"8bbdP"Y8  `"YbbdP"'   `"Ybbd8"'  88       88      88    "Y888      88      `888   `"YbbdP"'    `"8bbdP"Y8   `"Ybbd8"'  `"YbbdP"'  #
#______________________________________________________________________________________________________________________________________________________#
#______________________________________________________________________________________________________________________________________________________# */;
# ----------------------------------------
