# Dynamo custom node Solid.Icosahderon.dyf (Dynamo 2.0.3.8810)
# category: Easen It Nodes
# Create Icosahderon geometry for the golden rectangles

scaleFactor = Input(scaleFactor: var[]..[])
python_script = Python(IN[0]=scaleFactor)
# ---------- python_script.python (93 lines) ----------
# Enable Python support and load DesignScript library
import clr
clr.AddReference('ProtoGeometry')
from Autodesk.DesignScript.Geometry import *

scaleFactor=IN[0]

# This list of icoshedron triangles.
tringulations=[]


# Create the golden ratio rectangles of the icoshedron
a=pntsXY=Polygon.Corners(Rectangle.ByWidthLength(Plane.XY(),0.618034,1))
b=pntsXZ=Polygon.Corners(Rectangle.ByWidthLength(Plane.XZ(),0.618034,1))
c=pntsYZ=Polygon.Corners(Rectangle.ByWidthLength(Plane.YZ(),0.618034,1))


# Creating triangularion by means of the corner points of these rectangles until the icoshedron is formed
##########
tringulations.append(Surface.ByPerimeterPoints([a[1],a[2],c[0]]))
tringulations.append(Surface.ByPerimeterPoints([a[1],a[2],c[1]]))
##########
tringulations.append(Surface.ByPerimeterPoints([a[0],a[3],c[2]]))
tringulations.append(Surface.ByPerimeterPoints([a[0],a[3],c[3]]))
##########
#######################################################################
##########
tringulations.append(Surface.ByPerimeterPoints([b[1],b[2],a[0]]))
tringulations.append(Surface.ByPerimeterPoints([b[1],b[2],a[1]]))
##########
tringulations.append(Surface.ByPerimeterPoints([b[0],b[3],a[2]]))
tringulations.append(Surface.ByPerimeterPoints([b[0],b[3],a[3]]))
##########
######################################################################
##########
tringulations.append(Surface.ByPerimeterPoints([c[1],c[2],b[0]]))
tringulations.append(Surface.ByPerimeterPoints([c[1],c[2],b[1]]))
##########
tringulations.append(Surface.ByPerimeterPoints([c[0],c[3],b[2]]))
tringulations.append(Surface.ByPerimeterPoints([c[0],c[3],b[3]]))
##########
############################################################################################################################################
############################################################################################################################################
############################################################################################################################################
tringulations.append(Surface.ByPerimeterPoints([a[0],b[1],c[2]]))
tringulations.append(Surface.ByPerimeterPoints([a[0],b[2],c[3]]))
##########
tringulations.append(Surface.ByPerimeterPoints([a[1],b[1],c[1]]))
tringulations.append(Surface.ByPerimeterPoints([a[1],b[2],c[0]]))
##########
tringulations.append(Surface.ByPerimeterPoints([a[2],b[0],c[1]]))
tringulations.append(Surface.ByPerimeterPoints([a[2],b[3],c[0]]))
##########
tringulations.append(Surface.ByPerimeterPoints([a[3],b[0],c[2]]))
tringulations.append(Surface.ByPerimeterPoints([a[3],b[3],c[3]]))


# Scale the geometry of icoshedron
scaledGeom=[]

for i in tringulations:
	scaledGeom.append(Geometry.Scale(i,scaleFactor,scaleFactor,scaleFactor))
# Find each face normal plane 
normals=[]	
for i in scaledGeom:
	normals.append(Surface.NormalAtParameter(i,0.5))
# Return each face polygon
triPolygons=[]
for i in scaledGeom:
	tmp=Surface.PerimeterCurves(i)
	pnts=[]
	for j in tmp:
		pnts.append(Curve.PointAtParameter(j,0))
	triPolygons.append(Polygon.ByPoints(pnts))

# The output list for the icoshedron 
OUT = scaledGeom,triPolygons,normals



#______________________________________________________________________________________________________________________________________________________#
#______________________________________________________________________________________________________________________________________________________#
                                                                                                                                              
#     88888888888                                                      88               888b      88                        88                         #
#     88                                                               88    ,d         8888b     88                        88                         #
#     88                                                               88    88         88 `8b    88                        88                         #
#     88aaaaa      ,adPPYYba,  ,adPPYba,   ,adPPYba,  8b,dPPYba,       88  MM88MMM      88  `8b   88   ,adPPYba,    ,adPPYb,88   ,adPPYba,  ,adPPYba,  #
#     88"""""      ""     `Y8  I8[    ""  a8P_____88  88P'   `"8a      88    88         88   `8b  88  a8"     "8a  a8"    `Y88  a8P_____88  I8[    ""  #
#     88           ,adPPPPP88   `"Y8ba,   8PP"""""""  88       88      88    88         88    `8b 88  8b       d8  8b       88  8PP"""""""   `"Y8ba,   #
#     88           88,    ,88  aa    ]8I  "8b,   ,aa  88       88      88    88,        88     `8888  "8a,   ,a8"  "8a,   ,d88  "8b,   ,aa  aa    ]8I  #
#     88888888888  `"8bbdP"Y8  `"YbbdP"'   `"Ybbd8"'  88       88      88    "Y888      88      `888   `"YbbdP"'    `"8bbdP"Y8   `"Ybbd8"'  `"YbbdP"'  #
#______________________________________________________________________________________________________________________________________________________#                                                                                                                                                 
#______________________________________________________________________________________________________________________________________________________#                              
# ----------------------------------------
code_block = CodeBlock(a=python_script) { a[0]; a[1]; a[2]; }
tringulations = Output(code_block.out0)
triPolygons = Output(code_block.out1)
normals = Output(code_block.out2)
