# Dynamo custom node Solid.createSolidPartitions.dyf (Dynamo 2.0.3.8810)
# category: Easen It Nodes
# Create solid partitions by means of a list of cutting planes

solid = Input(solid: var[]..[])
planes = Input(planes: var[]..[])
code_block = CodeBlock(t2=solid, t3=planes)
# ---------- code_block.designscript (4 lines) ----------
geometry1 = Geometry.Intersect(t2, t3);
t4 = List.Flatten(geometry1, -1);
t5 = List.Clean(t4, true);
solid1 = Surface.Thicken(t5, 0.1, true);
# ----------------------------------------
byUnion = Solid.ByUnion(solids=code_block.solid1)
PartitionsSolid = Output(byUnion)
code_block_2 = CodeBlock()
# ---------- code_block_2.designscript (14 lines) ----------
/*
#______________________________________________________________________________________________________________________________________________________#
#______________________________________________________________________________________________________________________________________________________#

#     88888888888                                                      88               888b      88                        88                         #
#     88                                                               88    ,d         8888b     88                        88                         #
#     88                                                               88    88         88 `8b    88                        88                         #
#     88aaaaa      ,adPPYYba,  ,adPPYba,   ,adPPYba,  8b,dPPYba,       88  MM88MMM      88  `8b   88   ,adPPYba,    ,adPPYb,88   ,adPPYba,  ,adPPYba,  #
#     88"""""      ""     `Y8  I8[    ""  a8P_____88  88P'   `"8a      88    88         88   `8b  88  a8"     "8a  a8"    `Y88  a8P_____88  I8[    ""  #
#     88           ,adPPPPP88   `"Y8ba,   8PP"""""""  88       88      88    88         88    `8b 88  8b       d8  8b       88  8PP"""""""   `"Y8ba,   #
#     88           88,    ,88  aa    ]8I  "8b,   ,aa  88       88      88    88,        88     `8888  "8a,   ,a8"  "8a,   ,d88  "8b,   ,aa  aa    ]8I  #
#     88888888888  `"8bbdP"Y8  `"YbbdP"'   `"Ybbd8"'  88       88      88    "Y888      88      `888   `"YbbdP"'    `"8bbdP"Y8   `"Ybbd8"'  `"YbbdP"'  #
#______________________________________________________________________________________________________________________________________________________#
#______________________________________________________________________________________________________________________________________________________#   */;
# ----------------------------------------
