# Dynamo custom node Solid.isolateSolidAngle.dyf (Dynamo 2.0.3.8810)
# category: Easen It Nodes
# Create two planes and return solid geometry between those two planes

solid = Input(solid: var[]..[])
firstAngle = Input(firstAngle: var[]..[])
secondAngle = Input(secondAngle: var[]..[])
thirdAngle = Input(thirdAngle: var[]..[])
python_script = Python(IN[0]=solid, IN[1]=firstAngle, IN[2]=secondAngle, IN[3]=thirdAngle)
# ---------- python_script.python (38 lines) ----------
# Enable Python support and load DesignScript library
import clr
clr.AddReference('ProtoGeometry')
from Autodesk.DesignScript.Geometry import *

# The input list for these nodes .
inSolid = IN[0]
angle_1=IN[1]
angle_2=IN[2]
angle_3=IN[3]

# Find solid centroid to creat a coordinate system at the normal of that plane and eventually rotating the desired angle and cut it by two planes and return the gometry within those two planes.

centroid=Solid.Centroid(inSolid)
mainPlane=Plane.ByOriginNormal(centroid,Vector.ByCoordinates(0,0,1))
plane_1=Geometry.Rotate(mainPlane,centroid,Vector.ByCoordinates(0,1,0),angle_1)
plane_2=Geometry.Rotate(mainPlane,centroid,Vector.ByCoordinates(0,1,0),angle_2)
plane_3=Geometry.Rotate(mainPlane,centroid,Vector.ByCoordinates(1,0,0),angle_3)
firstSplit=Geometry.Split(inSolid,plane_1)
secondSplit=Geometry.Split(firstSplit[0],plane_2)
lastSplit=Geometry.Split(firstSplit[0],plane_3)

OUT = lastSplit[1]


#______________________________________________________________________________________________________________________________________________________#
#______________________________________________________________________________________________________________________________________________________#
                                                                                                                                              
#     88888888888                                                      88               888b      88                        88                         #
#     88                                                               88    ,d         8888b     88                        88                         #
#     88                                                               88    88         88 `8b    88                        88                         #
#     88aaaaa      ,adPPYYba,  ,adPPYba,   ,adPPYba,  8b,dPPYba,       88  MM88MMM      88  `8b   88   ,adPPYba,    ,adPPYb,88   ,adPPYba,  ,adPPYba,  #
#     88"""""      ""     `Y8  I8[    ""  a8P_____88  88P'   `"8a      88    88         88   `8b  88  a8"     "8a  a8"    `Y88  a8P_____88  I8[    ""  #
#     88           ,adPPPPP88   `"Y8ba,   8PP"""""""  88       88      88    88         88    `8b 88  8b       d8  8b       88  8PP"""""""   `"Y8ba,   #
#     88           88,    ,88  aa    ]8I  "8b,   ,aa  88       88      88    88,        88     `8888  "8a,   ,a8"  "8a,   ,d88  "8b,   ,aa  aa    ]8I  #
#     88888888888  `"8bbdP"Y8  `"YbbdP"'   `"Ybbd8"'  88       88      88    "Y888      88      `888   `"YbbdP"'    `"8bbdP"Y8   `"Ybbd8"'  `"YbbdP"'  #
#______________________________________________________________________________________________________________________________________________________#                                                                                                                                                 
#______________________________________________________________________________________________________________________________________________________#                              
# ----------------------------------------
isolatedSolid = Output(python_script)
