# Dynamo custom node Solid.isolateSolidByQuarter.dyf (Dynamo 2.0.3.8810)
# category: Easen It Nodes
# Isolates the solids within a quarter of the global coordinate system the quarter numbers are from 1-8

solid = Input(solid: var[]..[])
quarterNum = Input(quarterNum: var[]..[])
python_script = Python(IN[0]=solid, IN[1]=quarterNum)
# ---------- python_script.python (73 lines) ----------
# Enable Python support and load DesignScript library
import clr
clr.AddReference('ProtoGeometry')
from Autodesk.DesignScript.Geometry import *

# The inputs to this node will be stored as a list in the IN variables.
solid=IN[0]
quarterNumber=IN[1]

# Create a golbal quarters to return the solid within a given quarter determined by the quarter number .
originPoint=Point.ByCoordinates(0,0,0)
cutPlane_1=Plane.ByOriginNormal(originPoint,Vector.ByCoordinates(0,0,1))
cutPlane_2=Plane.ByOriginNormal(originPoint,Vector.ByCoordinates(0,1,0))
cutPlane_3=Plane.ByOriginNormal(originPoint,Vector.ByCoordinates(1,0,0))


firstCut=Geometry.Split(solid,cutPlane_1)

result='No geometry was cut'
########################################################################
#Choose upper or lower half
try:
	if quarterNumber<1 or quarterNumber>8:
		raise IndexError('Invalid Quarter')
	if quarterNumber<5:
		########################################################################
		#Choose right or left half
		secondCut=Geometry.Split(firstCut[0],cutPlane_2)
		if quarterNumber<3:
			thirdCut=Geometry.Split(secondCut[0],cutPlane_3)
			if quarterNumber==1:
				result=thirdCut[0]
			else:
				result=thirdCut[1]
		else:
			thirdCut=Geometry.Split(secondCut[1],cutPlane_3)
			if quarterNumber==3:
				result=thirdCut[0]
			else:
				result=thirdCut[1]
	else:	
		secondCut=Geometry.Split(firstCut[1],cutPlane_2)
		if quarterNumber<7:
			thirdCut=Geometry.Split(secondCut[0],cutPlane_3)
			if quarterNumber==5:
				result=thirdCut[0]
			else:
				result=thirdCut[1]
		else:
			thirdCut=Geometry.Split(secondCut[1],cutPlane_3)
			if quarterNumber ==7:
				result=thirdCut[0]
			else:
				result=thirdCut[1]
except IndexError as e:
	result=e

OUT = result


#______________________________________________________________________________________________________________________________________________________#
#______________________________________________________________________________________________________________________________________________________#
                                                                                                                                              
#     88888888888                                                      88               888b      88                        88                         #
#     88                                                               88    ,d         8888b     88                        88                         #
#     88                                                               88    88         88 `8b    88                        88                         #
#     88aaaaa      ,adPPYYba,  ,adPPYba,   ,adPPYba,  8b,dPPYba,       88  MM88MMM      88  `8b   88   ,adPPYba,    ,adPPYb,88   ,adPPYba,  ,adPPYba,  #
#     88"""""      ""     `Y8  I8[    ""  a8P_____88  88P'   `"8a      88    88         88   `8b  88  a8"     "8a  a8"    `Y88  a8P_____88  I8[    ""  #
#     88           ,adPPPPP88   `"Y8ba,   8PP"""""""  88       88      88    88         88    `8b 88  8b       d8  8b       88  8PP"""""""   `"Y8ba,   #
#     88           88,    ,88  aa    ]8I  "8b,   ,aa  88       88      88    88,        88     `8888  "8a,   ,a8"  "8a,   ,d88  "8b,   ,aa  aa    ]8I  #
#     88888888888  `"8bbdP"Y8  `"YbbdP"'   `"Ybbd8"'  88       88      88    "Y888      88      `888   `"YbbdP"'    `"8bbdP"Y8   `"Ybbd8"'  `"YbbdP"'  #
#______________________________________________________________________________________________________________________________________________________#                                                                                                                                                 
#______________________________________________________________________________________________________________________________________________________#                              
# ----------------------------------------
isolatedQuarter = Output(python_script)
