# Dynamo custom node Solid.sliceRadially.dyf (Dynamo 2.0.3.8810)
# category: Easen It Nodes
# Slice a solid radially by a given angle for cutting planes

solid = Input(solid: var[]..[])
toAngle = Input(toAngle: var[]..[])
step = Input(step: var[]..[])
code_block = CodeBlock(toAngle=toAngle, step=step) { 0..toAngle..step; }
code_block_2 = CodeBlock(sphere1=solid, t1=code_block)
# ---------- code_block_2.designscript (5 lines) ----------
point1 = Solid.Centroid(sphere1);
vector1 = Vector.XAxis();
plane1 = Plane.ByOriginNormal(point1, vector1);
vector2 = Vector.ZAxis();
geometry1 = Geometry.Rotate(plane1, point1, vector2, t1);
# ----------------------------------------
code_block_3 = CodeBlock(s=solid, g=code_block_2.geometry1) { geometry1 = Geometry.Intersect(s, g); t2 = List.Flatten(geometry1, -1); t1 = t2; curve1 = Surface.PerimeterCurves(t1); }
code_block_4 = CodeBlock(geometry1=code_block_3.geometry1) { t2 = List.Flatten(geometry1, -1); t1 = t2; curve1 = Surface.PerimeterCurves(t1); t3=List.Flatten(curve1); }
curves = Output(code_block_4.t3)
surfaces = Output(code_block_3.t2)
code_block_5 = CodeBlock()
# ---------- code_block_5.designscript (14 lines) ----------
/*
#______________________________________________________________________________________________________________________________________________________#
#______________________________________________________________________________________________________________________________________________________#

#     88888888888                                                      88               888b      88                        88                         #
#     88                                                               88    ,d         8888b     88                        88                         #
#     88                                                               88    88         88 `8b    88                        88                         #
#     88aaaaa      ,adPPYYba,  ,adPPYba,   ,adPPYba,  8b,dPPYba,       88  MM88MMM      88  `8b   88   ,adPPYba,    ,adPPYb,88   ,adPPYba,  ,adPPYba,  #
#     88"""""      ""     `Y8  I8[    ""  a8P_____88  88P'   `"8a      88    88         88   `8b  88  a8"     "8a  a8"    `Y88  a8P_____88  I8[    ""  #
#     88           ,adPPPPP88   `"Y8ba,   8PP"""""""  88       88      88    88         88    `8b 88  8b       d8  8b       88  8PP"""""""   `"Y8ba,   #
#     88           88,    ,88  aa    ]8I  "8b,   ,aa  88       88      88    88,        88     `8888  "8a,   ,a8"  "8a,   ,d88  "8b,   ,aa  aa    ]8I  #
#     88888888888  `"8bbdP"Y8  `"YbbdP"'   `"Ybbd8"'  88       88      88    "Y888      88      `888   `"YbbdP"'    `"8bbdP"Y8   `"Ybbd8"'  `"YbbdP"'  #
#______________________________________________________________________________________________________________________________________________________#
#______________________________________________________________________________________________________________________________________________________#*/;
# ----------------------------------------
