# Dynamo custom node Solid.sliceSolidForCNC.dyf (Dynamo 2.0.3.8810)
# category: Easen It Nodes
# Slices a solid to surfaces and translate those surface in sequence and in order then exports them as SAT file which can be imported later in AutoCAD for CNC work

numberOfSlices = Input(numberOfSlices: var[]..[])
solid = Input(solid: var[]..[])
ZAxis = Vector.ZAxis()
sliceSolidToSurfaces = Custom[Solid.sliceSolidToSurfaces](numberOfSlices=numberOfSlices, solid=solid, axis=ZAxis)  # Creates a slices of surfaces out of solid by defining axis of slicing
code_block = CodeBlock(geometry1=solid)
# ---------- code_block.designscript (5 lines) ----------
boundingBox1 = BoundingBox.ByGeometry(geometry1);
point1 = BoundingBox.MaxPoint(boundingBox1);
t1 = Point.X(point1);
point2 = BoundingBox.MinPoint(boundingBox1);
t2 = Point.X(point2);
# ----------------------------------------
code_block_2 = CodeBlock(max=code_block.t1, min=code_block.t2) { max-min; }
count = List.Count(list=sliceSolidToSurfaces)
code_block_3 = CodeBlock(x=code_block_2, n=count) { x*n; }
code_block_4 = CodeBlock(reach=code_block_3, n=count, step=code_block_2) { 0..reach+0.3*n..step+0.3; }
code_block_5 = CodeBlock(t1=sliceSolidToSurfaces, t2=code_block_4)
# ---------- code_block_5.designscript (5 lines) ----------
curve1 = Surface.PerimeterCurves(t1);
vector1 = Vector.XAxis();
geometry1 = Geometry.Translate(curve1, vector1, t2);
plane1 = Plane.ByOriginNormal(Point.ByCoordinates(0, 0, 0), Vector.ByCoordinates(0, 0, 1));
vector2 = Vector.ZAxis();
# ----------------------------------------
project = Curve.Project(curve=code_block_5.geometry1, baseGeometry=code_block_5.plane1, projectionDirection=code_block_5.vector2)
flatten = List.Flatten(list=project)
filePath = Input(filePath: var[]..[])
exportToSAT = Geometry.ExportToSAT(geometry=flatten, filePath=filePath)
exportReport = Output(exportToSAT)
code_block_6 = CodeBlock()
# ---------- code_block_6.designscript (14 lines) ----------
/*
#______________________________________________________________________________________________________________________________________________________#
#______________________________________________________________________________________________________________________________________________________#

#     88888888888                                                      88               888b      88                        88                         #
#     88                                                               88    ,d         8888b     88                        88                         #
#     88                                                               88    88         88 `8b    88                        88                         #
#     88aaaaa      ,adPPYYba,  ,adPPYba,   ,adPPYba,  8b,dPPYba,       88  MM88MMM      88  `8b   88   ,adPPYba,    ,adPPYb,88   ,adPPYba,  ,adPPYba,  #
#     88"""""      ""     `Y8  I8[    ""  a8P_____88  88P'   `"8a      88    88         88   `8b  88  a8"     "8a  a8"    `Y88  a8P_____88  I8[    ""  #
#     88           ,adPPPPP88   `"Y8ba,   8PP"""""""  88       88      88    88         88    `8b 88  8b       d8  8b       88  8PP"""""""   `"Y8ba,   #
#     88           88,    ,88  aa    ]8I  "8b,   ,aa  88       88      88    88,        88     `8888  "8a,   ,a8"  "8a,   ,d88  "8b,   ,aa  aa    ]8I  #
#     88888888888  `"8bbdP"Y8  `"YbbdP"'   `"Ybbd8"'  88       88      88    "Y888      88      `888   `"YbbdP"'    `"8bbdP"Y8   `"Ybbd8"'  `"YbbdP"'  #
#______________________________________________________________________________________________________________________________________________________#
#______________________________________________________________________________________________________________________________________________________#*/;
# ----------------------------------------
