# Dynamo custom node Solid.sliceSolidToSolid.dyf (Dynamo 2.0.3.8810)
# category: Easen It Nodes
# Slices a solid to slices of solid type given thickness and axis of slicing

solid = Input(solid: var[]..[])
code_block = CodeBlock(sphere1=solid)
# ---------- code_block.designscript (3 lines) ----------
boundingBox1 = BoundingBox.ByGeometry(sphere1);
point1 = BoundingBox.MinPoint(boundingBox1);
point2 = BoundingBox.MaxPoint(boundingBox1);
# ----------------------------------------
axis = Input(axis: var[]..[])
python_script = Python(IN[0]=axis, IN[1]=code_block.point2, IN[2]=code_block.point1)
# ---------- python_script.python (37 lines) ----------
# Enable Python support and load DesignScript library
import clr
clr.AddReference('ProtoGeometry')
from Autodesk.DesignScript.Geometry import *

# The inputs to this node will be stored as a list in the IN variables.
vec=IN[0]

maxPoint=IN[1]
minPoint=IN[2]

def distanceOfLength(vectorToTest):
	if vectorToTest==Vector.XAxis():
		return maxPoint.X - minPoint.X
	elif vectorToTest==Vector.YAxis():
		return maxPoint.Y - minPoint.Y
	elif vectorToTest==Vector.ZAxis():
		return maxPoint.Z - minPoint.Z
	else:
		return 'Please choose X,Y or Z vector'
result=distanceOfLength(vec)
OUT = result,vec


#______________________________________________________________________________________________________________________________________________________#
#______________________________________________________________________________________________________________________________________________________#
                                                                                                                                              
#     88888888888                                                      88               888b      88                        88                         #
#     88                                                               88    ,d         8888b     88                        88                         #
#     88                                                               88    88         88 `8b    88                        88                         #
#     88aaaaa      ,adPPYYba,  ,adPPYba,   ,adPPYba,  8b,dPPYba,       88  MM88MMM      88  `8b   88   ,adPPYba,    ,adPPYb,88   ,adPPYba,  ,adPPYba,  #
#     88"""""      ""     `Y8  I8[    ""  a8P_____88  88P'   `"8a      88    88         88   `8b  88  a8"     "8a  a8"    `Y88  a8P_____88  I8[    ""  #
#     88           ,adPPPPP88   `"Y8ba,   8PP"""""""  88       88      88    88         88    `8b 88  8b       d8  8b       88  8PP"""""""   `"Y8ba,   #
#     88           88,    ,88  aa    ]8I  "8b,   ,aa  88       88      88    88,        88     `8888  "8a,   ,a8"  "8a,   ,d88  "8b,   ,aa  aa    ]8I  #
#     88888888888  `"8bbdP"Y8  `"YbbdP"'   `"Ybbd8"'  88       88      88    "Y888      88      `888   `"YbbdP"'    `"8bbdP"Y8   `"Ybbd8"'  `"YbbdP"'  #
#______________________________________________________________________________________________________________________________________________________#                                                                                                                                                 
#______________________________________________________________________________________________________________________________________________________#                              
# ----------------------------------------
code_block_2 = CodeBlock(OUT=python_script) { OUT[0]; OUT[1]; }
numberOfSlices = Input(numberOfSlices: var[]..[])
code_block_3 = CodeBlock(distance=code_block_2.out0, numberOfSlices=numberOfSlices) { 0..distance..#numberOfSlices; }
code_block_4 = CodeBlock(point1=code_block.point1, t1=code_block_2.out1, t2=code_block_3) { plane1 = Plane.ByOriginNormal(point1, t1); geometry1 = Geometry.Translate(plane1, t1, t2); }
intersect = Geometry.Intersect(geometry=solid, other=code_block_4.geometry1)
code_block_5 = CodeBlock { 2; }
flatten = List.Flatten(list=intersect, amt=code_block_5)
isSurface = Custom[Surface.isSurface](list=flatten)  # Filters a list and returns only the surfaces within that list
thickness = Input(thickness: var[]..[])
thicken = Surface.Thicken(surface=isSurface, thickness=thickness)
slices = Output(thicken)
code_block_6 = CodeBlock()
# ---------- code_block_6.designscript (14 lines) ----------
/*
#______________________________________________________________________________________________________________________________________________________#
#______________________________________________________________________________________________________________________________________________________#

#     88888888888                                                      88               888b      88                        88                         #
#     88                                                               88    ,d         8888b     88                        88                         #
#     88                                                               88    88         88 `8b    88                        88                         #
#     88aaaaa      ,adPPYYba,  ,adPPYba,   ,adPPYba,  8b,dPPYba,       88  MM88MMM      88  `8b   88   ,adPPYba,    ,adPPYb,88   ,adPPYba,  ,adPPYba,  #
#     88"""""      ""     `Y8  I8[    ""  a8P_____88  88P'   `"8a      88    88         88   `8b  88  a8"     "8a  a8"    `Y88  a8P_____88  I8[    ""  #
#     88           ,adPPPPP88   `"Y8ba,   8PP"""""""  88       88      88    88         88    `8b 88  8b       d8  8b       88  8PP"""""""   `"Y8ba,   #
#     88           88,    ,88  aa    ]8I  "8b,   ,aa  88       88      88    88,        88     `8888  "8a,   ,a8"  "8a,   ,d88  "8b,   ,aa  aa    ]8I  #
#     88888888888  `"8bbdP"Y8  `"YbbdP"'   `"Ybbd8"'  88       88      88    "Y888      88      `888   `"YbbdP"'    `"8bbdP"Y8   `"Ybbd8"'  `"YbbdP"'  #
#______________________________________________________________________________________________________________________________________________________#
#______________________________________________________________________________________________________________________________________________________#*/;
# ----------------------------------------
