# Dynamo custom node Solid.sliceSolidToSolidsWithAngles.dyf (Dynamo 2.0.3.8810)
# category: Easen It Nodes
# Slices a solid to slices of solid type given the thickness for those slices

solid = Input(solid: var[]..[])
xAngle = Input(xAngle: var[]..[])
code_block = CodeBlock(sphere1=solid, t1=xAngle)
# ---------- code_block.designscript (5 lines) ----------
boundingBox1 = BoundingBox.ByGeometry(sphere1);
point1 = BoundingBox.MinPoint(boundingBox1);
plane1 = Plane.ByOriginNormal(point1, Vector.ByCoordinates(0, 0, 1));
vector1 = Vector.XAxis();
geometry1 = Geometry.Rotate(plane1, point1, vector1, t1);
# ----------------------------------------
YAxis = Vector.YAxis()
yAngle = Input(yAngle: var[]..[])
rotate = Geometry.Rotate(geometry=code_block.geometry1, origin=code_block.point1, axis=YAxis, degrees=yAngle)
normal = Plane.Normal(plane=rotate)
reachDistance = Input(reachDistance: var[]..[])
DistanceBetweenPlanes = Input(DistanceBetweenPlanes: var[]..[])
code_block_2 = CodeBlock(reachDistance=reachDistance, DistanceBetweenPlanes=DistanceBetweenPlanes) { 0..reachDistance..DistanceBetweenPlanes; }
translate = Geometry.Translate(geometry=rotate, direction=normal, distance=code_block_2)
code_block_3 = CodeBlock(sphere1=solid, geometry2=translate) { Geometry.Intersect(sphere1, geometry2); }
code_block_4 = CodeBlock(geometry1=code_block_3) { t2 = List.Clean(geometry1, false); t3 = List.Flatten(t2, -1); }
isSurface = Custom[Surface.isSurface](list=code_block_4.t3)  # Filters a list and returns only the surfaces within that list
slicesThickness = Input(slicesThickness: var[]..[])
thicken = Surface.Thicken(surface=isSurface, thickness=slicesThickness)
solidSlices = Output(thicken)
code_block_5 = CodeBlock()
# ---------- code_block_5.designscript (14 lines) ----------
/*
#______________________________________________________________________________________________________________________________________________________#
#______________________________________________________________________________________________________________________________________________________#

#     88888888888                                                      88               888b      88                        88                         #
#     88                                                               88    ,d         8888b     88                        88                         #
#     88                                                               88    88         88 `8b    88                        88                         #
#     88aaaaa      ,adPPYYba,  ,adPPYba,   ,adPPYba,  8b,dPPYba,       88  MM88MMM      88  `8b   88   ,adPPYba,    ,adPPYb,88   ,adPPYba,  ,adPPYba,  #
#     88"""""      ""     `Y8  I8[    ""  a8P_____88  88P'   `"8a      88    88         88   `8b  88  a8"     "8a  a8"    `Y88  a8P_____88  I8[    ""  #
#     88           ,adPPPPP88   `"Y8ba,   8PP"""""""  88       88      88    88         88    `8b 88  8b       d8  8b       88  8PP"""""""   `"Y8ba,   #
#     88           88,    ,88  aa    ]8I  "8b,   ,aa  88       88      88    88,        88     `8888  "8a,   ,a8"  "8a,   ,d88  "8b,   ,aa  aa    ]8I  #
#     88888888888  `"8bbdP"Y8  `"YbbdP"'   `"Ybbd8"'  88       88      88    "Y888      88      `888   `"YbbdP"'    `"8bbdP"Y8   `"Ybbd8"'  `"YbbdP"'  #
#______________________________________________________________________________________________________________________________________________________#
#______________________________________________________________________________________________________________________________________________________#*/;
# ----------------------------------------
