# Dynamo custom node Solid.tetrahedronByBaseLength.dyf (Dynamo 2.0.3.8810)
# category: Easen It Nodes
# Create a tetrahedron geometry given a base length

baseLength = Input(baseLength: var[]..[])
python_script = Python(IN[0]=baseLength)
# ---------- python_script.python (50 lines) ----------
# Enable Python support and load DesignScript library
import clr
clr.AddReference('ProtoGeometry')
from Autodesk.DesignScript.Geometry import *

import math


####################################################################
# The inputs to this node will be stored as a list in the IN variables.
baseLength = IN[0]

sin60=math.sin(math.radians(60))
basePoints=[]
####################################################################
#Creating Base points of equliteral triangle
basePoints.append(Point.ByCoordinates(0, sin60*baseLength, 0))
basePoints.append(Point.ByCoordinates(-baseLength/2, 0, 0))
basePoints.append(Point.ByCoordinates(baseLength/2, 0, 0))
####################################################################
#Creating the tip of tetrahedron 
baseSurface=Surface.ByPerimeterPoints(basePoints)
basePolygon=Polygon.ByPoints(basePoints)
centerPoint=Polygon.Center(basePolygon)
vertexDirection=Surface.NormalAtPoint(baseSurface,centerPoint)
tipPoint=Geometry.Translate(centerPoint,vertexDirection,((sin60**2)*(baseLength**2)/4)**0.5)
#####################################################################
#Creating the thetrahedron surfaces
tetrahedronSrfcs=[]
tetrahedronSrfcs.append(baseSurface)
tetrahedronSrfcs.append(Surface.ByPerimeterPoints([basePoints[0],basePoints[1],tipPoint]))
tetrahedronSrfcs.append(Surface.ByPerimeterPoints([basePoints[0],basePoints[2],tipPoint]))
tetrahedronSrfcs.append(Surface.ByPerimeterPoints([basePoints[1],basePoints[2],tipPoint]))

OUT = tetrahedronSrfcs


#______________________________________________________________________________________________________________________________________________________#
#______________________________________________________________________________________________________________________________________________________#
                                                                                                                                              
#     88888888888                                                      88               888b      88                        88                         #
#     88                                                               88    ,d         8888b     88                        88                         #
#     88                                                               88    88         88 `8b    88                        88                         #
#     88aaaaa      ,adPPYYba,  ,adPPYba,   ,adPPYba,  8b,dPPYba,       88  MM88MMM      88  `8b   88   ,adPPYba,    ,adPPYb,88   ,adPPYba,  ,adPPYba,  #
#     88"""""      ""     `Y8  I8[    ""  a8P_____88  88P'   `"8a      88    88         88   `8b  88  a8"     "8a  a8"    `Y88  a8P_____88  I8[    ""  #
#     88           ,adPPPPP88   `"Y8ba,   8PP"""""""  88       88      88    88         88    `8b 88  8b       d8  8b       88  8PP"""""""   `"Y8ba,   #
#     88           88,    ,88  aa    ]8I  "8b,   ,aa  88       88      88    88,        88     `8888  "8a,   ,a8"  "8a,   ,d88  "8b,   ,aa  aa    ]8I  #
#     88888888888  `"8bbdP"Y8  `"YbbdP"'   `"Ybbd8"'  88       88      88    "Y888      88      `888   `"YbbdP"'    `"8bbdP"Y8   `"Ybbd8"'  `"YbbdP"'  #
#______________________________________________________________________________________________________________________________________________________#                                                                                                                                                 
#______________________________________________________________________________________________________________________________________________________#                              
# ----------------------------------------
tetrahedronSurfacs = Output(python_script)
