# Dynamo custom node Surface.Hyperboloid.dyf (Dynamo 2.0.3.8810)
# category: Easen It Nodes
# Create a hyberboloid surface geometry by parameters : Radius , Height and Rotation

code_block = CodeBlock { 0..1..#100; }
circleRadius = Input(circleRadius: var[]..[])
rotationDegree = Input(rotationDegree: var[]..[])
height = Input(height: var[]..[])
python_script = Python(IN[0]=code_block, IN[1]=circleRadius, IN[2]=rotationDegree, IN[3]=height)
# ---------- python_script.python (53 lines) ----------
# Enable Python support and load DesignScript library
import clr
clr.AddReference('ProtoGeometry')
from Autodesk.DesignScript.Geometry import *

# The inputs to this node will be stored as a list in the IN variables.
parameters = IN[0]
circleRadius = IN[1]
rotationDegree=IN[2]
height=IN[3]


baseCircle=Circle.ByCenterPointRadius(Point.ByCoordinates(0,0,0),circleRadius)
topCircle=Geometry.Translate(baseCircle,0,0,height)

# Create bottom face points
basePnts=[]
for i in parameters:
	basePnts.append(Curve.PointAtParameter(baseCircle,i))

# Create top face points
topPnts=[]
for i in parameters:
	topPnts.append(Curve.PointAtParameter(topCircle,i))

# Rotate the top face points
rotatedPnts=[]
for i in topPnts:
	rotatedPnts.append(Geometry.Rotate(i,Plane.ByOriginNormal(Point.ByCoordinates(0,0,0),Vector.ByCoordinates(0,0,1)),rotationDegree))

# Make lines between base and rotated points
hyperboloidLines=[]
for i in range(len(rotatedPnts)):
	hyperboloidLines.append(Line.ByStartPointEndPoint(rotatedPnts[i],basePnts[i]))

# Create hyperboloid surface
OUT = Surface.ByLoft(hyperboloidLines,baseCircle)



#______________________________________________________________________________________________________________________________________________________#
#______________________________________________________________________________________________________________________________________________________#
                                                                                                                                              
#     88888888888                                                      88               888b      88                        88                         #
#     88                                                               88    ,d         8888b     88                        88                         #
#     88                                                               88    88         88 `8b    88                        88                         #
#     88aaaaa      ,adPPYYba,  ,adPPYba,   ,adPPYba,  8b,dPPYba,       88  MM88MMM      88  `8b   88   ,adPPYba,    ,adPPYb,88   ,adPPYba,  ,adPPYba,  #
#     88"""""      ""     `Y8  I8[    ""  a8P_____88  88P'   `"8a      88    88         88   `8b  88  a8"     "8a  a8"    `Y88  a8P_____88  I8[    ""  #
#     88           ,adPPPPP88   `"Y8ba,   8PP"""""""  88       88      88    88         88    `8b 88  8b       d8  8b       88  8PP"""""""   `"Y8ba,   #
#     88           88,    ,88  aa    ]8I  "8b,   ,aa  88       88      88    88,        88     `8888  "8a,   ,a8"  "8a,   ,d88  "8b,   ,aa  aa    ]8I  #
#     88888888888  `"8bbdP"Y8  `"YbbdP"'   `"Ybbd8"'  88       88      88    "Y888      88      `888   `"YbbdP"'    `"8bbdP"Y8   `"Ybbd8"'  `"YbbdP"'  #
#______________________________________________________________________________________________________________________________________________________#                                                                                                                                                 
#______________________________________________________________________________________________________________________________________________________#                              
# ----------------------------------------
HyperboloidSurface = Output(python_script)
