# Dynamo custom node Surface.angleOfIncidence.dyf (Dynamo 2.0.3.8810)
# category: Easen It Nodes
# Finds the angle of incidence for a source point rays over a surface divided by Surface.dividePixels tool

sourcePoint = Input(sourcePoint: var[]..[])
precision = Input(precision: var[]..[])
surface = Input(surface: var[]..[])
dividePixels = Custom[Surface.dividePixels](precision=precision, surface=surface)  # Divide a given surface to a rectangular mesh the node returns the rectangles, surfaces by those recs and thier center point .
byTwoPoints = Vector.ByTwoPoints(start=sourcePoint, end=dividePixels.centerPoint)
normalAtPoint = Surface.NormalAtPoint(surface=dividePixels.surfaces, point=dividePixels.centerPoint)
angleWithVector = Vector.AngleWithVector(vector=byTwoPoints, otherVector=normalAtPoint)
angleOfIncidence = Output(angleWithVector)
code_block = CodeBlock()
# ---------- code_block.designscript (14 lines) ----------
/*
#______________________________________________________________________________________________________________________________________________________#
#______________________________________________________________________________________________________________________________________________________#

#     88888888888                                                      88               888b      88                        88                         #
#     88                                                               88    ,d         8888b     88                        88                         #
#     88                                                               88    88         88 `8b    88                        88                         #
#     88aaaaa      ,adPPYYba,  ,adPPYba,   ,adPPYba,  8b,dPPYba,       88  MM88MMM      88  `8b   88   ,adPPYba,    ,adPPYb,88   ,adPPYba,  ,adPPYba,  #
#     88"""""      ""     `Y8  I8[    ""  a8P_____88  88P'   `"8a      88    88         88   `8b  88  a8"     "8a  a8"    `Y88  a8P_____88  I8[    ""  #
#     88           ,adPPPPP88   `"Y8ba,   8PP"""""""  88       88      88    88         88    `8b 88  8b       d8  8b       88  8PP"""""""   `"Y8ba,   #
#     88           88,    ,88  aa    ]8I  "8b,   ,aa  88       88      88    88,        88     `8888  "8a,   ,a8"  "8a,   ,d88  "8b,   ,aa  aa    ]8I  #
#     88888888888  `"8bbdP"Y8  `"YbbdP"'   `"Ybbd8"'  88       88      88    "Y888      88      `888   `"YbbdP"'    `"8bbdP"Y8   `"Ybbd8"'  `"YbbdP"'  #
#______________________________________________________________________________________________________________________________________________________#
#______________________________________________________________________________________________________________________________________________________#*/;
# ----------------------------------------
