# Dynamo custom node Surface.coloredByDistanceParameter.dyf (Dynamo 2.0.3.8810)
# category: Easen It Nodes
# Color a surface divided by Surface.dividePixel according to a source point to visualize the flux

precision = Input(precision: var[]..[])
surface = Input(surface: var[]..[])
dividePixels = Custom[Surface.dividePixels](precision=precision, surface=surface)  # Divide a given surface to a rectangular mesh the node returns the rectangles, surfaces by those recs and thier center point .
color_palette = ColorPalette({R: 255, G: 0, B: 0, A: 255})
color_palette_2 = ColorPalette({R: 8, G: 103, B: 221, A: 255})
code_block = CodeBlock(t2=color_palette, t3=color_palette_2) { t4 = List.Join([t2, t3]); t1 = (0..1); }
sourcePoint = Input(sourcePoint: var[]..[])
code_block_2 = CodeBlock(t1=dividePixels.centerPoint, point1=sourcePoint) { num3 = Geometry.DistanceTo(t1, point1); t2 = Math.RemapRange(num3, 0, 1); }
color_range = ColorRange(colors=code_block.t4, indices=code_block.t1, value=code_block_2.t2)
byGeometryColor = Modifiers.GeometryColor.ByGeometryColor(geometry=dividePixels.surfaces, color=color_range)
geometryColored = Output(byGeometryColor)
code_block_3 = CodeBlock()
# ---------- code_block_3.designscript (14 lines) ----------
/*
#______________________________________________________________________________________________________________________________________________________#
#______________________________________________________________________________________________________________________________________________________#

#     88888888888                                                      88               888b      88                        88                         #
#     88                                                               88    ,d         8888b     88                        88                         #
#     88                                                               88    88         88 `8b    88                        88                         #
#     88aaaaa      ,adPPYYba,  ,adPPYba,   ,adPPYba,  8b,dPPYba,       88  MM88MMM      88  `8b   88   ,adPPYba,    ,adPPYb,88   ,adPPYba,  ,adPPYba,  #
#     88"""""      ""     `Y8  I8[    ""  a8P_____88  88P'   `"8a      88    88         88   `8b  88  a8"     "8a  a8"    `Y88  a8P_____88  I8[    ""  #
#     88           ,adPPPPP88   `"Y8ba,   8PP"""""""  88       88      88    88         88    `8b 88  8b       d8  8b       88  8PP"""""""   `"Y8ba,   #
#     88           88,    ,88  aa    ]8I  "8b,   ,aa  88       88      88    88,        88     `8888  "8a,   ,a8"  "8a,   ,d88  "8b,   ,aa  aa    ]8I  #
#     88888888888  `"8bbdP"Y8  `"YbbdP"'   `"Ybbd8"'  88       88      88    "Y888      88      `888   `"YbbdP"'    `"8bbdP"Y8   `"Ybbd8"'  `"YbbdP"'  #
#______________________________________________________________________________________________________________________________________________________#
#______________________________________________________________________________________________________________________________________________________#   */;
# ----------------------------------------
