# Dynamo custom node Surface.createPlanesInTangentDirection.dyf (Dynamo 2.0.3.8810)
# category: Easen It Nodes
# Create planes in the tangent direction of the surface

surface = Input(surface: Autodesk.DesignScript.Geometry.Surface)
code_block = CodeBlock { 1; }
pointAtParameter = Surface.PointAtParameter(surface=surface, u=code_block, v=code_block)
tangentAtUParameter = Surface.TangentAtUParameter(surface=surface, u=code_block, v=code_block)
reverse = Vector.Reverse(vector=tangentAtUParameter)
byOriginNormal = Plane.ByOriginNormal(origin=pointAtParameter, normal=reverse)
normalAtPoint = Surface.NormalAtPoint(surface=surface, point=pointAtParameter)
byOriginNormal_2 = Plane.ByOriginNormal(origin=pointAtParameter, normal=normalAtPoint)
angle = Input(angle: var[]..[])
code_block_2 = CodeBlock(angle=angle) { angle; }
rotate = Geometry.Rotate(geometry=byOriginNormal, basePlane=byOriginNormal_2, degrees=code_block_2)
normal = Plane.Normal(plane=rotate)
DistnaceToReach = Input(DistnaceToReach: var[]..[])
DistanceBetweenPlanes = Input(DistanceBetweenPlanes: var[]..[])
code_block_3 = CodeBlock(distance=DistnaceToReach, step=DistanceBetweenPlanes) { 0..distance..step; }
translate = Geometry.Translate(geometry=rotate, direction=normal, distance=code_block_3)
Planes = Output(translate)
code_block_4 = CodeBlock()
# ---------- code_block_4.designscript (14 lines) ----------
/*
#______________________________________________________________________________________________________________________________________________________#
#______________________________________________________________________________________________________________________________________________________#

#     88888888888                                                      88               888b      88                        88                         #
#     88                                                               88    ,d         8888b     88                        88                         #
#     88                                                               88    88         88 `8b    88                        88                         #
#     88aaaaa      ,adPPYYba,  ,adPPYba,   ,adPPYba,  8b,dPPYba,       88  MM88MMM      88  `8b   88   ,adPPYba,    ,adPPYb,88   ,adPPYba,  ,adPPYba,  #
#     88"""""      ""     `Y8  I8[    ""  a8P_____88  88P'   `"8a      88    88         88   `8b  88  a8"     "8a  a8"    `Y88  a8P_____88  I8[    ""  #
#     88           ,adPPPPP88   `"Y8ba,   8PP"""""""  88       88      88    88         88    `8b 88  8b       d8  8b       88  8PP"""""""   `"Y8ba,   #
#     88           88,    ,88  aa    ]8I  "8b,   ,aa  88       88      88    88,        88     `8888  "8a,   ,a8"  "8a,   ,d88  "8b,   ,aa  aa    ]8I  #
#     88888888888  `"8bbdP"Y8  `"YbbdP"'   `"Ybbd8"'  88       88      88    "Y888      88      `888   `"YbbdP"'    `"8bbdP"Y8   `"Ybbd8"'  `"YbbdP"'  #
#______________________________________________________________________________________________________________________________________________________#
#______________________________________________________________________________________________________________________________________________________#*/;
# ----------------------------------------
