# Dynamo custom node Surface.dividePixels.dyf (Dynamo 2.0.3.8810)
# category: Easen It Nodes
# Divide a given surface to a rectangular mesh the node returns the rectangles, surfaces by those recs and thier center point .

precision = Input(precision: var[]..[])
surface = Input(surface: var[]..[])
code_block = CodeBlock(num1=precision, t2=surface) { n = num1; t1 = (0..1..#n); point1 = Surface.PointAtParameter(t2<1>, t1<2>, t1<3>); t3 = List.Transpose(point1); }
python_script = Python(IN[0]=code_block.point1)
# ---------- python_script.python (19 lines) ----------
# Enable Python support and load DesignScript library
import clr
clr.AddReference('ProtoGeometry')
from Autodesk.DesignScript.Geometry import *

# The inputs to this node will be stored as a list in the IN variables.
v_pnts = IN[0]

plyCrvs=[]
crvs=[]

for i in range(len(v_pnts)):
	plyCrvs.append(PolyCurve.ByPoints(v_pnts[i]))

for i in plyCrvs:
	crvs.append(PolyCurve.Curves(i))


OUT = crvs
# ----------------------------------------
python_script_2 = Python(IN[0]=code_block.t3)  # same code as python_script
python_script_3 = Python(IN[0]=python_script, IN[1]=python_script_2)
# ---------- python_script_3.python (57 lines) ----------
# Enable Python support and load DesignScript library
import clr
clr.AddReference('ProtoGeometry')
from Autodesk.DesignScript.Geometry import *

# The inputs to this node will be stored as a list in the IN variables.
U_curves = IN[0]
V_curves = IN[1]

# The outputs to this node will be stored in these lists.
srfcs=[]
recs=[]

# Create Rectangles for the curves
for i in range(1,len(U_curves)):
	
	prev_U=U_curves[i-1]
	curr_U=U_curves[i]
	
	for j in range(1,len(V_curves)):
		prev_V=V_curves[j-1]
		curr_V=V_curves[j]
		
		recCrvs=[]
		recCrvs.append(prev_V[i-1])
		recCrvs.append(curr_V[i-1])
		recCrvs.append(prev_U[j-1])
		recCrvs.append(curr_U[j-1])
		
		p=PolyCurve.ByJoinedCurves(recCrvs)
		s=Surface.ByPatch(p)
		srfcs.append(s)
		
		recs.append(recCrvs)
		
centers=[]

for i in srfcs:
	centers.append(Surface.PointAtParameter(i,0.5,0.5))

OUT = srfcs,recs,centers



#______________________________________________________________________________________________________________________________________________________#
#______________________________________________________________________________________________________________________________________________________#
                                                                                                                                              
#     88888888888                                                      88               888b      88                        88                         #
#     88                                                               88    ,d         8888b     88                        88                         #
#     88                                                               88    88         88 `8b    88                        88                         #
#     88aaaaa      ,adPPYYba,  ,adPPYba,   ,adPPYba,  8b,dPPYba,       88  MM88MMM      88  `8b   88   ,adPPYba,    ,adPPYb,88   ,adPPYba,  ,adPPYba,  #
#     88"""""      ""     `Y8  I8[    ""  a8P_____88  88P'   `"8a      88    88         88   `8b  88  a8"     "8a  a8"    `Y88  a8P_____88  I8[    ""  #
#     88           ,adPPPPP88   `"Y8ba,   8PP"""""""  88       88      88    88         88    `8b 88  8b       d8  8b       88  8PP"""""""   `"Y8ba,   #
#     88           88,    ,88  aa    ]8I  "8b,   ,aa  88       88      88    88,        88     `8888  "8a,   ,a8"  "8a,   ,d88  "8b,   ,aa  aa    ]8I  #
#     88888888888  `"8bbdP"Y8  `"YbbdP"'   `"Ybbd8"'  88       88      88    "Y888      88      `888   `"YbbdP"'    `"8bbdP"Y8   `"Ybbd8"'  `"YbbdP"'  #
#______________________________________________________________________________________________________________________________________________________#                                                                                                                                                 
#______________________________________________________________________________________________________________________________________________________#                              
# ----------------------------------------
code_block_2 = CodeBlock(a=python_script_3) { a[0]; a[1]; a[2]; }
surfaces = Output(code_block_2.out0)
rectangles = Output(code_block_2.out1)
centerPoint = Output(code_block_2.out2)
code_block_3 = CodeBlock()
# ---------- code_block_3.designscript (14 lines) ----------
/*
#______________________________________________________________________________________________________________________________________________________#
#______________________________________________________________________________________________________________________________________________________#

#     88888888888                                                      88               888b      88                        88                         #
#     88                                                               88    ,d         8888b     88                        88                         #
#     88                                                               88    88         88 `8b    88                        88                         #
#     88aaaaa      ,adPPYYba,  ,adPPYba,   ,adPPYba,  8b,dPPYba,       88  MM88MMM      88  `8b   88   ,adPPYba,    ,adPPYb,88   ,adPPYba,  ,adPPYba,  #
#     88"""""      ""     `Y8  I8[    ""  a8P_____88  88P'   `"8a      88    88         88   `8b  88  a8"     "8a  a8"    `Y88  a8P_____88  I8[    ""  #
#     88           ,adPPPPP88   `"Y8ba,   8PP"""""""  88       88      88    88         88    `8b 88  8b       d8  8b       88  8PP"""""""   `"Y8ba,   #
#     88           88,    ,88  aa    ]8I  "8b,   ,aa  88       88      88    88,        88     `8888  "8a,   ,a8"  "8a,   ,d88  "8b,   ,aa  aa    ]8I  #
#     88888888888  `"8bbdP"Y8  `"YbbdP"'   `"Ybbd8"'  88       88      88    "Y888      88      `888   `"YbbdP"'    `"8bbdP"Y8   `"Ybbd8"'  `"YbbdP"'  #
#______________________________________________________________________________________________________________________________________________________#
#______________________________________________________________________________________________________________________________________________________# */;
# ----------------------------------------
