# Dynamo custom node Surface.extrudePolygonSurfaces.dyf (Dynamo 2.0.3.8810)
# category: Easen It Nodes
# Extrudes a polygon by means of external  point where each side for a triangle with that point the result is a mesh of surfaces

polygon = Input(polygon: var[]..[])
translatedPoint = Input(translatedPoint: var[]..[])
python_script = Python(IN[0]=polygon, IN[1]=translatedPoint)
# ---------- python_script.python (56 lines) ----------
# Enable Python support and load DesignScript library
import clr
clr.AddReference('ProtoGeometry')
from Autodesk.DesignScript.Geometry import *

# The inputs to this node will be stored as a list in the IN variables.
polygonList=IN[0]
extrudedPoint=IN[1]


tmp=[]
try:
	polygon=[]
	for j in polygonList:
		polygon.append(j)
	tmp.append(Polygon.Corners(polygon[0]))
except TypeError as t:
	tmp.append(Polygon.Corners(polygonList))
	
tmpPnt=[]
try:
	exPoint=[]
	for j in extrudedPoint:
		exPoint.append(j)
	tmpPnt.append(exPoint[0])
except TypeError as t:
	tmpPnt.append(extrudedPoint)
	
polygonCorners=tmp[0]
extrudedPoint=tmpPnt[0]

srfcs=[]

for i in range(0,len(polygonCorners)):
	tmpPnts=[]
	tmpPnts.append(polygonCorners[i-1])
	tmpPnts.append(polygonCorners[i])
	tmpPnts.append(extrudedPoint)
	srfcs.append(Surface.ByPerimeterPoints(tmpPnts))

OUT = srfcs


#______________________________________________________________________________________________________________________________________________________#
#______________________________________________________________________________________________________________________________________________________#
                                                                                                                                              
#     88888888888                                                      88               888b      88                        88                         #
#     88                                                               88    ,d         8888b     88                        88                         #
#     88                                                               88    88         88 `8b    88                        88                         #
#     88aaaaa      ,adPPYYba,  ,adPPYba,   ,adPPYba,  8b,dPPYba,       88  MM88MMM      88  `8b   88   ,adPPYba,    ,adPPYb,88   ,adPPYba,  ,adPPYba,  #
#     88"""""      ""     `Y8  I8[    ""  a8P_____88  88P'   `"8a      88    88         88   `8b  88  a8"     "8a  a8"    `Y88  a8P_____88  I8[    ""  #
#     88           ,adPPPPP88   `"Y8ba,   8PP"""""""  88       88      88    88         88    `8b 88  8b       d8  8b       88  8PP"""""""   `"Y8ba,   #
#     88           88,    ,88  aa    ]8I  "8b,   ,aa  88       88      88    88,        88     `8888  "8a,   ,a8"  "8a,   ,d88  "8b,   ,aa  aa    ]8I  #
#     88888888888  `"8bbdP"Y8  `"YbbdP"'   `"Ybbd8"'  88       88      88    "Y888      88      `888   `"YbbdP"'    `"8bbdP"Y8   `"Ybbd8"'  `"YbbdP"'  #
#______________________________________________________________________________________________________________________________________________________#                                                                                                                                                 
#______________________________________________________________________________________________________________________________________________________#                              
# ----------------------------------------
meshSurfaces = Output(python_script)
