# Dynamo custom node Surface.findFlux.dyf (Dynamo 2.0.3.8810)
# category: Easen It Nodes
# Finds the flux for a unitary source point over a surface divided by Surface.dividePixels ( Flux= 1* pixelArea * cos(angleOfIncidence) )

precision = Input(precision: var[]..[])
surface = Input(surface: var[]..[])
dividePixels = Custom[Surface.dividePixels](precision=precision, surface=surface)  # Divide a given surface to a rectangular mesh the node returns the rectangles, surfaces by those recs and thier center point .
sourcePoint = Input(sourcePoint: var[]..[])
angleOfIncidence = Custom[Surface.angleOfIncidence](sourcePoint=sourcePoint, precision=precision, surface=surface)  # Finds the angle of incidence for a source point rays over a surface divided by Surface.dividePixels tool
code_block = CodeBlock(t1=dividePixels.surfaces, t2=angleOfIncidence) { num1 = Surface.Area(t1); num2 = Math.Cos(t2); }
code_block_2 = CodeBlock(area=code_block.num1, CosineAngleOfIncidence=code_block.num2) { flux=area*CosineAngleOfIncidence; }
fluxes = Output(code_block_2)
python_script = Python(IN[0]=code_block_2)
# ---------- python_script.python (10 lines) ----------
# Enable Python support and load DesignScript library
import clr
clr.AddReference('ProtoGeometry')
from Autodesk.DesignScript.Geometry import *

# The inputs to this node will be stored as a list in the IN variables.
fluxes = IN[0]


OUT = sum(fluxes)
# ----------------------------------------
fluxesSum = Output(python_script)
code_block_3 = CodeBlock()
# ---------- code_block_3.designscript (14 lines) ----------
/*
#______________________________________________________________________________________________________________________________________________________#
#______________________________________________________________________________________________________________________________________________________#

#     88888888888                                                      88               888b      88                        88                         #
#     88                                                               88    ,d         8888b     88                        88                         #
#     88                                                               88    88         88 `8b    88                        88                         #
#     88aaaaa      ,adPPYYba,  ,adPPYba,   ,adPPYba,  8b,dPPYba,       88  MM88MMM      88  `8b   88   ,adPPYba,    ,adPPYb,88   ,adPPYba,  ,adPPYba,  #
#     88"""""      ""     `Y8  I8[    ""  a8P_____88  88P'   `"8a      88    88         88   `8b  88  a8"     "8a  a8"    `Y88  a8P_____88  I8[    ""  #
#     88           ,adPPPPP88   `"Y8ba,   8PP"""""""  88       88      88    88         88    `8b 88  8b       d8  8b       88  8PP"""""""   `"Y8ba,   #
#     88           88,    ,88  aa    ]8I  "8b,   ,aa  88       88      88    88,        88     `8888  "8a,   ,a8"  "8a,   ,d88  "8b,   ,aa  aa    ]8I  #
#     88888888888  `"8bbdP"Y8  `"YbbdP"'   `"Ybbd8"'  88       88      88    "Y888      88      `888   `"YbbdP"'    `"8bbdP"Y8   `"Ybbd8"'  `"YbbdP"'  #
#______________________________________________________________________________________________________________________________________________________#
#______________________________________________________________________________________________________________________________________________________#*/;
# ----------------------------------------
