# Dynamo custom node Surface.getSurfaceContours.dyf (Dynamo 2.0.3.8810)
# category: Easen It Nodes
# Returns the surface curve contours and project them onto XY plane

minRange = Input(minRange: var[]..[])
maxRange = Input(maxRange: var[]..[])
step = Input(step: var[]..[])
code_block = CodeBlock(minRange=minRange, maxRange=maxRange, step=step) { minRange..maxRange..step; }
surface = Input(surface: var[]..[])
code_block_2 = CodeBlock(range=code_block, t3=surface)
# ---------- code_block_2.designscript (4 lines) ----------
planes = Geometry.Translate(Plane.XY(), 0, 0, range);
intersectionPlanes = Geometry.Intersect(planes, t3);
t4 = List.Flatten(intersectionPlanes, -1);
t5 = List.Clean(t4, false);
# ----------------------------------------
cleanPoints = Custom[List.cleanPoints](flattenedList=code_block_2.t5)  # Removies all points items from a given list
cleanCurves = Custom[List.cleanCurves](flattenedList=code_block_2.t5)  # Removes all curves items from a given list
code_block_3 = CodeBlock(t1=cleanPoints, t2=cleanCurves)
# ---------- code_block_3.designscript (3 lines) ----------
crvs = Curve.PullOntoPlane(t1, Plane.XY());
pnts = Point.Project(t2, Plane.XY(), Vector.ByCoordinates(0, 0, -1));
t=List.Join([crvs,pnts]);
# ----------------------------------------
projectionContours = Output(code_block_3.t)
code_block_4 = CodeBlock()
# ---------- code_block_4.designscript (14 lines) ----------
/*
#______________________________________________________________________________________________________________________________________________________#
#______________________________________________________________________________________________________________________________________________________#

#     88888888888                                                      88               888b      88                        88                         #
#     88                                                               88    ,d         8888b     88                        88                         #
#     88                                                               88    88         88 `8b    88                        88                         #
#     88aaaaa      ,adPPYYba,  ,adPPYba,   ,adPPYba,  8b,dPPYba,       88  MM88MMM      88  `8b   88   ,adPPYba,    ,adPPYb,88   ,adPPYba,  ,adPPYba,  #
#     88"""""      ""     `Y8  I8[    ""  a8P_____88  88P'   `"8a      88    88         88   `8b  88  a8"     "8a  a8"    `Y88  a8P_____88  I8[    ""  #
#     88           ,adPPPPP88   `"Y8ba,   8PP"""""""  88       88      88    88         88    `8b 88  8b       d8  8b       88  8PP"""""""   `"Y8ba,   #
#     88           88,    ,88  aa    ]8I  "8b,   ,aa  88       88      88    88,        88     `8888  "8a,   ,a8"  "8a,   ,d88  "8b,   ,aa  aa    ]8I  #
#     88888888888  `"8bbdP"Y8  `"YbbdP"'   `"Ybbd8"'  88       88      88    "Y888      88      `888   `"YbbdP"'    `"8bbdP"Y8   `"Ybbd8"'  `"YbbdP"'  #
#______________________________________________________________________________________________________________________________________________________#
#______________________________________________________________________________________________________________________________________________________#   */;
# ----------------------------------------
