# Dynamo custom node Surface.isWithinSurface.dyf (Dynamo 2.0.3.8810)
# category: Easen It Nodes
# Tests a list of points and returns the points within the list and the points outside that surface

PointsToTest = Input(PointsToTest: Autodesk.DesignScript.Geometry.Point)
SurfaceToTest = Input(SurfaceToTest: Autodesk.DesignScript.Geometry.Surface)
number = DoubleInput(0)  # graph input
number_2 = DoubleInput(1)  # graph input
pointAtParameter = Surface.PointAtParameter(surface=SurfaceToTest, u=number, v=number_2)
byStartPointEndPoint = Line.ByStartPointEndPoint(startPoint=pointAtParameter, endPoint=PointsToTest)
doesIntersect = Geometry.DoesIntersect(geometry=SurfaceToTest, other=byStartPointEndPoint)
number_3 = DoubleInput(1)  # graph input
number_4 = DoubleInput(0)  # graph input
pointAtParameter_2 = Surface.PointAtParameter(surface=SurfaceToTest, u=number_3, v=number_4)
byStartPointEndPoint_2 = Line.ByStartPointEndPoint(startPoint=pointAtParameter_2, endPoint=PointsToTest)
doesIntersect_2 = Geometry.DoesIntersect(geometry=SurfaceToTest, other=byStartPointEndPoint_2)
and_ = doesIntersect && doesIntersect_2
number_5 = DoubleInput(1)  # graph input
pointAtParameter_3 = Surface.PointAtParameter(surface=SurfaceToTest, u=number_5, v=number_5)
byStartPointEndPoint_3 = Line.ByStartPointEndPoint(startPoint=pointAtParameter_3, endPoint=PointsToTest)
doesIntersect_3 = Geometry.DoesIntersect(geometry=SurfaceToTest, other=byStartPointEndPoint_3)
number_6 = DoubleInput(0)  # graph input
pointAtParameter_4 = Surface.PointAtParameter(surface=SurfaceToTest, u=number_6, v=number_6)
byStartPointEndPoint_4 = Line.ByStartPointEndPoint(startPoint=pointAtParameter_4, endPoint=PointsToTest)
doesIntersect_4 = Geometry.DoesIntersect(geometry=SurfaceToTest, other=byStartPointEndPoint_4)
and_2 = doesIntersect_3 && doesIntersect_4
and_3 = and_ && and_2
filterByBoolMask = List.FilterByBoolMask(list=PointsToTest, mask=and_3)
code_block = CodeBlock { false; }
clean = List.Clean(list=filterByBoolMask.in, preserveIndices=code_block)
flatten = List.Flatten(list=clean)
WithinPoints = Output(flatten)  # "WithinPoints:Point"
WithoutPoints = Output(filterByBoolMask.out)  # "WithoutPoints:Point"
code_block_2 = CodeBlock()
# ---------- code_block_2.designscript (14 lines) ----------
/*
#______________________________________________________________________________________________________________________________________________________#
#______________________________________________________________________________________________________________________________________________________#

#     88888888888                                                      88               888b      88                        88                         #
#     88                                                               88    ,d         8888b     88                        88                         #
#     88                                                               88    88         88 `8b    88                        88                         #
#     88aaaaa      ,adPPYYba,  ,adPPYba,   ,adPPYba,  8b,dPPYba,       88  MM88MMM      88  `8b   88   ,adPPYba,    ,adPPYb,88   ,adPPYba,  ,adPPYba,  #
#     88"""""      ""     `Y8  I8[    ""  a8P_____88  88P'   `"8a      88    88         88   `8b  88  a8"     "8a  a8"    `Y88  a8P_____88  I8[    ""  #
#     88           ,adPPPPP88   `"Y8ba,   8PP"""""""  88       88      88    88         88    `8b 88  8b       d8  8b       88  8PP"""""""   `"Y8ba,   #
#     88           88,    ,88  aa    ]8I  "8b,   ,aa  88       88      88    88,        88     `8888  "8a,   ,a8"  "8a,   ,d88  "8b,   ,aa  aa    ]8I  #
#     88888888888  `"8bbdP"Y8  `"YbbdP"'   `"Ybbd8"'  88       88      88    "Y888      88      `888   `"YbbdP"'    `"8bbdP"Y8   `"Ybbd8"'  `"YbbdP"'  #
#______________________________________________________________________________________________________________________________________________________#
#______________________________________________________________________________________________________________________________________________________# */;
# ----------------------------------------
