# Dynamo custom node Surface.overSurfaceGrid .dyf "Surface.overSurfaceGrid" (Dynamo 2.0.3.8810)
# category: Easen It Nodes
# Creates a grid of points over a surface

surfaceOfGird = Input(surfaceOfGird: var[]..[])
parameterVal = Input(parameterVal: var[]..[])
code_block = CodeBlock(n=parameterVal) { 0..1..#n; }
pointAtParameter = Surface.PointAtParameter(surface=surfaceOfGird, u=code_block, v=code_block, lacing=CrossProduct)
code_block_2 = CodeBlock { -1; }
flatten = List.Flatten(list=pointAtParameter, amt=code_block_2)
gridPoints = Output(flatten)
