# Dynamo custom node Surface.turblentSurface.dyf (Dynamo 2.0.3.8810)
# category: Easen It Nodes
# Make a given surface turblent one randomly

Density = Input(Density: var[]..[])
surface = Input(surface: var[]..[])
code_block = CodeBlock(num1=Density, surface1=surface)
# ---------- code_block.designscript (6 lines) ----------
n = num1;
t1 = (0..1..#n);
point1 = Surface.PointAtParameter(surface1<1>, t1<2>, t1<3>);
t2 = List.Flatten(point1, -1);
vector1 = Surface.NormalAtParameter(surface1<1>, t1<2>, t1<3>);
t3 = List.Flatten(vector1, -1);
# ----------------------------------------
Amplitude = Input(Amplitude: var[]..[])
python_script = Python(IN[0]=code_block.t2, IN[1]=Amplitude)
# ---------- python_script.python (32 lines) ----------
import clr
import sys
clr.AddReference('ProtoGeometry')
from Autodesk.DesignScript.Geometry import *
pyt_path = r'C:\Program Files (x86)\IronPython 2.7\Lib'
sys.path.append(pyt_path)
import random

pnts=IN[0]
amp=IN[1]

distances=[]

for i in range(len(pnts)):
	distances.append(amp*random.random())

OUT = distances


#______________________________________________________________________________________________________________________________________________________#
#______________________________________________________________________________________________________________________________________________________#
                                                                                                                                              
#     88888888888                                                      88               888b      88                        88                         #
#     88                                                               88    ,d         8888b     88                        88                         #
#     88                                                               88    88         88 `8b    88                        88                         #
#     88aaaaa      ,adPPYYba,  ,adPPYba,   ,adPPYba,  8b,dPPYba,       88  MM88MMM      88  `8b   88   ,adPPYba,    ,adPPYb,88   ,adPPYba,  ,adPPYba,  #
#     88"""""      ""     `Y8  I8[    ""  a8P_____88  88P'   `"8a      88    88         88   `8b  88  a8"     "8a  a8"    `Y88  a8P_____88  I8[    ""  #
#     88           ,adPPPPP88   `"Y8ba,   8PP"""""""  88       88      88    88         88    `8b 88  8b       d8  8b       88  8PP"""""""   `"Y8ba,   #
#     88           88,    ,88  aa    ]8I  "8b,   ,aa  88       88      88    88,        88     `8888  "8a,   ,a8"  "8a,   ,d88  "8b,   ,aa  aa    ]8I  #
#     88888888888  `"8bbdP"Y8  `"YbbdP"'   `"Ybbd8"'  88       88      88    "Y888      88      `888   `"YbbdP"'    `"8bbdP"Y8   `"Ybbd8"'  `"YbbdP"'  #
#______________________________________________________________________________________________________________________________________________________#                                                                                                                                                 
#______________________________________________________________________________________________________________________________________________________#                              
# ----------------------------------------
code_block_2 = CodeBlock(t1=code_block.t2, t2=code_block.t3, t3=python_script, num1=Density)
# ---------- code_block_2.designscript (3 lines) ----------
geometry1 = Geometry.Translate(t1, t2, t3);
t4 = List.Chop(geometry1, num1);
nurbsSurface1 = NurbsSurface.ByPoints(t4, 3, 3);
# ----------------------------------------
resultSurface = Output(code_block_2.nurbsSurface1)
