# Dynamo custom node TSpline.DelaunayTesselationGeometry.dyf (Dynamo 2.0.3.8810)
# category: Easen It Nodes
# Create a Delaunay tesselation geometry using TSpline functionality

numberOfUVs = Input(numberOfUVs: var[]..[])
python_script = Python(IN[0]=numberOfUVs)
# ---------- python_script.python (15 lines) ----------
import clr
import sys
clr.AddReference('ProtoGeometry')
from Autodesk.DesignScript.Geometry import *
pyt_path = r'C:\Program Files (x86)\IronPython 2.7\Lib'
sys.path.append(pyt_path)
import random
# The inputs to this node will be stored as a list in the IN variables.
count = IN[0]

UVs=[]

for i in range(count):
	UVs.append(UV.ByCoordinates(random.random(),random.random()))
OUT = UVs
# ----------------------------------------
surface = Input(surface: var[]..[])
radius = Input(radius: var[]..[])
code_block = CodeBlock(randomUVs=python_script, srfc=surface, radius=radius)
# ---------- code_block.designscript (8 lines) ----------
DelaunayCurves = Delaunay.ByParametersOnSurface(randomUVs, srfc);
surfaceThickening=Surface.Thicken(srfc,0.3,true);
innerCurves = Geometry.Intersect(surfaceThickening, DelaunayCurves);
innerCurvesFlattened = List.Flatten(innerCurves, -1);
finalGeometrySurface = TSplineSurface.BuildPipes(innerCurvesFlattened, radius, 0.001, null, true, true, null, null, null, null, null, null, true);
/*********************************************************************************************/
perimeterCurves = Surface.PerimeterCurves(srfc);
finalGeometryCurve = TSplineSurface.BuildPipes(perimeterCurves, radius, 0.001, null, true, true, null, null, null, null, null, null, true);
# ----------------------------------------
DelaunayGeometry = Output(code_block.finalGeometrySurface)
frameGeometry = Output(code_block.finalGeometryCurve)
code_block_2 = CodeBlock()
# ---------- code_block_2.designscript (14 lines) ----------
/*
#______________________________________________________________________________________________________________________________________________________#
#______________________________________________________________________________________________________________________________________________________#

#     88888888888                                                      88               888b      88                        88                         #
#     88                                                               88    ,d         8888b     88                        88                         #
#     88                                                               88    88         88 `8b    88                        88                         #
#     88aaaaa      ,adPPYYba,  ,adPPYba,   ,adPPYba,  8b,dPPYba,       88  MM88MMM      88  `8b   88   ,adPPYba,    ,adPPYb,88   ,adPPYba,  ,adPPYba,  #
#     88"""""      ""     `Y8  I8[    ""  a8P_____88  88P'   `"8a      88    88         88   `8b  88  a8"     "8a  a8"    `Y88  a8P_____88  I8[    ""  #
#     88           ,adPPPPP88   `"Y8ba,   8PP"""""""  88       88      88    88         88    `8b 88  8b       d8  8b       88  8PP"""""""   `"Y8ba,   #
#     88           88,    ,88  aa    ]8I  "8b,   ,aa  88       88      88    88,        88     `8888  "8a,   ,a8"  "8a,   ,d88  "8b,   ,aa  aa    ]8I  #
#     88888888888  `"8bbdP"Y8  `"YbbdP"'   `"Ybbd8"'  88       88      88    "Y888      88      `888   `"YbbdP"'    `"8bbdP"Y8   `"Ybbd8"'  `"YbbdP"'  #
#______________________________________________________________________________________________________________________________________________________#
#______________________________________________________________________________________________________________________________________________________# */;
# ----------------------------------------
