# Dynamo custom node deformSurfaces.createAttractorControl.dyf (Dynamo 2.0.3.8810)
# category: Easen It Nodes
# Create a new set of points that is deformed by an attractor point

setOfPoints = Input(setOfPoints: var[]..[])
AttractorPoint = Input(AttractorPoint: var[]..[])
code_block = CodeBlock(t1=setOfPoints, t2=AttractorPoint) { vector1 = Vector.ByTwoPoints(t1<1>, t2<2>); t3 = Geometry.DistanceTo(t1<1>, t2<2>); }
code_block_2 = CodeBlock { 40; }
code_block_3 = CodeBlock(t2=code_block.t3) { t3 = List.Flatten(t2, 2); }
python_script = Python(IN[0]=code_block_3)
# ---------- python_script.python (12 lines) ----------
# Enable Python support and load DesignScript library
import clr
clr.AddReference('ProtoGeometry')
from Autodesk.DesignScript.Geometry import *

# The inputs to this node will be stored as a list in the IN variables.
x = IN[0]

squared=[]
for i in x:
	squared.append(1/(i**2))
OUT = squared
# ----------------------------------------
code_block_4 = CodeBlock(factor=code_block_2, distance=python_script) { factor*distance; }
code_block_5 = CodeBlock(t1=setOfPoints, vector1=code_block.vector1, t2=code_block_4) { geometry1 = Geometry.Translate(t1, vector1, t2); t3 = List.Flatten(geometry1, -1); }
newSetOfPoints = Output(code_block_5.t3)
code_block_6 = CodeBlock()
# ---------- code_block_6.designscript (14 lines) ----------
/*
#______________________________________________________________________________________________________________________________________________________#
#______________________________________________________________________________________________________________________________________________________#

#     88888888888                                                      88               888b      88                        88                         #
#     88                                                               88    ,d         8888b     88                        88                         #
#     88                                                               88    88         88 `8b    88                        88                         #
#     88aaaaa      ,adPPYYba,  ,adPPYba,   ,adPPYba,  8b,dPPYba,       88  MM88MMM      88  `8b   88   ,adPPYba,    ,adPPYb,88   ,adPPYba,  ,adPPYba,  #
#     88"""""      ""     `Y8  I8[    ""  a8P_____88  88P'   `"8a      88    88         88   `8b  88  a8"     "8a  a8"    `Y88  a8P_____88  I8[    ""  #
#     88           ,adPPPPP88   `"Y8ba,   8PP"""""""  88       88      88    88         88    `8b 88  8b       d8  8b       88  8PP"""""""   `"Y8ba,   #
#     88           88,    ,88  aa    ]8I  "8b,   ,aa  88       88      88    88,        88     `8888  "8a,   ,a8"  "8a,   ,d88  "8b,   ,aa  aa    ]8I  #
#     88888888888  `"8bbdP"Y8  `"YbbdP"'   `"Ybbd8"'  88       88      88    "Y888      88      `888   `"YbbdP"'    `"8bbdP"Y8   `"Ybbd8"'  `"YbbdP"'  #
#______________________________________________________________________________________________________________________________________________________#
#______________________________________________________________________________________________________________________________________________________#*/;
# ----------------------------------------
