# Dynamo custom node deformSurfaces.deformByPointNode.dyf (Dynamo 2.0.3.8810)
# category: Easen It Nodes
# Deform surfaces by creating a gird of points an choosing what point index to translate and deform according to its new location

surface = Input(surface: var[]..[])
pointsParameter = Input(pointsParameter: var[]..[])
pointIndex = Input(pointIndex: var[]..[])
translatingDirection = Input(translatingDirection: var[]..[])
distance = Input(distance: var[]..[])
code_block = CodeBlock(num1=pointsParameter, surface1=surface, num2=pointIndex, vector1=translatingDirection, num3=distance)
# ---------- code_block.designscript (9 lines) ----------
n = num1;
t1 = (0..1..#n);
point1 = Surface.PointAtParameter(surface1<1>, t1<2>, t1<3>);
t2 = List.Flatten(point1, -1);
t3 = List.GetItemAtIndex(t2, num2);
geometry1 = Geometry.Translate(t3, vector1, num3);
t4 = List.ReplaceItemAtIndex(t2, num2, geometry1);
t5 = List.Chop(t4, num1);
nurbsSurface1 = NurbsSurface.ByPoints(t5, 3, 3);
# ----------------------------------------
python_script = Python(IN[0]=code_block.nurbsSurface1)
# ---------- python_script.python (17 lines) ----------
import clr
clr.AddReference('ProtoGeometry')
from Autodesk.DesignScript.Geometry import *


srfc = IN[0]

bBox= BoundingBox.ByGeometry(srfc)

pMax = bBox.MaxPoint
pMin = bBox.MinPoint

xHeight = pMax.X-pMin.X
yHeight = pMax.Y-pMin.Y
zHeight = pMax.Z-pMin.Z

OUT = max(xHeight,yHeight,zHeight)
# ----------------------------------------
code_block_2 = CodeBlock(surface1=surface, t1=python_script, nurbsSurface1=code_block.nurbsSurface1) { solid1 = Surface.Thicken(surface1, t1); geometry1 = Geometry.Intersect(solid1, nurbsSurface1); }
deformedSurface = Output(code_block_2.geometry1)
code_block_3 = CodeBlock()
# ---------- code_block_3.designscript (14 lines) ----------
/*
#______________________________________________________________________________________________________________________________________________________#
#______________________________________________________________________________________________________________________________________________________#

#     88888888888                                                      88               888b      88                        88                         #
#     88                                                               88    ,d         8888b     88                        88                         #
#     88                                                               88    88         88 `8b    88                        88                         #
#     88aaaaa      ,adPPYYba,  ,adPPYba,   ,adPPYba,  8b,dPPYba,       88  MM88MMM      88  `8b   88   ,adPPYba,    ,adPPYb,88   ,adPPYba,  ,adPPYba,  #
#     88"""""      ""     `Y8  I8[    ""  a8P_____88  88P'   `"8a      88    88         88   `8b  88  a8"     "8a  a8"    `Y88  a8P_____88  I8[    ""  #
#     88           ,adPPPPP88   `"Y8ba,   8PP"""""""  88       88      88    88         88    `8b 88  8b       d8  8b       88  8PP"""""""   `"Y8ba,   #
#     88           88,    ,88  aa    ]8I  "8b,   ,aa  88       88      88    88,        88     `8888  "8a,   ,a8"  "8a,   ,d88  "8b,   ,aa  aa    ]8I  #
#     88888888888  `"8bbdP"Y8  `"YbbdP"'   `"Ybbd8"'  88       88      88    "Y888      88      `888   `"YbbdP"'    `"8bbdP"Y8   `"Ybbd8"'  `"YbbdP"'  #
#______________________________________________________________________________________________________________________________________________________#
#______________________________________________________________________________________________________________________________________________________#*/;
# ----------------------------------------
