# Dynamo graph explodeFractalGeometry.dyn (Dynamo 2.0.3.8810)

number = DoubleInput(10)
number_2 = DoubleInput(1)
indentedCubes = Custom[Fractals.indentedCubes](startLength=number, stopLength=number_2)  # Creates an indented cubes like structure that stops at a certain cube length
byUnion = Solid.ByUnion(solids=indentedCubes)
explodeFractalGeometry = Custom[Fractals.explodeFractalGeometry](fractalGeometry=byUnion)  # Takes in fractal geometry list and returns its exploded data
