# Dynamo graph fractalOctahedronSolids.dyn (Dynamo 2.0.3.8810)

number = DoubleInput(10)  # graph input
number_2 = DoubleInput(0.5)  # graph input
fractalOctahedronSolids = Custom[Fractals.fractalOctahedronSolids](baseLength=number, stopArea=number_2)  # Create fractal octahedron solids by baseLength and faceArea stop parameter
