# Dynamo graph indentedCubeByLengthCenterPoint.dyn (Dynamo 2.0.3.8810)

stop_length = DoubleInput(1)  # graph input
start_length = DoubleInput(5)  # graph input
select_point_on_face = DSPointOnElementSelection()  # 1 picked in the model; graph input
code_block = CodeBlock(a=select_point_on_face) { a[0]; }
indentedCubeByLengthCenterPoint = Custom[Fractals.indentedCubeByLengthCenterPoint](stopLength=stop_length, startLength=start_length, centerPoint=code_block)  # Defines an indented cube strucutre by center point the structure stops at a given cube length
byUnion = Solid.ByUnion(solids=indentedCubeByLengthCenterPoint)
sat_file_path = Filename("C:\Users\n\Desktop\solidsUnioned")  # graph input
exportToSAT = Geometry.ExportToSAT(geometry=byUnion, filePath=sat_file_path)
materials_template_file_path = Filename("E:\Programming\RevitDynamo\packages\materialtemplate.rft")  # graph input
family_mass_name = StringInput("indentedCubes")  # graph input
extractSAT__ImportToRevit = Custom[Revit.ImportExport.extractSAT__ImportToRevit](filePathSAT=exportToSAT, materialsTemplatePath=materials_template_file_path, familyName=family_mass_name)  # Extracts a SAT geometry and imports the geometry into Revit as a mass family Note : The python code is not made by Easen It Node for more information look for Spring Nodes : https://dynamopackages.com/
