# Dynamo graph indentedCubes.dyn (Dynamo 2.0.3.8810)

start_length = DoubleInput(5)  # graph input
stop_length = DoubleInput(1)  # graph input
indentedCubes = Custom[Fractals.indentedCubes](startLength=start_length, stopLength=stop_length)  # Creates an indented cubes like structure that stops at a certain cube length .
byUnion = Solid.ByUnion(solids=indentedCubes)
sat_file_path = Filename("C:\Users\n\Desktop\solidsUnioned")  # graph input
exportToSAT = Geometry.ExportToSAT(geometry=byUnion, filePath=sat_file_path)
materials_template_file_path = Filename("E:\Programming\RevitDynamo\packages\materialtemplate.rft")  # graph input
family_mass_name = StringInput("Mass")  # graph input
extractSAT__ImportToRevit = Custom[Revit.ImportExport.extractSAT__ImportToRevit](filePathSAT=exportToSAT, materialsTemplatePath=materials_template_file_path, familyName=family_mass_name)  # Extracts a SAT geometry and imports the geometry into Revit as a mass family Note : The python code is not made by Easen It Node for more information look for Spring Nodes : https://dynamopackages.com/
