# Dynamo graph mengerSponge.dyn (Dynamo 2.0.3.8810)

stop_volume = DoubleInput(400)  # graph input
cube_side_length = DoubleInput(20)  # graph input
mengerSponge = Custom[Fractals.mengerSponge](stopVolume=stop_volume, cubeLength=cube_side_length)  # Creates a Menger Spong fractal structure
byUnion = Solid.ByUnion(solids=mengerSponge)
file_path = Filename("No file selected.")  # graph input
exportToSAT = Geometry.ExportToSAT(geometry=byUnion, filePath=file_path)
