# Dynamo graph randomRecursiveTree.dyn (Dynamo 2.0.3.8810)

branches_in_level = DoubleInput(5)  # graph input
stop_creation_level = DoubleInput(3)  # graph input
maximum_length = DoubleInput(2)  # graph input
root_curve = DSModelElementSelection()  # 1 picked in the model; graph input
curves = Element.Curves(element=root_curve)
code_block = CodeBlock(a=curves) { a[0]; }
randomRecursiveTree = Custom[Fractals.randomRecursiveTree](branchesInlevel=branches_in_level, stoppingLevel=stop_creation_level, maxRandomLength=maximum_length, rootLine=code_block)  # Creating a random length given the maximum length for branches tree structure
code_block_2 = CodeBlock { 0; }
planeAtParameter = Curve.PlaneAtParameter(curve=randomRecursiveTree, param=code_block_2)
code_block_3 = CodeBlock { 0.01; }
byPlaneRadius = Circle.ByPlaneRadius(plane=planeAtParameter, radius=code_block_3)
sweepAsSolid = Curve.SweepAsSolid(curve=byPlaneRadius, path=randomRecursiveTree)
