# Dynamo graph recursiveCubes.dyn (Dynamo 2.0.3.8810)

byLengths = Cuboid.ByLengths()
stopping_volume = DoubleInput(0.1)
recursiveCubes = Custom[Fractals.recursiveCubes](startingCube=byLengths, stoppingVolume=stopping_volume)  # Creates a recursive outward cubes structure that stops at a given volume
byUnion = Solid.ByUnion(solids=recursiveCubes)
file_path = Filename("C:\Users\n\Desktop\Solids")
exportToSAT = Geometry.ExportToSAT(geometry=byUnion, filePath=file_path)
file_path_2 = Filename("E:\Odds & Ends\DC\packages\materialtemplate.rft")
string = StringInput("mass1")
extractSAT__ImportToRevit = Custom[Revit.ImportExport.extractSAT__ImportToRevit](filePathSAT=exportToSAT, materialsTemplatePath=file_path_2, familyName=string)  # Extracts a SAT geometry and imports the geometry into Revit as a mass family Note : The python code is not made by Easen It Node for more information look for Spring Nodes : https://dynamopackages.com/
