# Dynamo graph rippleCircles.dyn (Dynamo 2.0.3.8810)

stopping_radius = DoubleInput(1)  # graph input
center_point_x = DoubleInput(1)  # graph input
center_point_y = DoubleInput(1)  # graph input
center_point_z = DoubleInput(1)  # graph input
byCoordinates = Point.ByCoordinates(x=center_point_x, y=center_point_y, z=center_point_z)
root_radius = DoubleInput(10)  # graph input
byCenterPointRadius = Circle.ByCenterPointRadius(centerPoint=byCoordinates, radius=root_radius)
random_range = DoubleInput(2)  # graph input
rippleCircles = Custom[Fractals.rippleCircles](stoppingRadius=stopping_radius, firstCircle=byCenterPointRadius, randomRange=random_range)  # Creates a ripple curve recursively out a starting circle to a stopping radius
