# Dynamo graph sierpinskiTriangles.dyn (Dynamo 2.0.3.8810)

start_length = DoubleInput(10)  # graph input
stop_length = DoubleInput(0.1)  # graph input
sierpinskiTriangles = Custom[Fractals.sierpinskiTriangles](startLength=start_length, stopLength=stop_length)  # Creates a polygon curve to form Sierpinski Triangles
