# Dynamo graph symmetricalRecursiveTree.dyn (Dynamo 2.0.3.8810)

code_block = CodeBlock { 4; }
code_block_2 = CodeBlock { 3; }
select_model_element = DSModelElementSelection()  # 1 picked in the model; graph input
curves = Element.Curves(element=select_model_element)
code_block_3 = CodeBlock(a=curves) { a[0]; }
code_block_4 = CodeBlock { 4; }
code_block_5 = CodeBlock { 10; }
symmetricalRecursiveTree = Custom[Fractals.symmetricalRecursiveTree](numberOfBranchees=code_block, branchLength=code_block_2, baseLine=code_block_3, stopLevel=code_block_4, alphaAngle=code_block_5)  # Creates a symmetrical tree like structure
